# Grasshopper definition 07022023_GHandJuliaConnected3D.gh (Grasshopper 1.0.7)
# plug-ins: FDMremote, Kangaroo2 Components

pipeline = GeometryPipeline(
    GroupByLayer=False,
    GroupByType=False,
    IncludeHidden=True,
    IncludeLocked=True,
    LayerFilter="*",
    NameFilter="*",
    SublayerFiltering=True,
    TypeFilter=0)
extent_z = Slider(7, range=1..101)
series = Series(Start=0, Step=1, Count=extent_z)
recgrid = Rectangular(Plane=PlaneXY(0, 0, 0), SizeX="1", SizeY="1", ExtentX=Slider(14, range=2..100), ExtentY=Slider(8, range=1..101))  # -> flatten(Cells), flatten(Points)
Z = UnitZ(Factor=series)  # -> graft(UnitVector)
panel = Panel("""2
1""")
panel_2 = Panel("""0
3""")
move = Move(Geometry=recgrid.Points, Motion=Z)  # -> Geometry, Transform
move_2 = Move(Geometry=recgrid.Cells, Motion=Z)  # -> Geometry, Transform
pt = Point(recgrid.Points)
line = LineSDL(Start=move.Geometry, Direction=Vector(0, 0, 1), Length=1)
inter = InterconnectPoints(Pts=pt)
explode = Explode(Curve=recgrid.Cells, Recursive=True)  # -> flatten(Segments), Vertices
merge = Merge(Data1=flatten(move_2.Geometry), Data2=flatten(line))
line_2 = Line(inter)
item = ListItem(List=explode.Vertices, Index=panel_2, Wrap=True)
item_2 = ListItem(List=explode.Vertices, Index=panel, Wrap=True)
pt_2 = Point(recgrid.Points)
dupln = RemoveDuplicateLines(Lines=explode.Segments, Tolerance=0.01)
ln = Line(StartPoint=item, EndPoint=item_2)  # -> flatten(Line)
line_3 = Line(flatten([dupln, ln]))
filter = StreamFilter(Gate=Toggle(True), Stream0=line_2, Stream1=line_3)
supoprt_points = ListItem(List=pt_2, Index=0, Wrap=True)  # -> Item, Item1, Item2
create = CreateNetwork(
    Edges=flatten(filter),
    Anchors=[supoprt_points.Item, supoprt_points.Item1, supoprt_points.Item2],
    ForceDensities=1,
    IntersectionTolerance=0.1)
info = NetworkInformation(FDMNetwork=create)  # -> Nodes, Edges, EdgeLengths, StartIndex, EndIndex, Anchors, ForceDensities, NumberEdges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
pdecon = Deconstruct(Point=info.Nodes)  # -> XComponent, YComponent, ZComponent
sort = SortList(Keys=pdecon.YComponent)  # -> Keys, ValuesA
sort_2 = SortList(Keys=pdecon.XComponent)  # -> Keys, ValuesA
item_3 = ListItem(List=sort_2.Keys, Index=-1, Wrap=True)
item_4 = ListItem(List=sort.Keys, Index=-1, Wrap=True)
ma = MassAddition(Input=sort_2.Keys)  # -> Result, PartialResults
lng = ListLength(List=pdecon.XComponent)
division = Division(A=ma.Result, B=lng)
expression = Expression(x=pdecon.XComponent, y=division, Expression="abs(x-y)")
equals = Equality(FirstNumber=pdecon.XComponent, SecondNumber="0")  # -> Equality, Inequality
equals_2 = Equality(FirstNumber=pdecon.XComponent, SecondNumber=item_3)  # -> Equality, Inequality
equals_3 = Equality(FirstNumber=pdecon.YComponent, SecondNumber=item_4)  # -> Equality, Inequality
equals_4 = Equality(FirstNumber=pdecon.XComponent, SecondNumber=division)  # -> Equality, Inequality
equals_5 = Equality(FirstNumber=pdecon.YComponent, SecondNumber="0")  # -> Equality, Inequality
smaller = SmallerThan(FirstNumber=expression, SecondNumber="0.5")  # -> SmallerThan, OrEqualTo
or = GateOr(A=equals.Equality, B=equals_2.Equality)
and = GateAnd(A=equals_3.Equality, B=smaller.SmallerThan)
and_2 = GateAnd(A=equals_5.Equality, B=or)
cull = CullPattern(List=info.Nodes, CullPattern=and)
cull_2 = CullPattern(List=pt_2, CullPattern=and_2)
loads = ItemIndex(List=info.Nodes, Item=cull)
supports = ItemIndex(List=pt_2, Item=cull_2)
panel_3 = Panel(pt_2)
pt2num = PointsToNumbers(Points=graft(info.Nodes), Mask=4)  # -> simplify(Numbers)
date = ConstructDate(Year=2023, Month=2, Day=7, Hour=12, Minute=0, Second=0)
panel_4 = Panel(date)
python = GhPythonScript(
    elements_i=info.StartIndex,
    elements_j=info.EndIndex,
    points=pt2num,
    supports=supports,
    loads=loads,
    maxVf=Slider(0.16, range=0.01..0.5),
    time=panel_4)  # -> out, c, output, supports; inputs elements_i: list, elements_j: list, points: tree, supports: list, loads: list
# ---------- python: Python ----------
__author__ = "pitipatw"
__version__ = "2023.01.24"

import rhinoscriptsyntax as rs
import ghpythonlib.treehelpers as th
import json

temp = {'fc_prime': fc_prime ,\
'rho_c' : rho_c , 'PTsteel_r' : PTsteel_r ,\
'PTsteel_area' :PTsteel_area,\
'PTpos' : PTpos,\
'TEST_tuple' : (fc_prime, PTsteel_r)}
c = json.dumps(temp)

output = dict() 
output["unit"] = "meter"
#input materials detail
materials = dict()
materials = [{"G12": 80760000.0,
            "E": 1000.0,
            "name": "DummyMaterial",
            "family": "DummyMaterial",
            "density": 78.5,
            "elem_tags": [],
            "E_unit": "kN/m2",
            "type_name": "ISO",
            "fy": 235000.0,
            "density_unit": "kN/m3",
            "fy_unit": "kN/m2",
            "G12_unit": "kN/m2"}]
output["materials"] = materials

#make a default of 2 but then able to put in 3
output["dimension"] = 2
output["generate_time"] = time

output["model_type"] = "truss"
output["model_name"] = "Pitipat_SMBT"
output["_info"] = "myFirstGHtoJuliaTopOpt"
output["TO_model_type"] = "ground_mesh"

cross_secs = dict() 
cross_secs["A"] = 1 
cross_secs["name"] = ""
cross_secs["family"] = "DummyCroSecByPitipat"
cross_secs["elem_tags"] = []
cross_secs["A_unit"] = "m2" 
output["cross_secs"] = [cross_secs]


nodes = dict()
nodes_list = list()
tree = th.tree_to_list(points, retrieve_base = None)
#for i in range(0,len(tree[0])) :
for i in range(len(tree)):
    dummy = dict()
    dummy["node_ind"] = i
    dummy["point"] = tree[i][0:2]
    nodes_list.append(dummy)

output["nodes"] = nodes_list
elements_list = list() 
for i in range(len(elements_i)) : 
    dummy = dict() 
    dummy["end_node_inds"] = [ elements_i[i], elements_j[i]]
    dummy["elem_tag"] = ""
    elements_list.append(dummy)

loadcases_dict = dict()
#this is load case "0"

loadcases_0 = dict()
loadcases_0["lc_ind"] = 0
ploads = dict()
load_list = list()
for i in loads :
    dummy = dict()
    dummy["node_ind"] = int(i)
    dummy["force"] = [0,-1]
    dummy["loadcase"] = str(i)
    dummy["force_unit"] = "kN"
    load_list.append(dummy)
loadcases_0["ploads"] = load_list
loadcases_dict["0"] = loadcases_0

output["loadcases"] = loadcases_dict


output["elements"] = elements_list
output["node_num"] = len(tree)
output["element_num"] = len(elements_list) 

supports_list = list()
check = True
for i in supports: 
    dummy = dict()
    dummy["node_ind"] = i
    if check :
        dummy["condition"] = [1,1]
        #check = False
    else :
        dummy["condition"] = [0,1]
        
    supports_list.append(dummy)
output["supports"] = supports_list


output["maxVf"] = maxVf
#nodes_input = points
#remove the curry brackets
#print(nodes_input)
#output["nodes"] = nodes



#print(json.dumps(tree, indent = 4))

print(json.dumps(output))
# ---------- end python ----------
panel_5 = Panel(python.out)
websocket_client_start = WebsocketClientStart(Address="ws://127.0.0.1:2000/", InitalMessage=python.out, Reset=Button())
websocket_client_receiver = WebsocketClientReceiver(WebsocketObjects=websocket_client_start, AutoUpdate=Toggle(True))  # -> Message, Status
panel_6 = Panel(websocket_client_receiver.Message)
panel_7 = Panel(websocket_client_receiver.Status)
panel_8 = Panel("fc_prime")
