# Grasshopper definition 3D_TopOpt_13FEB.gh (Grasshopper 1.0.7)
# plug-ins: FDMremote, Kangaroo2 Components, Pufferfish

# ---- group: TopOpt Control
minumum_members_length = Slider(2.9, range=0..10)
# Control Panel
max_volume_fraction = Slider(0.122, range=0.005..0.31)
# This is a Topology Optimization using TopOpt.jl
# 
# last major modified: 10 Feb 2023
button = Button()

# ----
extent_z = Slider(2, range=1..4)

recgrid = Rectangular(Plane=PlaneXY(0, 0, 0), SizeX=1, SizeY=1, ExtentX=Slider(5, range=2..12), ExtentY=Slider(4, range=1..11))  # -> flatten(Cells), flatten(Points)
series = Series(Start=1, Step=1, Count=extent_z)
Z = UnitZ(Factor=series)  # -> graft(UnitVector)
move = Move(Geometry=recgrid.Cells, Motion=Z)  # -> Geometry, Transform
move_2 = Move(Geometry=recgrid.Points, Motion=Z)  # -> Geometry, Transform
line = LineSDL(Start=move_2.Geometry, Direction=Vector(0, 0, -1), Length=1)
# To do
# 
# visualize support points
# 
# Specified applied load values
# 
# visualize load points and direction (scales with value)
# 
# 
# movable points (optional: movable groundstructure)
# 
# color
merge = Merge(Data1=flatten(move.Geometry), Data2=recgrid.Cells, Data3=flatten(line))
explode = Explode(Curve=merge, Recursive=True)  # -> Segments, flatten(Vertices)
duppt = RemoveDuplicatePts(Points=explode.Vertices, Tolerance=0.01)
inter = InterconnectPoints(Pts=flatten(duppt))
len = Length(Curve=inter)
smaller = SmallerThan(FirstNumber=len, SecondNumber=minumum_members_length)  # -> SmallerThan, OrEqualTo
cull = CullPattern(List=inter, CullPattern=smaller.SmallerThan)
pipeline = GeometryPipeline(
    GroupByLayer=False,
    GroupByType=False,
    IncludeHidden=True,
    IncludeLocked=True,
    LayerFilter="support points",
    NameFilter="*",
    SublayerFiltering=True,
    TypeFilter=1)
pipeline_2 = GeometryPipeline(
    GroupByLayer=False,
    GroupByType=False,
    IncludeHidden=True,
    IncludeLocked=True,
    LayerFilter="load points",
    NameFilter="*",
    SublayerFiltering=True,
    TypeFilter=1)

# ----
# Ground Structure
pt = Point(duppt)
line_2 = Line(cull)

supoprt_points = ListItem(List=pt, Index=0, Wrap=True)  # -> Item, Item1, Item2
create = CreateNetwork(
    Edges=flatten(line_2),
    Anchors=[supoprt_points.Item, supoprt_points.Item1, supoprt_points.Item2],
    ForceDensities=1,
    IntersectionTolerance=0.1)
info = NetworkInformation(FDMNetwork=create)  # -> Nodes, Edges, EdgeLengths, StartIndex, EndIndex, Anchors, ForceDensities, NumberEdges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
# For quick test, no layers
# supports on all lowest points
# loads on all highest points
pdecon = Deconstruct(Point=info.Nodes)  # -> XComponent, YComponent, ZComponent
sort = SortList(Keys=pdecon.ZComponent, ValuesA=info.Nodes)  # -> Keys, ValuesA
item = ListItem(List=info.Nodes, Index=info.EndIndex, Wrap=True)
item_2 = ListItem(List=info.Nodes, Index=info.StartIndex, Wrap=True)
mindex = MemberIndex(Set=info.Nodes, Member=pipeline)  # -> flatten(Index), Count
mindex_2 = MemberIndex(Set=info.Nodes, Member=pipeline_2)  # -> flatten(Index), Count
item_3 = ListItem(List=sort.Keys, Index=0, Wrap=True)  # -> Item1, Item
equalst = EqualityWithinTolerance(FirstNumber=pdecon.ZComponent, SecondNumber=item_3.Item1, Tolerance=0.001)  # -> Equality, Inequality
equalst_2 = EqualityWithinTolerance(FirstNumber=pdecon.ZComponent, SecondNumber=item_3.Item, Tolerance=0.001)  # -> Equality, Inequality
pt2num = PointsToNumbers(Points=graft(info.Nodes), Mask=4)  # -> simplify(Numbers)
cull_2 = CullPattern(List=info.Nodes, CullPattern=equalst.Equality)
cull_3 = CullPattern(List=info.Nodes, CullPattern=equalst_2.Equality)
time = Time()
load_inds = ItemIndex(List=info.Nodes, Item=cull_2)
support_inds = ItemIndex(List=info.Nodes, Item=cull_3)
python = GhPythonScript(
    elements_i=info.StartIndex,
    elements_j=info.EndIndex,
    points=pt2num,
    supports=support_inds,
    loads=load_inds,
    maxVf=max_volume_fraction,
    time=time)  # -> out; inputs elements_i: list, elements_j: list, points: tree, supports: list, loads: list
# ---------- python: Python ----------
__author__ = "pitipatw"
__version__ = "2023.01.24"

import rhinoscriptsyntax as rs
import ghpythonlib.treehelpers as th
import json

# assign static values
output = dict() 
output["model_name"] = "Pitipat_SMBT"
output["unit"] = "meter"
output["generate_time"] = time

output["model_type"] = "truss"

output["_info"] = "myFirstGHtoJuliaTopOpt"
output["TO_model_type"] = "ground_mesh"
# Processing Inputs
tree = th.tree_to_list(points, retrieve_base = None)

#input materials detail
materials = dict()
materials = [{"G12": 80760000.0,
            "E": 1000.0,
            "name": "DummyMaterial",
            "family": "DummyMaterial",
            "density": 78.5,
            "elem_tags": [],
            "E_unit": "kN/m2",
            "type_name": "ISO",
            "fy": 235000.0,
            "mu": 0.3,
            "density_unit": "kN/m3",
            "fy_unit": "kN/m2",
            "G12_unit": "kN/m2"}]
output["materials"] = materials

#make a default of 2 but then able to put in 3
output["dimension"] = 3




cross_secs = dict() 
cross_secs["A"] = 1 
cross_secs["name"] = ""
cross_secs["family"] = "DummyCroSecByPitipat"
cross_secs["elem_tags"] = []
cross_secs["A_unit"] = "m2" 
cross_secs["Iy"]= 2.1106547193827362e-06
cross_secs["Iz"]= 2.1106547193827362e-06
cross_secs["Jx"]= 4.2213094387654724e-06
cross_secs["name"]= "RO114.3/4"
output["cross_secs"] = [cross_secs]


nodes = dict()
nodes_list = list()
for i in range(len(tree)):
    dummy = dict()
    dummy["node_ind"] = i
    dummy["point"] = tree[i][0:3]
    dummy["is_grounded"] = False
    nodes_list.append(dummy)

output["nodes"] = nodes_list
elements_list = list() 
for i in range(len(elements_i)) : 
    dummy = dict() 
    dummy["elem_ind"] = i
    dummy["end_node_inds"] = [ elements_i[i], elements_j[i]]
    dummy["elem_tag"] = ""
    dummy["bending_stiff"] = False
    elements_list.append(dummy)

supports_list = list()
check = True
for i in supports: 
    dummy = dict()
    dummy["node_ind"] = i
    if check :
        dummy["condition"] = [1,1,1,0,0,0]
        #check = False
    else :
        dummy["condition"] = [0,1]
    supports_list.append(dummy)
output["supports"] = supports_list

output["joints"] = []

loadcases_dict = dict()
#this is load case "0"
loadcases_0 = dict()
loadcases_0["lc_ind"] = 0
ploads = dict()
load_list = list()
for i in loads :
    dummy = dict()
    dummy["node_ind"] = int(i)
    dummy["force"]  = [0.0, 0.0, -1.0]
    dummy["moment"] = [0.0, 0.0, 0.0]
    dummy["loadcase"] = str(i)
    dummy["force_unit"] = "kN"
    load_list.append(dummy)
loadcases_0["ploads"] = load_list
loadcases_0["eloads"] = []
loadcases_0["gravity"] = ""
loadcases_dict["0"] = loadcases_0

output["loadcases"] = loadcases_dict


output["elements"] = elements_list

#====Node and Element numbers are here!====
output["node_num"] = len(tree)
output["element_num"] = len(elements_list) 
#====

output["maxVf"] = maxVf


print(json.dumps(output))
# ---------- end python ----------

# ---- group: WebSockets for Julia
websocket_client_start = WebsocketClientStart(Address="ws://127.0.0.1:2000/", InitalMessage=python, Reset=button)
websocket_client_receiver = WebsocketClientReceiver(WebsocketObjects=websocket_client_start, AutoUpdate=Toggle(True))  # -> Message, Status
panel = Panel(websocket_client_receiver.Status)
panel_2 = Panel(websocket_client_receiver.Message)

# ----
vec2pt = Vector2Pt(PointA=item_2, PointB=item, Unitize=False)  # -> Vector, Length
python_2 = GhPythonScript(input=panel_2, points=pt2num)  # -> out, output; inputs points: tree
# ---------- python_2: Python ----------
__author__ = "pitipatw"
__version__ = "2023.01.24"

import rhinoscriptsyntax as rs
import ghpythonlib.treehelpers as th
import json


output = []
list_points= th.tree_to_list(points, retrieve_base = None)
print(list_points)
dictofelements = json.loads(input)
for i in range(len(dictofelements)):
    temp = (dictofelements[str(i)])
    #, points[i])
    output.append(temp)
    
    
print(output[1])
print(output)
# ---------- end python_2 ----------
division = Division(A=python_2.output, B=Slider(38, range=10..100))
item_4 = ListItem(List=python_2.output, Index="0", Wrap=True)
cir = Circle(Plane=PlaneXY(0, 0, 0), Radius=item_4)
circle = CircleCNR(Center=item_2, Normal=vec2pt.Vector, Radius=division)
extr = Extrude(Base=circle, Direction=vec2pt.Vector)
panel_3 = Panel(python_2.out)
panel_4 = Panel(item_4)

# ==== cluster Time
time = ConstructTime(Hour=20, Minute=48, Second=0)
date = ConstructDate(Year=2023, Month=2, Day=7, Hour=12, Minute=0, Second=0)
cdate = CombineDateTime(Date=date, Time=time)
panel = Panel(cdate)
panel_2 = ClusterOutput(panel)
