# Grasshopper definition 3D_TopOpt_2MAR.gh (Grasshopper 1.0.7)
# plug-ins: FDMremote, Kangaroo2 Components, Pufferfish, Karamba3D, MetaHopper

# ---- group: OLD
number_slider = Slider(1, range=1..52)  # disabled
number_slider_2 = Slider(1, range=0..101)  # disabled
extent_z = Slider(1, range=1..51)  # disabled

# ----
geo = Geometry(<brep referenced from the Rhino model>)
volume = Volume(Geometry=geo)  # -> Volume, Centroid
circle = CircleCNR(Center=volume.Centroid, Normal=Vector(0, 0, 1), Radius=Slider(4.318, range=0..10))
qrsettings = QuadRemeshSettings(TargetCount="100", AdaptiveSize=0, AdaptiveCount=False, HardEdges=False, SeamEdges=0, Symmetry=0, GuideCurves=0)
area = Area(Geometry=circle)  # -> Area, Centroid
divide = DivideCurve(Curve=circle, Count="1", Kinks=False)  # -> Points, Tangents, Parameters
mesh = MeshBrep(
    Brep=geo,
    Settings={GridMaxCount=0, GridMinCount=16, JaggedSeams=False, MaxEdgeLength=0, MinEdgeLength=0.0001, MinTolerance=0, Refine=True, RefineAngle=0, RelativeTolerance=0.65, SimplePlanes=True, Tolerance=0})
ln = Line(StartPoint=area.Centroid, EndPoint=divide.Points)
qrmesh = QuadRemesh(Mesh=mesh, Settings=qrsettings)
len = Length(Curve=ln)
demesh = DeconstructMesh(Mesh=qrmesh)  # -> Vertices, Faces, Colours, Normals
pdecon = Deconstruct(Point=area.Centroid)  # -> XComponent, YComponent, ZComponent
pt = Point(demesh.Vertices)
inter = InterconnectPoints(Pts=flatten(pt))  # disabled

# ---- group: Adam's
# 5 4 6
# 0.27
# "2"
# 0.27
# fail
nz = Slider(6, range=0..10)
ny = Slider(5, range=0..10)
lx = Slider(20, range=0..100)
ly = Slider(20, range=0..100)
nx = Slider(6, range=0..10)
lz = Slider(20, range=0..100)
expression = Expression(L=lx, x=nx, Expression="L/(x-1)")
expression_2 = Expression(L=lz, x=nz, Expression="L/(x-1)")
expression_3 = Expression(L=ly, x=ny, Expression="L/(x-1)")
origin_point = ConstructPoint(XCoordinate=0, YCoordinate=0, ZCoordinate=0)
box = CenterBox(Base=PlaneXY(0, 0, 0), X=expression, Y=expression_3, Z=expression_2)
arrbox = BoxArray(Geometry=origin_point, Cell=box, XCount=nx, YCount=ny, ZCount=nz)  # -> Geometry, Transform

# ---- group: TopOpt Control
max_members_length = Slider(20, range=0..20)
# This is a Topology Optimization using TopOpt.jl
# 
# last major modified: 10 Feb 2023
# If 2D then put a z axis constriain on every node
# Control Panel
button = Button()
gs_visibility = BooleanToggle(True)
max_volume_fraction = Slider(0.074, range=0.005..0.705)
list = ValueList({"2D": 0, "3D": 1}, selected="3D")

# ---- group: OLD
recgrid = Rectangular(Plane=PlaneXY(0, 0, 0), SizeX=1, SizeY=1, ExtentX=number_slider, ExtentY=number_slider_2)  # -> flatten(Cells), flatten(Points); disabled
series = Series(Start=1, Step=1, Count=extent_z)  # disabled
Z = UnitZ(Factor=series)  # -> graft(UnitVector); disabled
move = Move(Geometry=recgrid.Cells, Motion=Z)  # -> Geometry, Transform; disabled
move_2 = Move(Geometry=recgrid.Points, Motion=Z)  # -> Geometry, Transform; disabled
line = LineSDL(Start=move_2.Geometry, Direction=Vector(0, 0, -1), Length=1)  # disabled
merge = Merge(Data1=flatten(move.Geometry), Data2=recgrid.Cells, Data3=flatten(line))  # disabled
explode = Explode(Curve=merge, Recursive=True)  # -> Segments, flatten(Vertices); disabled
duppt = RemoveDuplicatePts(Points=explode.Vertices, Tolerance=0.01)  # disabled
inter_2 = InterconnectPoints(Pts=flatten(pt))  # disabled
len_2 = Length(Curve=inter_2)  # disabled
smaller = SmallerThan(FirstNumber=len_2, SecondNumber=max_members_length)  # -> SmallerThan, OrEqualTo; disabled
# 5 4 6
# 0.27
# 3
# 0.27
# pass
cull = CullPattern(List=inter_2, CullPattern=smaller.SmallerThan)  # disabled

# ---- group: Remove Dups
# To do
# 
# visualize support points
# 
# Specified applied load values
# 
# 
# 
# movable points (optional: movable groundstructure)
# 
# color
# 
# Specify domain size
# and the nX,nY,nZ are divisions instead of keep adding
inter_3 = InterconnectPoints(Pts=arrbox.Geometry)
duppt_2 = RemoveDuplicatePts(Points=arrbox.Geometry, Tolerance=0.01)

# ---- group: Length Constraint
len_3 = Length(Curve=inter_3)  # disabled
smaller_2 = SmallerThan(FirstNumber=len_3, SecondNumber=max_members_length)  # -> SmallerThan, OrEqualTo; disabled
cull_2 = CullPattern(List=inter_3, CullPattern=smaller_2.SmallerThan)  # disabled

# ----
toggle = BooleanToggle(False)
filter = StreamFilter(Gate=toggle, Stream0=inter_3, Stream1=cull_2)

# ---- group: Ground Structure
pt_2 = Point(duppt_2)
line_2 = Line(filter)

# ---- group: Preprocessing
supoprt_points = ListItem(List=pt_2, Index=0, Wrap=True)  # -> Item, Item1, Item2
create = CreateNetwork(
    Edges=flatten(line_2),
    Anchors=[supoprt_points.Item, supoprt_points.Item1, supoprt_points.Item2],
    ForceDensities=1,
    IntersectionTolerance=0.1)
info = NetworkInformation(FDMNetwork=create)  # -> Nodes, Edges, EdgeLengths, StartIndex, EndIndex, Anchors, ForceDensities, NumberEdges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

# ----
# For quick test, no layers
# supports on all lowest points
# loads on all highest points
pdecon_2 = Deconstruct(Point=info.Nodes)  # -> XComponent, YComponent, ZComponent
expression_4 = Expression(
    x=pdecon_2.XComponent,
    y=pdecon_2.YComponent,
    x0=pdecon.XComponent,
    y0=pdecon.YComponent,
    r=len,
    tol=Slider(0.25, range=0..1),
    Expression="(x-x0)^2 + (y-y0)^2 - r^2 > tol")
panel = Panel(expression_4)
onoff = EnableDisableObject(Enabled=toggle, AllObjects_Object=[smaller_2, cull_2, len_3])

# ---- group: background
hideshow = HideShowObjectPreview(Visible=gs_visibility, AllObjects_Object=line_2)

# ----
pipeline = GeometryPipeline(
    GroupByLayer=False,
    GroupByType=False,
    IncludeHidden=True,
    IncludeLocked=True,
    LayerFilter="support points",
    NameFilter="*",
    SublayerFiltering=True,
    TypeFilter=1)
pipeline_2 = GeometryPipeline(
    GroupByLayer=False,
    GroupByType=False,
    IncludeHidden=True,
    IncludeLocked=True,
    LayerFilter="load points",
    NameFilter="*",
    SublayerFiltering=True,
    TypeFilter=1)
mindex = MemberIndex(Set=info.Nodes, Member=pipeline_2)  # -> flatten(Index), Count
mindex_2 = MemberIndex(Set=info.Nodes, Member=pipeline)  # -> flatten(Index), Count

sort_y = SortList(Keys=pdecon_2.YComponent)  # -> Keys, ValuesA
sort_z = SortList(Keys=pdecon_2.ZComponent)  # -> Keys, ValuesA
sort_x = SortList(Keys=pdecon_2.XComponent)  # -> Keys, ValuesA
item = ListItem(List=sort_z.Keys, Index=0, Wrap=True)  # -> Item1, Item
item_2 = ListItem(List=sort_y.Keys, Index=0, Wrap=True)  # -> Item1, Item
division = Division(A=item_2.Item1, B=2)
panel_2 = Panel(division)
expression_5 = Expression(x=pdecon_2.YComponent, y=division, Expression="abs(x-y)")
item_3 = ListItem(List=sort_x.Keys, Index=0, Wrap=True)  # -> Item1, Item
division_2 = Division(A=item_3.Item1, B=2)
panel_3 = Panel(division_2)
expression_6 = Expression(x=pdecon_2.XComponent, y=division_2, Expression="abs(x-y)")
item_4 = ListItem(List=info.Nodes, Index=info.StartIndex, Wrap=True)
item_5 = ListItem(List=info.Nodes, Index=info.EndIndex, Wrap=True)
list_2 = ValueList({"All": 0, "Mid X": 1, "Mid Y": 2, "Mid X&Y": 3, "cirle": 4}, selected="Mid X")
equalst = EqualityWithinTolerance(FirstNumber=pdecon_2.YComponent, SecondNumber=item_2.Item1, Tolerance=0.001)  # -> Equality, Inequality
equalst_2 = EqualityWithinTolerance(FirstNumber=pdecon_2.ZComponent, SecondNumber=item.Item, Tolerance=0.001)  # -> Equality, Inequality
equalst_3 = EqualityWithinTolerance(FirstNumber=pdecon_2.XComponent, SecondNumber="1", Tolerance=0.001)  # -> Equality, Inequality; disabled
filter_2 = StreamFilter(Gate=list)
equalst_4 = EqualityWithinTolerance(FirstNumber=pdecon_2.YComponent, SecondNumber=item_2.Item, Tolerance=0.001)  # -> Equality, Inequality
or = GateOr(A=equalst.Equality, B=equalst_4.Equality)
equalst_5 = EqualityWithinTolerance(FirstNumber=pdecon_2.ZComponent, SecondNumber=item.Item1, Tolerance=0.001)  # -> Equality, Inequality
pt2num = PointsToNumbers(Points=graft(info.Nodes), Mask=4)  # -> simplify(Numbers)
and = GateAnd(A=equalst_2.Equality, B=or, C=equalst_3.Inequality)
cull_3 = CullPattern(List=info.Nodes, CullPattern=equalst.Equality)
cull_4 = CullPattern(List=info.Nodes, CullPattern=equalst_4.Equality)
and_2 = GateAnd(A=and, B=equalst_4.Equality)
smaller_3 = SmallerThan(FirstNumber=expression_5, SecondNumber=Slider(0.5, range=0..1))  # -> SmallerThan, OrEqualTo
smaller_4 = SmallerThan(FirstNumber=expression_6, SecondNumber=Slider(1, range=0..1))  # -> SmallerThan, OrEqualTo
and_3 = GateAnd(A=smaller_4.OrEqualTo, B=smaller_3.OrEqualTo)
filter_3 = StreamFilter(Gate=list_2, Stream0="1", Stream1=smaller_4.OrEqualTo, Stream2=smaller_3.OrEqualTo, Stream3=and_3, Stream4=expression_4)
and_4 = GateAnd(A=filter_3, B=equalst_5.Equality)
cull_5 = CullPattern(List=info.Nodes, CullPattern=and_4)
cull_6 = CullPattern(List=info.Nodes, CullPattern=and_2)
time = Time()
cull_7 = CullPattern(List=info.Nodes, CullPattern=equalst_2.Equality)
load_inds = ItemIndex(List=info.Nodes, Item=cull_3)
support_inds = ItemIndex(List=info.Nodes, Item=cull_4)
load_inds_2 = ItemIndex(List=info.Nodes, Item=cull_5)
support_inds_2 = ItemIndex(List=info.Nodes, Item=cull_7)
suppor_rollert_inds = ItemIndex(List=info.Nodes, Item=cull_6)
id = Panel(load_inds_2)
lng = ListLength(List=load_inds_2)
supports_inds = Number(support_inds_2)
load_inds_3 = Number(load_inds_2)
y_kn = Panel("""0
0
0
0
0
0
0
0
0
0
0
0
0
0
0
0
0
0
0
0""")
z_kn = Panel("""-10
-10
-10
-10
-10
-10
-10
-10
-10
-10
-10
-10
-10
-10
-10
-10
-10
-10
-10
-10""")
x_kn = Panel("""0
0
0
0
0
0
0
0
0
0
0
0
0
0
0
0
0
0
0
0""")
concat = Concatenate(FragmentA="Please input ", FragmentB=lng, FragmentC=" load values as [x, y, z] kN")
panel_4 = Panel(concat)
merge_2 = Merge(Data1=graft(x_kn), Data2=graft(z_kn), Data3=graft(y_kn))  # -> simplify(Result)
python = GhPythonScript(
    elements_i=info.StartIndex,
    elements_j=info.EndIndex,
    points=pt2num,
    supports=supports_inds,
    supports_rollery=suppor_rollert_inds,
    load_points=load_inds_3,
    load_values=merge_2,
    maxVf=max_volume_fraction,
    time=time)  # -> out; inputs elements_i: list, elements_j: list, points: tree, supports: list, supports_rollery: list, load_points: list, load_values: tree
# ---------- python: Python ----------
__author__ = "pitipatw"
__version__ = "2023.01.24"

import rhinoscriptsyntax as rs
import ghpythonlib.treehelpers as th
import json

# assign static values
output = dict() 
output["model_name"] = "Pitipat_SMBT"
output["unit"] = "meter"
output["generate_time"] = time

output["model_type"] = "truss"

output["_info"] = "myFirstGHtoJuliaTopOpt"
output["TO_model_type"] = "ground_mesh"
# Processing Inputs
tree = th.tree_to_list(points, retrieve_base = None)

#input materials detail
materials = dict()
materials = [{"G12": 80760000.0,
            "E": 1000.0,
            "name": "DummyMaterial",
            "family": "DummyMaterial",
            "density": 78.5,
            "elem_tags": [],
            "E_unit": "kN/m2",
            "type_name": "ISO",
            "fy": 235000.0,
            "mu": 0.3,
            "density_unit": "kN/m3",
            "fy_unit": "kN/m2",
            "G12_unit": "kN/m2"}]
output["materials"] = materials

#make a default of 2 but then able to put in 3
output["dimension"] = 3




cross_secs = dict() 
cross_secs["A"] = 1 
cross_secs["name"] = ""
cross_secs["family"] = "DummyCroSecByPitipat"
cross_secs["elem_tags"] = []
cross_secs["A_unit"] = "m2" 
cross_secs["Iy"]= 2.1106547193827362e-06
cross_secs["Iz"]= 2.1106547193827362e-06
cross_secs["Jx"]= 4.2213094387654724e-06
cross_secs["name"]= "RO114.3/4"
output["cross_secs"] = [cross_secs]


nodes = dict()
nodes_list = list()
for i in range(len(tree)):
    dummy = dict()
    dummy["node_ind"] = i
    dummy["point"] = tree[i][0:3]
    dummy["is_grounded"] = False
    nodes_list.append(dummy)

output["nodes"] = nodes_list
elements_list = list() 
for i in range(len(elements_i)) : 
    dummy = dict() 
    dummy["elem_ind"] = i
    dummy["end_node_inds"] = [ elements_i[i], elements_j[i]]
    dummy["elem_tag"] = ""
    dummy["bending_stiff"] = False
    elements_list.append(dummy)

supports_list = list()

check = True
for i in supports: 
    dummy = dict()
    dummy["node_ind"] = int(i)
    if check :
        if i in supports_rollery :
            dummy["condition"] = [1,0,1,0,0,0] #roller on y
        else :
            dummy["condition"] = [1,1,1,0,0,0] #pin x y z
        #check = False
    else :
        dummy["condition"] = [0,0,0,0,0,0]
    supports_list.append(dummy)
output["supports"] = supports_list

output["joints"] = []


load_value_list = th.tree_to_list(load_values, retrieve_base = None)

loadcases_dict = dict()
#this is load case "0"
loadcases_0 = dict()
loadcases_0["lc_ind"] = 0
ploads = dict()
load_list = list()
for i in range(len(load_points)) :
    dummy = dict()
    dummy["node_ind"] = load_points[i]
    if i > (len(load_value_list)-1) : 
        x = 0.0
        y = 0.0 
        z = -10.0
    else:
        [x,y,z] = load_value_list[i]
    dummy["force"]  = [int(x),int(y),int(z)]
    dummy["moment"] = [0.0, 0.0, 0.0] #No moment for now
    dummy["loadcase"] = str(i)
    dummy["force_unit"] = "kN"
    load_list.append(dummy)
loadcases_0["ploads"] = load_list
loadcases_0["eloads"] = []
loadcases_0["gravity"] = ""
loadcases_dict["0"] = loadcases_0

output["loadcases"] = loadcases_dict


output["elements"] = elements_list

#====Node and Element numbers are here!====
output["node_num"] = len(tree)
output["element_num"] = len(elements_list) 
#====

output["maxVf"] = maxVf


print(json.dumps(output))
# ---------- end python ----------

# ---- group: Loads Visualization
item_6 = ListItem(List=info.Nodes, Index=load_inds_3, Wrap=True)
cone = Cone(Base=item_6, Radius=0.1, Length=expr("x/100", z_kn))  # -> Cone, Tip
move_3 = Move(Geometry=cone.Cone, Motion=Vector(0, 0, 0.1))  # -> Geometry, Transform
preview = CustomPreview(Geometry=move_3.Geometry, Material=ColourSwatch(SwatchColor=RGB(255, 64, 64)))

# ---- group: Supports Visualization
item_7 = ListItem(List=info.Nodes, Index=supports_inds, Wrap=True)
cone_2 = Cone(Base=item_7, Radius=0.1, Length=0.1)  # -> Cone, Tip
preview_2 = CustomPreview(Geometry=cone_2.Cone, Material=ColourSwatch(SwatchColor=RGB(64, 255, 175)))

# ----
panel_5 = Panel(merge_2)

# ---- group: WebSockets for Julia
server_port = Panel("ws://127.0.0.1:2000/")
websocket_client_start = WebsocketClientStart(Address=server_port, InitalMessage=python, Reset=button)
websocket_client_receiver = WebsocketClientReceiver(WebsocketObjects=websocket_client_start, AutoUpdate=Toggle(True))  # -> Message, Status
panel_6 = Panel(websocket_client_receiver.Status)
panel_7 = Panel(websocket_client_receiver.Message)

# ----
Y = UnitY(Factor=Slider(6, range=0..20))
move_4 = Move(Geometry=line_2, Motion=Y)  # -> Geometry, Transform
vec2pt = Vector2Pt(PointA=item_4, PointB=item_5, Unitize=False)  # -> Vector, Length
python_2 = GhPythonScript(input=websocket_client_receiver.Message, points=pt2num)  # -> out, output; inputs points: tree
# ---------- python_2: Python ----------
__author__ = "pitipatw"
__version__ = "2023.01.24"

import rhinoscriptsyntax as rs
import ghpythonlib.treehelpers as th
import json


output = []
list_points= th.tree_to_list(points, retrieve_base = None)
print(list_points)
dictofelements = json.loads(input)
for i in range(len(dictofelements)):
    temp = (dictofelements[str(i)])
    #, points[i])
    output.append(temp)
    
    
print(output[1])
print(output)
# ---------- end python_2 ----------
larger = LargerThan(FirstNumber=python_2.output, SecondNumber=0)  # -> LargerThan, OrEqualTo
cull_8 = CullPattern(List=item_4, CullPattern=larger.LargerThan)
cull_9 = CullPattern(List=vec2pt.Vector, CullPattern=larger.LargerThan)
cull_10 = CullPattern(List=vec2pt.Length, CullPattern=larger.LargerThan)
division_3 = Division(A=python_2.output, B=Slider(45, range=10..100))
cull_11 = CullPattern(List=division_3, CullPattern=larger.LargerThan)
multiplication = Multiplication(A=cull_11, B=5)
circle_2 = CircleCNR(Center=cull_8, Normal=cull_9, Radius=cull_11)
align = AlignPlanes()
rectangle = Rectangle(Plane=cull_8, XSize=multiplication, YSize=multiplication, Radius=0)  # -> Rectangle, Length
orient = Orient(Geometry=rectangle.Rectangle, Source=cull_9, Target=PlaneXY(0, 0, 0))  # -> Geometry, Transform
extr = Extrude(Base=circle_2, Direction=cull_9)
panel_8 = Panel(python_2.out)
extr_2 = Extrude(Base=rectangle.Rectangle, Direction=cull_9)
preview_3 = CustomPreview(Geometry=extr, Material=ColourSwatch(SwatchColor=RGB(0, 55, 255)))
cross_section = CrossSectionKaramba3D(FamilyNameOfCrossSection="DefaultCroSec", Diameter_cm=11.43, WallThickness_cm=0.4, mode="Circular Hollow")
item_8 = ListItem(List=info.Nodes, Index=support_inds_2, Wrap=True)
matprops = MaterialPropertiesKaramba3D(
    FamilyOfMaterial="Steel",
    Name="S235",
    YoungsModulus_kN_cm2=21000,
    InPlaneShearModulus_kN_cm2=8076,
    TransverseShearModulus_kN_cm2=8076,
    SpecificWeight_kN_m3=78.5,
    CoefficientOfThermalExpansion_1_C=1.2e-05,
    TensileStrength_kN_cm2=23.5,
    CompressiveStrength_kN_cm2=-23.5,
    StrengthHypothesis="MISES",
    mode="Isotrop")
supp = SupportKaramba3D(PosInd=item_8, menu=[buttons(on, on, on, off, off, off)])
item_9 = ListItem(List=info.Nodes, Index=load_inds_2, Wrap=True)
Z_2 = UnitZ(Factor="-10")
line_3 = LineSDL(Start=cull_8, Direction=cull_9, Length=cull_10)
explode_2 = Explode(Curve=line_3, Recursive=True)  # -> Segments, Vertices
loads = LoadsKaramba3D(ForceVector=Z_2, Local=False, PosInd=item_9, LCase="0", mode="Point")
duppt_3 = RemoveDuplicatePts(Points=flatten(explode_2.Vertices), Tolerance=0.01)
material = MaterialKaramba3D(matprops)
linetobeam = LineToBeamKaramba3D(
    Line=line_3,
    New=True,
    Remove=True,
    LimitDistance_m=0.005,
    Bending=True,
    SetBucklingLength=True,
    ToPolylineMaxAngle=0.03,
    ToPolylineTolerance=0.01,
    ToPolylineMaxEdgeLength=0.25)  # -> Element, Points, Info
support = SupportKaramba3D(supp)
load = LoadKaramba3D(loads)
assemble = AssembleModelKaramba3D(
    Point=duppt_3,
    Elem=linetobeam.Element,
    Support=support,
    Load=load,
    CrossSection=cross_section,
    Material=material,
    LimitDistance_m=0.005)  # -> Model, Info, Mass_kg, CenterOfGravity, LoadCaseNames
analyze = AnalyzeKaramba3D(Model=assemble.Model)  # -> CalculatedModel, MaximumDisplacement_cm, ResultingForceOfGravity_kN, ElasticEnergyChange_kNm
b_forces = BeamForcesKaramba3D(AnalyzedModel=analyze.CalculatedModel, Ts=[0, 1])  # -> AnalyzedModel, NormalForce_kN, ShearForceVz_kN, ShearForceVy_kN, TorsionalMomentMt_kNm, BendingMomentMy_kNm, BendingMomentMz_kNm

# ==== cluster Time
time = ConstructTime(Hour=20, Minute=48, Second=0)
date = ConstructDate(Year=2023, Month=2, Day=7, Hour=12, Minute=0, Second=0)
cdate = CombineDateTime(Date=date, Time=time)
panel = Panel(cdate)
panel_2 = ClusterOutput(panel)
