# Grasshopper definition 3dm_to_pts_and_lines.gh (Grasshopper 1.0.7)
# plug-ins: Kangaroo2 Components, FDMremote

geo = Geometry([<curve referenced from the Rhino model> x50])
geo_2 = Geometry([<curve referenced from the Rhino model> x4])
explode = Explode(Curve=geo, Recursive=True)  # -> flatten(Segments), Vertices
explode_2 = Explode(Curve=geo_2, Recursive=True)  # -> flatten(Segments), Vertices
duppt = RemoveDuplicatePts(Points=flatten(explode.Vertices), Tolerance=0.01)
duppt_2 = RemoveDuplicatePts(Points=flatten(explode_2.Vertices), Tolerance=0.01)
item = ListItem(List=duppt, Index=0, Wrap=True)  # -> Item, Item1, Item2
item_2 = ListItem(List=duppt_2, Index=0, Wrap=True)  # -> Item, Item1, Item2
create = CreateNetwork(
    Edges=explode.Segments,
    Anchors=[item.Item, item.Item1, item.Item2],
    ForceDensities=1,
    IntersectionTolerance=Slider(0.05, range=0..0.1))
create_2 = CreateNetwork(
    Edges=explode_2.Segments,
    Anchors=[item_2.Item, item_2.Item1, item_2.Item2],
    ForceDensities=1,
    IntersectionTolerance=Slider(0.05, range=0..0.1))
info = NetworkInformation(FDMNetwork=create)  # -> Nodes, Edges, EdgeLengths, StartIndex, EndIndex, Anchors, ForceDensities, NumberEdges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
info_2 = NetworkInformation(FDMNetwork=create_2)  # -> Nodes, Edges, EdgeLengths, StartIndex, EndIndex, Anchors, ForceDensities, NumberEdges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
item_3 = ListItem(List=info.Nodes, Index=info.StartIndex, Wrap=True)
item_4 = ListItem(List=info.Nodes, Index=info.EndIndex, Wrap=True)
pt = Point(info.Nodes)
item_5 = ListItem(List=info_2.Nodes, Index=info_2.StartIndex, Wrap=True)
item_6 = ListItem(List=info_2.Nodes, Index=info_2.EndIndex, Wrap=True)
pt_2 = Point(info_2.Nodes)
ln = Line(StartPoint=item_3, EndPoint=item_4)
ln_2 = Line(StartPoint=item_5, EndPoint=item_6)
concat = Concatenate(FragmentA=info.StartIndex, FragmentC=",", FragmentB=info.EndIndex)
concat_2 = Concatenate(FragmentA=info_2.StartIndex, FragmentC=",", FragmentB=info_2.EndIndex)
rep = ReplaceText(Text=pt_2, Find="{", RecursiveReplace=False)
rep_2 = ReplaceText(Text=rep, Find="}", RecursiveReplace=False)
panel = Panel(concat)
rep_3 = ReplaceText(Text=pt, Find="{", RecursiveReplace=False)
panel_2 = Panel(rep_2)
panel_3 = Panel(concat_2)
rep_4 = ReplaceText(Text=rep_3, Find="}", RecursiveReplace=False)
panel_4 = Panel(rep_4)
supoprt_points = ListItem(Index=0, Wrap=True)  # -> Item, Item1, Item2
supoprt_points_2 = ListItem(Index=0, Wrap=True)  # -> Item, Item1, Item2
