# Grasshopper definition cupbase_demo.gh (Grasshopper 1.0.7)

number_of_holes = Slider(5, range=0..10)
holes_radius = Slider(0.1, range=0..1)
holes_depths = Slider(-0.06, range=-0.5..0.5)
base_height = Slider(0.125, range=0..1)
wall_height = Slider(0.1, range=0..1)
tol = Slider(0, range=-0.5..0.5)
outer_r = Slider(2.375, range=0..10)
inner_r = Slider(1.125, range=0..2)
offset = Slider(0.08, range=0..1)

pt = ConstructPoint(XCoordinate=0, YCoordinate=0, ZCoordinate=0)
pt_2 = ConstructPoint(XCoordinate=0, YCoordinate=0, ZCoordinate=0)
addition = Addition(A=holes_radius, B=tol)
addition_2 = Addition(A=holes_depths, B=tol)
addition_3 = Addition(A=inner_r, B=offset)
avr = Average(Input=[outer_r, addition_3])
circle = CircleCNR(Center=pt_2, Normal=Vector(0, 0, 1), Radius=addition)
circle_2 = CircleCNR(Center=pt, Normal=Vector(0, 0, 1), Radius=avr)
Z = UnitZ(Factor=expr("-x", addition_2))
circle_3 = CircleCNR(Center=pt, Normal=Vector(0, 0, 1), Radius=inner_r)
circle_4 = CircleCNR(Center=pt, Normal=Vector(0, 0, 1), Radius=outer_r)
circle_5 = CircleCNR(Center=pt, Normal=Vector(0, 0, 1), Radius=addition_3)
boundary = BoundarySurfaces(Edges=circle)
divide = DivideCurve(Curve=circle_2, Count=10, Kinks=False)  # -> Points, Tangents, Parameters
series = Series(Start=0, Step=1, Count=number_of_holes)
boundary_2 = BoundarySurfaces(Edges=[circle_3, circle_5])
extr = Extrude(Base=boundary, Direction=Z)
addition_4 = Addition(A=base_height, B=wall_height)
Z_2 = UnitZ(Factor=base_height)
Z_3 = UnitZ(Factor=addition_4)
boundary_3 = BoundarySurfaces(Edges=circle_4)
item = ListItem(List=divide.Points, Index=series, Wrap=True)
circle_6 = CircleCNR(Center=item, Normal=Vector(0, 0, 1), Radius=holes_radius)
move = Move(Geometry=circle_6, Motion=Z_2)  # -> Geometry, Transform
Z_4 = UnitZ(Factor=holes_depths)
extr_2 = Extrude(Base=boundary_3, Direction=Z_2)
boundary_4 = BoundarySurfaces(Edges=move.Geometry)
extr_3 = Extrude(Base=boundary_4, Direction=Z_4)
sdiff = SolidDifference(BrepsA=extr_2, BrepsB=extr_3)
extr_4 = Extrude(Base=boundary_2, Direction=Z_3)
merge = Merge(Data1=extr_4, Data2=sdiff)
