# Grasshopper definition 08042023_PostProcess.gh (Grasshopper 1.0.7)
# plug-ins: Karamba3D, Kangaroo2 Components, Pufferfish

pipeline = GeometryPipeline(
    GroupByLayer=False,
    GroupByType=False,
    IncludeHidden=True,
    IncludeLocked=True,
    LayerFilter="Compressions",
    NameFilter="*",
    SublayerFiltering=True,
    TypeFilter=4)
pipeline_2 = GeometryPipeline(
    GroupByLayer=False,
    GroupByType=False,
    IncludeHidden=True,
    IncludeLocked=True,
    LayerFilter="Compressions",
    NameFilter="*",
    SublayerFiltering=True,
    TypeFilter=4)
relay = Relay()
X = UnitX(Factor=expr("1.5*x", relay))
linetobeam = LineToBeamKaramba3D(
    Line=pipeline,
    Identifier="compression",
    New=True,
    Remove=True,
    LimitDistance_m=0.005,
    Bending=True,
    SetBucklingLength=True,
    ToPolylineMaxAngle=0.03,
    ToPolylineTolerance=0.01,
    ToPolylineMaxEdgeLength=0.25)  # -> Element, Points, Info
linetobeam_2 = LineToBeamKaramba3D(
    Line=pipeline_2,
    Identifier="compression",
    New=True,
    Remove=True,
    LimitDistance_m=0.005,
    Bending=True,
    SetBucklingLength=True,
    ToPolylineMaxAngle=0.03,
    ToPolylineTolerance=0.01,
    ToPolylineMaxEdgeLength=0.25)  # -> Element, Points, Info
vec = VectorXYZ(XComponent=expr("1.5*x", relay), YComponent=0, ZComponent=0)  # -> Vector, Length
mkset = MakeElementSetKaramba3D(SetIdentifier="set0", MinimumSplitLength_m=0.001)
larger = LargerThan(SecondNumber="0")  # -> LargerThan, OrEqualTo
assemble = AssembleModelKaramba3D(LimitDistance_m=0.005)  # -> Model, Info, Mass_kg, CenterOfGravity, LoadCaseNames
cull = CullPattern(CullPattern=larger.LargerThan)
xz = XZPlane(Origin=Point(0, 0, 0))
X_2 = UnitX(Factor=expr("1.5*x", 1))
pipeline_3 = GeometryPipeline(
    GroupByLayer=False,
    GroupByType=False,
    IncludeHidden=True,
    IncludeLocked=True,
    LayerFilter="ModGeo",
    NameFilter="*",
    SublayerFiltering=True,
    TypeFilter=4)

# ---- group: Bake THIS and MOD
move = Move(Geometry=pipeline_3, Motion=vec.Vector)  # -> Geometry, Transform

# ----
curvepoint = PointOnCurve(pipeline_3, parameter=1)
curvepoint_2 = PointOnCurve(pipeline_3, parameter=0)
cull_2 = CullPattern(List=move.Geometry, CullPattern=larger.LargerThan)
cull_3 = CullPattern(List=move.Geometry, CullPattern=invert(larger.LargerThan))
hull = ConvexHull(Points=[curvepoint, curvepoint_2], Plane=xz)  # -> Hull, HullZ, Indices
move_2 = Move(Geometry=cull_2, Motion=X)  # -> Geometry, Transform
curvepoint_3 = PointOnCurve(move_2.Geometry, parameter=0.5)
move_3 = Move(Geometry=hull.Hull, Motion=X)  # -> Geometry, Transform
preview = CustomPreview(Geometry=move_2.Geometry, Material=ColourSwatch(SwatchColor=RGB(0, 55, 255)))
move_4 = Move(Geometry=cull_3, Motion=X)  # -> Geometry, Transform
curvepoint_4 = PointOnCurve(move_4.Geometry, parameter=0.5)
xz_2 = XZPlane(Origin=curvepoint_3)
tag = TextTag3D(Location=xz_2, Text=cull, Size=Slider(50, range=0..100), Justification=7)
preview_2 = CustomPreview(Geometry=move_4.Geometry, Material=ColourSwatch(SwatchColor=RGB(255, 0, 0)))
llinter = LineLineIntersectionKaramba3D(Line=pipeline_3, LimitDistance_m=0.005)  # -> IntersectionPoints, flatten(LineSubSegements)
xz_3 = XZPlane(Origin=curvepoint_4)
tag_2 = TextTag3D(Location=xz_3, Text=cull, Size=Slider(50, range=0..100), Justification=7)
duppt = RemoveDuplicatePts(Points=llinter.IntersectionPoints, Tolerance=0.01)
pdecon = Deconstruct(Point=duppt)  # -> XComponent, YComponent, ZComponent
dupln = RemoveDuplicateLines(Lines=llinter.LineSubSegements, Tolerance=0.01)

sort = SortList(Keys=pdecon.XComponent, ValuesA=pdecon.XComponent)  # -> Keys, ValuesA
sort_2 = SortList(Keys=pdecon.ZComponent, ValuesA=pdecon.XComponent)  # -> Keys, ValuesA
item = ListItem(List=sort.ValuesA, Index=0, Wrap=True)
item_2 = ListItem(List=sort_2.Keys, Index=0, Wrap=True)
equals = Equality(FirstNumber=item, SecondNumber=pdecon.XComponent)  # -> Equality, Inequality
equals_2 = Equality(FirstNumber=item_2, SecondNumber=pdecon.ZComponent)  # -> Equality, Inequality
and = GateAnd(A=equals.Equality, B=equals_2.Equality)
cull_4 = CullPattern(List=duppt, CullPattern=and)

python = GhPythonScript()  # -> out, output
# ---------- python: Python ----------
__author__ = "pitipatw"
__version__ = "2023.07.16"

import rhinoscriptsyntax as rs

output = []
if np%2 == 0:
    output.append(np/2)
    output.append(np/2+1)
else:
    output.append((np+1)/2)
# ---------- end python ----------
subtraction = Subtraction(A=python.output, B="1")
multiplication = Multiplication(A=subtraction)
addition = Addition(A=multiplication, B=item)

sort_3 = SortList(Keys=pdecon.XComponent, ValuesA=pdecon.XComponent)  # -> Keys, ValuesA
sort_4 = SortList(Keys=pdecon.ZComponent, ValuesA=pdecon.XComponent)  # -> Keys, ValuesA
item_3 = ListItem(List=reverse(sort_3.ValuesA), Index=0, Wrap=True)
item_4 = ListItem(List=sort_4.Keys, Index=0, Wrap=True)
equals_3 = Equality(FirstNumber=item_4, SecondNumber=pdecon.ZComponent)  # -> Equality, Inequality
equals_4 = Equality(FirstNumber=item_3, SecondNumber=pdecon.XComponent)  # -> Equality, Inequality
and_2 = GateAnd(A=equals_4.Equality, B=equals_3.Equality)
cull_5 = CullPattern(List=duppt, CullPattern=and_2)

sort_5 = SortList(Keys=pdecon.ZComponent, ValuesA=pdecon.XComponent)  # -> Keys, ValuesA
item_5 = ListItem(List=reverse(sort_5.Keys), Index=0, Wrap=True)
ft_mpa = Slider(412, range=28..928)
fc_mpa = Slider(31, range=28..56)
number_slider = Slider(20, range=0..20)
item_6 = ListItem(List=addition, Index=0, Wrap=True)  # -> Item, Item1
item_7 = ListItem(List=addition, Index=0, Wrap=True)  # -> Item, Item1
equalst = EqualityWithinTolerance(FirstNumber=item_5, SecondNumber=pdecon.ZComponent, Tolerance=number_slider)  # -> Equality, Inequality
or = GateOr(A=and, B=and_2)
matselect = MaterialSelectionKaramba3D(menu=[dropdown(7), dropdown(5)])
equalst_2 = EqualityWithinTolerance(FirstNumber=item_6.Item, SecondNumber=pdecon.XComponent, Tolerance=number_slider)  # -> Equality, Inequality
equalst_3 = EqualityWithinTolerance(FirstNumber=item_7.Item1, SecondNumber=pdecon.XComponent, Tolerance=number_slider)  # -> Equality, Inequality
division = Division(A="5200000", B=Slider(2, range=0..10))
division_2 = Division(A=fc_mpa, B=10)
division_3 = Division(A=ft_mpa, B=10)
not = GateNot(A=or)
and_3 = GateAnd(A=equalst_2.Equality, B=equalst.Equality)
and_4 = GateAnd(A=equalst_3.Equality, B=equalst.Equality)
panel = Panel(matselect)
supp = SupportKaramba3D(PosInd=cull_5, menu=[buttons(off, on, on, off, off, off)])
supp_2 = SupportKaramba3D(PosInd=cull_4, menu=[buttons(on, on, on, off, off, off)])
linetobeam_3 = LineToBeamKaramba3D(
    Line=dupln,
    New=True,
    Remove=True,
    LimitDistance_m=0.005,
    Bending=True,
    SetBucklingLength=True,
    ToPolylineMaxAngle=0.03,
    ToPolylineTolerance=0.01,
    ToPolylineMaxEdgeLength=0.25)  # -> Element, Points, Info
cull_6 = CullPattern(List=duppt, CullPattern=and_3)
cull_7 = CullPattern(List=duppt, CullPattern=not)
supp_3 = SupportKaramba3D(PosInd=cull_7, menu=[buttons(off, on, off, off, off, off)])
panel_2 = Panel("""3
5
6
8""")
matprops = MaterialPropertiesKaramba3D(
    FamilyOfMaterial="Vectran",
    Name=panel_2,
    YoungsModulus_kN_cm2="5200000",
    InPlaneShearModulus_kN_cm2=division,
    TransverseShearModulus_kN_cm2=division,
    SpecificWeight_kN_m3=78.5,
    CoefficientOfThermalExpansion_1_C=1.2e-05,
    TensileStrength_kN_cm2=division_3,
    CompressiveStrength_kN_cm2=expr("-x", division_2),
    StrengthHypothesis="MISES",
    mode="Isotrop")
cull_8 = CullPattern(List=duppt, CullPattern=and_4)
panel_3 = Panel("""1/8
3/16
1/4
5/16""")
Z = UnitZ(Factor=expr("-x", Slider(2, range=0..100)))
panel_4 = Panel("5")
merge = Merge(Data1=supp_2, Data2=supp, Data3=supp_3)
item_8 = ListItem(List=matprops, Index=Slider(2, range=0..4), Wrap=True)
division_4 = Division(A=panel_2, B=Slider(2, range=0..10))
merge_2 = Merge(Data1=cull_6, Data2=cull_8)
loads = LoadsKaramba3D(ForceVector=Z, Local=False, PosInd=merge_2, LCase="0", mode="Point")
support = SupportKaramba3D(merge)
panel_5 = Panel("concrete")
cross_section = CrossSectionKaramba3D(
    FamilyNameOfCrossSection="Vectran",
    NameOfCrossSection=panel_3,
    Diameter_cm=panel_2,
    WallThickness_cm=division_4,
    mode="Circular Hollow")
cross_section_2 = CrossSectionKaramba3D(
    FamilyNameOfCrossSection="Vectran",
    NameOfCrossSection=panel_3,
    Diameter_cm=panel_2,
    WallThickness_cm=division_4,
    mode="Circular Hollow")
item_9 = ListItem(List=panel_3, Index=Slider(3, range=0..3), Wrap=True)
panel_6 = Panel(equalst_2.Equality)
panel_7 = Panel(cross_section)
crosecselect = CrossSectionSelectorKaramba3D(CrossSections=cross_section, NameOrListIndexOfCrossSection=item_9)  # -> CrossSection, Info
assemble_2 = AssembleModelKaramba3D(
    Point=duppt,
    Elem=linetobeam_3.Element,
    Support=support,
    Load=loads,
    CrossSection=crosecselect.CrossSection,
    Material=item_8,
    LimitDistance_m=0.005)  # -> Model, Info, Mass_kg, CenterOfGravity, LoadCaseNames
analyze = AnalyzeKaramba3D(Model=assemble_2.Model)  # -> CalculatedModel, MaximumDisplacement_cm, ResultingForceOfGravity_kN, ElasticEnergyChange_kNm
modelview = ModelViewKaramba3D(Model=analyze.CalculatedModel, ResultFactors=1, ResultCase=-1)  # -> Model, DeformedMesh, DeformedAxes, DeformedModel
panel_8 = Panel(crosecselect.CrossSection)
nodedisp = NodalDisplacementsKaramba3D(AnalyzedModel=modelview.Model, PositionsIndexes=merge_2)  # -> AnalyzedModel, NodalTranslations_m, NodalRotations_rad
panel_9 = Panel(nodedisp.NodalTranslations_m)

sort_6 = SortList(Keys=pdecon.ZComponent, ValuesA=pdecon.ZComponent)  # -> Keys, ValuesA
item_10 = ListItem(List=reverse(sort_6.ValuesA), Index=0, Wrap=True)

equalst_4 = EqualityWithinTolerance(FirstNumber=item_10, SecondNumber=pdecon.ZComponent, Tolerance=0.001)  # -> Equality, Inequality

cull_9 = CullPattern(List=duppt, CullPattern=equalst_4.Equality)
