# Grasshopper definition 18072023(1).gh (Grasshopper 1.0.7)
# plug-ins: FDMremote, Karamba3D, Kangaroo2 Components, MetaHopper, BeamShapeExplorer, Radical, Pufferfish

# 5 4 6
# 0.27
# 3
# 0.27
# pass
# 5 4 6
# 0.27
# "2"
# 0.27
# fail
setup_layers = CSharpScript()  # -> out, A
# ---------- setup_layers: C# usings ----------
using Rhino.DocObjects;
using Rhino.Display ;
# ---------- setup_layers: C# ----------
    Rhino.RhinoDoc doc = Rhino.RhinoDoc.ActiveDoc;



    Layer l0 = new Layer();
    l0.Name = "Default";
    l0.Color = System.Drawing.Color.Black;
    int l0Index = doc.Layers.Add(l0);

    Layer l1 = new Layer();
    l1.Name = "Load points";
    l1.Color = System.Drawing.Color.Red;
    int l1Index = doc.Layers.Add(l1);

    Layer l2 = new Layer();
    l2.Name = "Supports (pin)";
    l2.Color = System.Drawing.Color.Blue;
    int l2Index = doc.Layers.Add(l2);

    Layer l3 = new Layer();
    l3.Name = "Supports (roller)";
    l3.Color = System.Drawing.Color.Green;
    int l3Index = doc.Layers.Add(l3);

    Layer l4 = new Layer();
    l4.Name = "ModGeo";
    l4.Color = System.Drawing.Color.Orange;
    int l4Index = doc.Layers.Add(l4);

    Layer l5 = new Layer();
    l5.Name = "Lines";
    l5.Color = System.Drawing.Color.Red;
    int l5Index = doc.Layers.Add(l5);
    
    Layer l6 = new Layer();
    l6.Name = "Points";
    l6.Color = System.Drawing.Color.Red;
    int l6Index = doc.Layers.Add(l6);
# ---------- end setup_layers ----------
ly = Slider(1, range=0..5000)

# ---- group: Adam's / 1.
# Box Ground Structure
lx = Slider(2300, range=0..5000)
nx = Slider(10, range=0..30)
ny = Slider(1, range=0..10)
nz = Slider(5, range=0..10)

# ----
lz = Slider(450, range=0..5000)

# ---- group: TopOpt Control / 2.
max_members_length = Slider(750, range=0..5000)

# ---- group: TopOpt Control / 6.
# 5. Assign loads in Rhino
max_volume_fraction = Slider(0.13, range=0..1)

# ---- group: TopOpt Control / 3.
create_a_ground_structure = Button()

# ---- group: TopOpt Control / 7.
optimization = Button()

# ---- group: TopOpt Control / 4.
bake_points = Button()

# ---- group: Components control
bake = BakeObject(Bake=bake_points, AllObjects_Object=pt_3)
# This is a Topology Optimization using TopOpt.jl
# 
# last major modified: 14 April 2023
# Notes:
# 
# For 2D problems, 3D model will be made,
# but z-axis constraints will be added to every node.
# 
# Actual separation is not implemented yet.
hideshow = HideShowObjectPreview(AllObjects_Object=line_2)

# ----
# For other configurations, see below...
python = GhPythonScript(L=lx, x=nx)  # -> out, x
# ---------- python: Python ----------
__author__ = "pitipatw"
__version__ = "2023.03.10"

import rhinoscriptsyntax as rs

if x==1 :
    x = 0
else:
    x = L/(x-1)
# ---------- end python ----------

# ---- group: Adam's
python_2 = GhPythonScript(L=ly, x=ny)  # -> out, y
# ---------- python_2: Python ----------
__author__ = "pitipatw"
__version__ = "2023.03.10"

import rhinoscriptsyntax as rs

if x==1 :
    y = 0
else:
    y = L/(x-1)
# ---------- end python_2 ----------
python_3 = GhPythonScript(L=lz, x=nz)  # -> out, z
# ---------- python_3: Python ----------
__author__ = "pitipatw"
__version__ = "2023.03.10"

import rhinoscriptsyntax as rs

if x==1 :
    z = 0
else:
    z = L/(x-1)
# ---------- end python_3 ----------
box = CenterBox(Base=PlaneXY(0, 0, 0), X=expr("x/2", python.x), Y=expr("x/2", python_2.y), Z=expr("x/2", python_3.z))
origin_point = ConstructPoint(XCoordinate=0, YCoordinate=0, ZCoordinate=0)
arrbox = BoxArray(Geometry=origin_point, Cell=box, XCount=nx, YCount=ny, ZCount=nz)  # -> Geometry, Transform
duppt = RemoveDuplicatePts(Points=arrbox.Geometry, Tolerance=0.01)

# ---- group: TopOpt Control
list = ValueList({"2D": 2, "3D": 3}, selected="3D")

# ----
number_4 = Slider(0.47, range=0.05..0.95)
number_4_2 = Slider(0.12, range=0.05..0.95)
filter = StreamFilter(Gate=list)  # disabled

# ---- group: Code Selection
# 0 | Materials and Code
# Right-click and recompute if changed
number_slider = Slider(1, range=0..1)
nickname = SelectCode2(Code=number_slider)
panel = Panel(nickname)

# ----
pt = ConstructPoint(XCoordinate=lx, YCoordinate=0, ZCoordinate=0)

long_span_m = Slider(6, range=0..10)
slab_width_m = Slider(0.53, range=0..5)
# 1 | Geometry definition
slab_clear_span_m = Slider(4, range=0..8)

maximum_depth = Slider(0.1, range=0.05..1)
number_4_3 = Slider(0.62, range=0.05..0.95)
number_4_4 = Slider(0.23, range=0.05..0.95)
number_4_5 = Slider(0.37, range=0.05..0.95)
merge = Merge(Data1="1", Data2="1", Data3=number_4_3, Data4=number_4_4, Data5=number_4_4)
merge_2 = Merge(Data1="0", Data2=number_4_5, Data3="0", Data4=number_4, Data5="1")
sbuild = SectionBuilder(WidthMOfSectionB=slab_width_m, DepthMOfSectionH=maximum_depth, VPx=merge, VPy=merge_2)  # -> Pts, Crv, VSect

number_4_6 = Slider(0.14, range=0.05..0.95)
maximum_depth_2 = Slider(0.22, range=0.05..1)
number_4_7 = Slider(0.05, range=0.05..0.95)
number_4_8 = Slider(0.09, range=0.05..0.95)
merge_3 = Merge(Data1="1", Data2="1", Data3=number_4_7, Data4=number_4_8, Data5=number_4_8)
merge_4 = Merge(Data1="0", Data2=number_4_6, Data3="0", Data4=number_4_2, Data5="1")
sbuild_2 = SectionBuilder(WidthMOfSectionB=slab_width_m, DepthMOfSectionH=maximum_depth_2, VPx=merge_3, VPy=merge_4)  # -> Pts, Crv, VSect

# ----
# To do
# 
# visualize roller support points
# 
# Specified applied load values
# 
# movable points (optional: movable groundstructure)
# 
# color
# 
# Specify domain size
# and the nX,nY,nZ are divisions instead of keep adding
ln = Line(StartPoint=origin_point, EndPoint=pt)
curvepoint = PointOnCurve(ln, parameter=0)
pt_2 = ConstructPoint(XCoordinate=0, YCoordinate=ly, ZCoordinate=0)
curvepoint_2 = PointOnCurve(ln, parameter=1)

merge_5 = Merge(Data1=sbuild.VSect, Data2=sbuild_2.VSect, Data3=sbuild.VSect)
bbuild = BeamBuilder(SpanM=slab_clear_span_m, VSect=merge_5)  # -> ConstructionPlanes, Pts, Crv, BeamBrep, SpanCurve

ln_2 = Line(StartPoint=origin_point, EndPoint=pt_2)

# ---- group: Material Properties
# Right-click and recompute if changed
set_mp = MaterialPropertiesGlobal(
    ConcreteCharacteristicStrengthMPaNMm2="20",
    ConcreteEModulusMPaNMm2=27500,
    ConcreteMaximumStrainMmMm=0.0035,
    ConcreteDensityKgM3=2400,
    ConcreteEmbodiedEnergyCoefficientMJKg="0.147",
    SteelCharacteristicStrengthMPaNMm2="415",
    SteelEModulusMPaNMm2=205000,
    SteelMaximumStrainMmMm=0.004,
    SteelDensityKgM3=8050,
    SteelEmbodiedEnergyCoefficientMJKg="1.32")

# ---- group: effective width constraint / hf (m)
multiplication = Multiplication(A=maximum_depth, B=number_4_5)
multiplication_2 = Multiplication(A=maximum_depth_2, B=number_4_6)
merge_6 = Merge(Data1=multiplication, Data2=multiplication_2)

# ----
# Issues
# 
# With nz = 7
# truss parser in the Websocket "doesnt" fail.
# 
# But with nz = 4 ,3 .. it fails
# 
# Unexpect end of file 0
# 
# 
# But run outside of the websocket does not fail too. What!
lineardim = LinearDimension(Line=ln, PointA=curvepoint, PointB=curvepoint_2, Text=lx, Size=Slider(100, range=0..100))
lineardim_2 = LinearDimension(Line=ln_2, PointA=origin_point, PointB=pt_2, Text=ly, Size=Slider(100, range=0..100))
time = Time("now")
ddate = DeconstructDate(Date=time)  # -> Year, Month, Day, Hour, Minute, Second
pipeline = GeometryPipeline(
    GroupByLayer=False,
    GroupByType=False,
    IncludeHidden=True,
    IncludeLocked=True,
    LayerFilter="Points",
    NameFilter="*",
    SublayerFiltering=True,
    TypeFilter=1)
pipeline_2 = GeometryPipeline(
    GroupByLayer=False,
    GroupByType=False,
    IncludeHidden=True,
    IncludeLocked=True,
    LayerFilter="Lines",
    NameFilter="*",
    SublayerFiltering=True,
    TypeFilter=4)
pt_3 = Point(duppt)
lng = ListLength(List=ddate.Month)
line = Line(pipeline_2)

# ---- group: Formwork blocks (to be finished)
crv = Curve(bbuild.Crv)
item = ListItem(List=crv, Index="0", Wrap=True)
curvepoint_3 = PointOnCurve(item, parameter=0.5)
item_2 = ListItem(List=crv, Index="2", Wrap=True)
item_3 = ListItem(List=crv, Index="3", Wrap=True)
xz = XZPlane(Origin=curvepoint_3)
mirror = Mirror(Geometry=item_2, Plane=xz)  # -> Geometry, Transform
mirror_2 = Mirror(Geometry=item_3, Plane=xz)  # -> Geometry, Transform
merge_7 = Merge(Data1=item_3, Data2=item_2, Data3=mirror.Geometry, Data4=mirror_2.Geometry)
curvepoint_4 = PointOnCurve(merge_7, parameter=0.5)
end = EndPoints(Curve=merge_7)  # -> Start, End
pline = PolyLine(Vertices=end.End, Closed=False)
pline_2 = PolyLine(Vertices=curvepoint_4, Closed=False)

# ----
equals = Equality(FirstNumber=lng, SecondNumber=Slider(1, range=0..1))  # -> Equality, Inequality

crv_2 = Curve(bbuild.SpanCurve)
brep = Brep(bbuild.BeamBrep)

brep_2 = Brep(brep)
nz_2 = Slider(3, range=0..20)
ny_2 = Slider(3, range=0..20)
# Brep boundary Ground Structure (Advance)
nx_2 = Slider(7, range=0..20)
volume = Volume(Geometry=brep_2)  # -> Volume, Centroid
scale = Scale(Geometry=brep_2, Center=volume.Centroid, Factor=Slider(2, range=0..10))  # -> Geometry, Transform
bbox = BoundingBox(Content=scale.Geometry, Plane=PlaneXY(0, 0, 0))  # -> Box, Box_2
debox = DeconstructBox(Box=bbox.Box)  # -> Plane, X, Y, Z
dedomain = DeconstructDomain(Domain=debox.X)  # -> Start, End
dedomain_2 = DeconstructDomain(Domain=debox.Y)  # -> Start, End
dedomain_3 = DeconstructDomain(Domain=debox.Z)  # -> Start, End
subtraction = Subtraction(A=dedomain.End, B=dedomain.Start)
subtraction_2 = Subtraction(A=dedomain_2.End, B=dedomain_2.Start)
subtraction_3 = Subtraction(A=dedomain_3.End, B=dedomain_3.Start)
subtraction_4 = Subtraction(A=nx_2, B=1)
subtraction_5 = Subtraction(A=ny_2, B=1)
subtraction_6 = Subtraction(A=nz_2, B=1)
division = Division(A=subtraction, B=subtraction_4)
division_2 = Division(A=subtraction_2, B=subtraction_5)
division_3 = Division(A=subtraction_3, B=subtraction_6)
series = Series(Start=dedomain_2.Start, Step=division_2, Count=ny_2)
series_2 = Series(Start=dedomain.Start, Step=division, Count=nx_2)
series_3 = Series(Start=dedomain_3.Start, Step=division_3, Count=nz_2)
python_4 = GhPythonScript(x=series_2, y=series, z=series_3)  # -> out, a, pts; inputs x: list, y: list, z: list
# ---------- python_4: Python ----------
__author__ = "pitipatw"
__version__ = "2023.04.13"

import rhinoscriptsyntax as rs


nx = len(x)
ny = len(y)
nz = len(z)

np = nx*ny*nz
points = [[[0] * nx] * ny ] * nz
pts = []
for i in range(nx):
    for j in range(ny):
        for k in range(nz):
            #print(x[i],y[j],z[k])
            #pts = rs.AddPoint(x[i], y[j], z[k])
            pts.append(rs.CreatePoint(x[i], y[j], z[k]))
# ---------- end python_4 ----------
pt_4 = Point(python_4.pts)
brepinc = PointInBrep(Brep=scale.Geometry, Point=pt_4, Strict=False)
cull = CullPattern(List=pt_4, CullPattern=brepinc)

pt2num = PointsToNumbers(Points=graft(pt_3), Mask=4)  # -> simplify(Numbers)
concat = Concatenate(FragmentA="0", FragmentB=ddate.Month)

# ---- group: Ground Structure
line_2 = Line(line)
pt_5 = Point(pipeline)

# ----
filter_2 = StreamFilter(Gate=equals.Equality, Stream0=ddate.Month, Stream1=concat)
live_load_kn_m = Slider(2, range=0..10)
panel_2 = Panel(pt2num)
concat_2 = Concatenate(FragmentB=filter_2, FragmentC=ddate.Year)

# ---- group: Preprocessing (Adam)
supoprt_points = ListItem(List=pt_5, Index=0, Wrap=True)  # -> Item, Item1, Item2
create = CreateNetwork(
    Edges=flatten(line_2),
    Anchors=[supoprt_points.Item, supoprt_points.Item1, supoprt_points.Item2],
    ForceDensities=1,
    IntersectionTolerance=Slider(0.02, range=0..0.1))
info = NetworkInformation(FDMNetwork=create)  # -> Nodes, Edges, EdgeLengths, StartIndex, EndIndex, Anchors, ForceDensities, NumberEdges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

# ----
multiplication_3 = Multiplication(A=Slider(200, range=0..1000), B=slab_width_m, C="9.8e-03")

# ---- group: FEA Assembly
number_slider_2 = Slider(5, range=0..10)
read_mp = ReadMP()
lew = LoadEnvelopeFromSelfweight(MaterialProperties=read_mp, BeamBRep=brep, SpanCurve=crv_2, NumberOfAnalysisSections=number_slider_2, GraphScale=0.1)  # -> DistributedLoadEnvelopeKNM, SplitCurve, DistributedLoadGraphActual, DistributedLoadGraphAverage, ElementSegments
expression = Expression(D=lew.DistributedLoadEnvelopeKNM, L=multiplication_3, Expression="-1.6*L+1.2*D")
series_4 = Series(Start=0, Step=1, Count=number_slider_2)
end_2 = EndPoints(Curve=crv_2)  # -> Start, End
concat_3 = Concatenate(FragmentA="seg_", FragmentB=series_4)
Z = UnitZ(Factor=expression)
supp = SupportKaramba3D(PosInd=end_2.Start, menu=[buttons(on, on, on, on, off, on)])
supp_2 = SupportKaramba3D(PosInd=end_2.End, menu=[buttons(off, off, on, off, off, off)])
loads = LoadsKaramba3D(Vector=graft(Z), BeamIdentifiers=graft(concat_3), mode="Uniform Line", menu=[buttons(on, off, off)])  # -> flatten(Load)
linetobeam = LineToBeamKaramba3D(Line=lew.SplitCurve, Identifier=concat_3, New=True, Remove=True, LimitDistance_m=0.005)  # -> Element, Points, Info

# ----
panel_3 = Panel(concat_2)

# ---- group: FEW Analysis
assemble = AssembleModelKaramba3D(Elem=linetobeam.Element, Support=[supp_2, supp], Load=loads, LimitDistance_m=0.005)  # -> Model, Info, Mass_kg, CenterOfGravity
# 2 | Load envelope
analyze = AnalyzeKaramba3D(Model=assemble.Model)  # -> CalculatedModel, MaximumDisplacement_cm, ResultingForceOfGravity_kN, ElasticEnergy_kNm
modelview = ModelViewKaramba3D(Model=analyze.CalculatedModel, ResultFactors=1, ResultCase=-1)  # -> Model, DeformedMesh, DeformedAxes, DeformedModel
beamview = BeamViewKaramba3D(Model=modelview.Model)  # -> Model, MeshesOfRenderedBeams, DeformedBeamAxes, LegendColors, LegendTags

# ----
pipeline_3 = GeometryPipeline(
    GroupByLayer=False,
    GroupByType=False,
    IncludeHidden=True,
    IncludeLocked=True,
    LayerFilter="Load points",
    NameFilter="*",
    SublayerFiltering=True,
    TypeFilter=1)
pipeline_4 = GeometryPipeline(
    GroupByLayer=False,
    GroupByType=False,
    IncludeHidden=True,
    IncludeLocked=True,
    LayerFilter="Supports (pin)",
    NameFilter="*",
    SublayerFiltering=True,
    TypeFilter=1)
pipeline_5 = GeometryPipeline(
    GroupByLayer=False,
    GroupByType=False,
    IncludeHidden=True,
    IncludeLocked=True,
    LayerFilter="Supports (roller)",
    NameFilter="*",
    SublayerFiltering=True,
    TypeFilter=1)
support_pin_inds = MemberIndex(Set=info.Nodes, Member=pipeline_3)  # -> simplify(flatten(Index)), Count
support_roller_inds = MemberIndex(Set=info.Nodes, Member=pipeline_5)  # -> simplify(flatten(Index)), Count
support_pin_inds_2 = MemberIndex(Set=info.Nodes, Member=pipeline_4)  # -> simplify(flatten(Index)), Count

lng_2 = ListLength(List=support_pin_inds.Index)
concat_4 = Concatenate(FragmentA="Please input ", FragmentB=lng_2, FragmentC=" load values as [x, y, z] kN")
panel_4 = Panel(concat_4)

# ---- group: FEA Results
b_forces = BeamForcesKaramba3D(AnalyzedModel=beamview.Model, LCase=-1, MaximumDistanceBetweenResults_m=-1, NumberOfResultsPerBeamElement=2)  # -> AnalyzedModel, NormalForce_kN, ShearForceVz_kN, ShearForceVy_kN, BendingMomentMt_kNm, BendingMomentMy_kNm, BendingMomentMz_kNm
dispatch = Dispatch(List=beamview.DeformedBeamAxes, DispatchPattern=[True, False])  # -> ListA, ListB
bnd = Bounds(Numbers=flatten(b_forces.ShearForceVz_kN))
bnd_2 = Bounds(Numbers=flatten(b_forces.BendingMomentMy_kNm))
join = JoinCurves(Curves=dispatch.ListA, Preserve=False)
join_2 = JoinCurves(Curves=dispatch.ListB, Preserve=False)
lecrv = LoadEnvelopeFromCurves(
    ShearCurve=join,
    MomentCurve=join_2,
    ShearDomain=bnd,
    MomentDomain=bnd_2,
    SpanCurve=crv_2,
    NumberOfAnalysisSections=Slider(5, range=0..100))  # -> ShearEnvelopeKN, MomentEnvelopeKNM, ShearAndMomentGraphs

# ----
y_kn = Panel("""0
0
0
0
0
0
0
0
0
0
0
0
0
0
0
0
0
0
0
0""")
x_kn = Panel("""0
0
0
0
0
0
0
0
0
0
0
0
0
0
0
0
0
0
0
0""")
z_kn = Panel("""-10
-10
-10
-10
-10
-10
-10
-10
-10
-10
-10
-10
-10
-10
-10
-10
-10
-10
-10
-10""")

roller_supports_inds = Number(support_roller_inds.Index)
supports_inds = Number(support_pin_inds_2.Index)
load_inds = Number(support_pin_inds.Index)

merge_8 = Merge(Data1=graft(y_kn), Data2=graft(y_kn), Data3=graft(z_kn))  # -> simplify(Result)
pt2num_2 = PointsToNumbers(Points=graft(info.Nodes), Mask=4)  # -> simplify(Numbers)
item_4 = ListItem(List=info.Nodes, Index=info.EndIndex, Wrap=True)
item_5 = ListItem(List=info.Nodes, Index=info.StartIndex, Wrap=True)
vec2pt = Vector2Pt(PointA=item_5, PointB=item_4, Unitize=False)  # -> Vector, Length
get_default_points = CSharpScript(y=nz)  # -> out, points; inputs y: Int32; disabled
# ---------- get_default_points: C# ----------
    if (y== 1)
    {
      String layer = "Default";
      Int32 layer_index = doc.Layers.Find(layer, true);

      //if ((layer_index < 0));
      //return;

      Rhino.DocObjects.Layer lay = doc.Layers[layer_index];
      Rhino.DocObjects.RhinoObject[] objs = doc.Objects.FindByLayer(lay);
      //if (objs == null);
      //return ;
      List<Point3d> geo = new List<Point3d>();

      foreach (Rhino.DocObjects.RhinoObject obj in objs){
        GH_Point p = new GH_Point();
        p.CastFrom(obj.Geometry);
        geo.Add(p.Value);
      }
      points = geo;
    }
# ---------- end get_default_points ----------
panel_5 = Panel(pt2num_2)
panel_6 = Panel(merge_8)

crv_3 = Curve(bbuild.SpanCurve)
brep_3 = Brep(bbuild.BeamBrep)

expression_2 = Expression(d=Slider(12, range=0..100), Expression="pi*(d/2)^2")
expression_3 = Expression(A=expression_2, Expression="2*sqrt(A/pi)")
panel_7 = Panel(expression_3)

larger = LargerThan(SecondNumber=0)  # -> LargerThan, OrEqualTo

# ----
# Python
topopt_python = GhPythonScript(
    elements_i=info.StartIndex,
    elements_j=info.EndIndex,
    points=pt2num_2,
    supports_pin=supports_inds,
    supports_roller_x=roller_supports_inds,
    load_points=load_inds,
    load_values=merge_8,
    y=ly,
    maxVf=max_volume_fraction,
    date=concat_2,
    ndim=list)  # -> out; inputs elements_i: list, elements_j: list, points: tree, supports_pin: list, supports_roller_x: list, load_points: list, load_values: tree
# ---------- topopt_python: Python ----------
__author__ = "pitipatw"
__version__ = "2023.03.10"

import rhinoscriptsyntax as rs
import ghpythonlib.treehelpers as th
import json

# assign static values
output = dict() 
output["date"] = date
output["model_name"] = "Example_1"
output["unit"] = "meter"
output["generate_time"] = "10PM"

output["model_type"] = "truss"

output["_info"] = "Example1"
output["TO_model_type"] = "ground_mesh"
# Processing Inputs
tree = th.tree_to_list(points, retrieve_base = None)

#input materials detail
materials = dict()
materials = [{"G12": 1.0,
            "E": 1.0,
            "name": "DummyMaterial",
            "family": "DummyMaterial",
            "density": 78.5,
            "elem_tags": [],
            "E_unit": "kN/m2",
            "type_name": "ISO",
            "fy": 235000.0,
            "mu": 0.3,
            "density_unit": "kN/m3",
            "fy_unit": "kN/m2",
            "G12_unit": "kN/m2"}]
output["materials"] = materials

#make a default of 2 but then able to put in 3
output["dimension"] = ndim


cross_secs = dict() 
cross_secs["A"] = 1 
cross_secs["name"] = ""
cross_secs["family"] = "DummyCroSecByPitipat"
cross_secs["elem_tags"] = []
cross_secs["A_unit"] = "m2" 
cross_secs["Iy"]= 2.1106547193827362e-06
cross_secs["Iz"]= 2.1106547193827362e-06
cross_secs["Jx"]= 4.2213094387654724e-06
cross_secs["name"]= "ex1"
output["cross_secs"] = [cross_secs]


nodes = dict()
nodes_list = list()
for i in range(len(tree)):
    dummy = dict()
    dummy["node_ind"] = i
    dummy["point"] = tree[i][0:3]
    dummy["is_grounded"] = False
    nodes_list.append(dummy)

output["nodes"] = nodes_list
elements_list = list() 
for i in range(len(elements_i)) : 
    dummy = dict() 
    dummy["elem_ind"] = i
    dummy["end_node_inds"] = [ elements_i[i], elements_j[i]]
    dummy["elem_tag"] = ""
    dummy["bending_stiff"] = False
    elements_list.append(dummy)

supports_list = list()

check = True
for i in supports_pin:
    dummy = dict()
    dummy["node_ind"] = int(i)
    dummy["condition"] = [1,1,1,0,0,0] # pin x y z
    supports_list.append(dummy)
        
for i in supports_roller_x :
    dummy = dict()
    dummy["node_ind"] = int(i)
    dummy["condition"] = [0,1,1,0,0,0] #
    supports_list.append(dummy)
    

if y == 1:
    for i in range(len(tree)): 
        if i not in supports_roller_x:
            if i not in supports_pin:
                dummy = dict()
                dummy["node_ind"] = int(i)
                dummy["condition"] = [0,1,0,0,0,0] # pin y on everything
                supports_list.append(dummy)
else:
    for i in range(len(tree)): 
        if i not in supports_roller_x:
            if i not in supports_pin:
                dummy = dict()
                dummy["node_ind"] = int(i)
                dummy["condition"] = [0,0,0,0,0,0] # release everything on 3D
                supports_list.append(dummy)

output["supports"] = supports_list



output["joints"] = []

load_value_list = th.tree_to_list(load_values, retrieve_base = None)

loadcases_dict = dict()
#this is load case "0"
loadcases_0 = dict()
loadcases_0["lc_ind"] = 0
ploads = dict()
load_list = list()
for i in range(len(load_points)) :
    dummy = dict()
    dummy["node_ind"] = load_points[i]
    if i > (len(load_value_list)-1) : 
        x = 0.0
        y = 0.0 
        z = -10.0
    else:
#        continue
        [x,y,z] = load_value_list[i]
    dummy["force"]  = [int(x),int(y),int(z)]
    dummy["moment"] = [0.0, 0.0, 0.0] #No moment for now
    dummy["loadcase"] = str(i)
    dummy["force_unit"] = "kN"
    load_list.append(dummy)
    
    
loadcases_0["ploads"] = load_list
loadcases_0["eloads"] = []
loadcases_0["gravity"] = ""
loadcases_dict["0"] = loadcases_0

output["loadcases"] = loadcases_dict


output["elements"] = elements_list

#====Node and Element numbers are here!====
output["node_num"] = len(tree)
output["element_num"] = len(elements_list) 
#====

output["maxVf"] = maxVf
output["stage"] = "Opt"
print(json.dumps(output))
# ---------- end topopt_python ----------
get_groundstructure = GhPythonScript(points=pt2num, Lmax=max_members_length, date=concat_2)  # -> out; inputs points: tree
# ---------- get_groundstructure: Python ----------
__author__ = "pitipatw"
__version__ = "2023.03.10"

import rhinoscriptsyntax as rs
import ghpythonlib.treehelpers as th
import json

# assign static values
output = dict() 
output["model_name"] = "Example_1"
output["unit"] = "meter"
output["generate_time"] = "10PM"

output["model_type"] = "truss"

output["_info"] = "Example1"
output["TO_model_type"] = "ground_mesh"

# Processing Inputs
tree = th.tree_to_list(points, retrieve_base = None)


nodes = dict()
nodes_list = dict()
for i in range(len(tree)):
    nodes_list[i] = tree[i][0:3]

output["nodes"] = nodes_list
output["Lmax"] = Lmax
output["date"] = date
output["stage"] = "GS"
print(json.dumps(output))
# ---------- end get_groundstructure ----------

# ---- group: Vu, Mu
num = Number(lecrv.ShearEnvelopeKN)
num_2 = Number(lecrv.MomentEnvelopeKNM)

# ---- group: Rebar Area
number_0 = Slider(0.011, range=0.001..1)
remap = RemapNumbers(Value=number_0, Source=Domain(0, 1), Target="0 to 10000")  # -> Mapped, Clipped
as_mm2 = Panel(remap.Mapped)

# ----
panel_8 = Panel(topopt_python)

# ---- group: WebSockets for Julia
server_port = Panel("ws://127.0.0.1:2000/")
websocket_client_start = WebsocketClientStart(Address=server_port, InitalMessage=get_groundstructure, Reset=create_a_ground_structure)
websocket_client_start_2 = WebsocketClientStart(Address=server_port, InitalMessage=topopt_python, Reset=optimization)
toggle = BooleanToggle(True)
websocket_client_receiver = WebsocketClientReceiver(WebsocketObjects=websocket_client_start_2, AutoUpdate=toggle)  # -> Message, Status
panel_9 = Panel(websocket_client_receiver.Status)
panel_10 = Panel(websocket_client_receiver.Message)

# ----
cull_2 = CullPattern(List=item_5, CullPattern=larger.LargerThan)
cull_3 = CullPattern(List=vec2pt.Vector, CullPattern=larger.LargerThan)
cull_4 = CullPattern(List=vec2pt.Length, CullPattern=larger.LargerThan)
division_4 = Division(B=Slider(45, range=10..100))
cull_5 = CullPattern(List=division_4, CullPattern=larger.LargerThan)
panel_11 = Panel(get_groundstructure)
number_slider_3 = Slider(0.05, range=0..0.1)
multiplication_4 = Multiplication(A=cull_5, B=5)
panel_12 = Panel(num_2)
circle = CircleCNR(Center=cull_2, Normal=cull_3, Radius=cull_5)
align = AlignPlanes()
rectangle = Rectangle(Plane=cull_2, XSize=multiplication_4, YSize=multiplication_4, Radius=0)  # -> Rectangle, Length

# ----
# 3 | Analysis & Optimization
read_mp_2 = ReadMP()

number_8 = Slider(35, range=15..200)
bs = BeamSections(
    MaterialProperties=read_mp_2,
    MomentEnvelopeKNM=num_2,
    BeamBRep=brep_3,
    SpanCurve=crv_3,
    ClearCoverMm=number_8,
    AreaOfSteelMm2=remap.Mapped,
    ConstantAreaOfSteel=Toggle(True))  # -> ConcreteSections, SteelReinforcementSections

crv_4 = Curve(join_2)
domain = Domain(bnd)
domain_2 = Domain(bnd_2)
brep_4 = Brep(bbuild.BeamBrep)
crv_5 = Curve(join)
crv_6 = Curve(bbuild.SpanCurve)
num_3 = Number(remap.Mapped)
num_4 = Number(number_8)

orient = Orient(Geometry=rectangle.Rectangle, Source=cull_3, Target=PlaneXY(0, 0, 0))  # -> Geometry, Transform
extr = Extrude(Base=circle, Direction=cull_3)

# ---- group: Loads Visualization
item_6 = ListItem(List=info.Nodes, Index=load_inds, Wrap=True)
cone = Cone(Base=item_6, Radius=0.1, Length=expr("x/100", z_kn))  # -> Cone, Tip
move = Move(Geometry=cone.Cone, Motion=Vector(0, 0, 0.1))  # -> Geometry, Transform
preview = CustomPreview(Geometry=move.Geometry, Material=ColourSwatch(SwatchColor=RGB(255, 64, 64)))

# ---- group: Supports Visualization
item_7 = ListItem(List=info.Nodes, Index=supports_inds, Wrap=True)
cone_2 = Cone(Base=item_7, Radius=number_slider_3, Length=number_slider_3)  # -> Cone, Tip
preview_2 = CustomPreview(Geometry=cone_2.Cone, Material=ColourSwatch(SwatchColor=RGB(64, 255, 175)))

item_8 = ListItem(List=info.Nodes, Index=roller_supports_inds, Wrap=True)
cone_3 = Cone(Base=item_8, Radius=number_slider_3, Length=number_slider_3)  # -> Cone, Tip
preview_3 = CustomPreview(Geometry=cone_3.Cone, Material=ColourSwatch(SwatchColor=RGB(64, 86, 255)))

# ----
websocket_client_receiver_2 = WebsocketClientReceiver(WebsocketObjects=websocket_client_start, AutoUpdate=toggle)  # -> Message, Status
python_5 = GhPythonScript(input=websocket_client_receiver_2.Message, points=pt2num_2)  # -> out, output; inputs points: tree
# ---------- python_5: Python ----------
__author__ = "pitipatw"
__version__ = "2023.01.24"

import rhinoscriptsyntax as rs
import ghpythonlib.treehelpers as th
import json


output = []
list_points= th.tree_to_list(points, retrieve_base = None)
print(list_points)
dictofelements = json.loads(input)
for i in range(len(dictofelements)):
    temp = (dictofelements[str(i)])
    #, points[i])
    output.append(temp)
    
    
print(output[1])
print(output)
# ---------- end python_5 ----------
python_6 = GhPythonScript(Msg=websocket_client_receiver_2.Message, points=pt2num)  # -> out, element_starts, element_ends, lines; inputs points: tree
# ---------- python_6: Python ----------
__author__ = "pitipatw"
__version__ = "2023.04.14"

import rhinoscriptsyntax as rs
import ghpythonlib.treehelpers as th
import json

elements = json.loads(Msg)
tree = th.tree_to_list(points, retrieve_base = None)
n = len(elements)
print(n)
print(elements)
lines = list()
element_starts = list()
element_ends = list()
for i in range(n) : 
#    print(str(i+1))
    element_starts.append(elements[str(i+1)][0])
    element_ends.append(elements[str(i+1)][1])
    p1 = rs.AddPoint(tree[elements[str(i+1)][0]])
    p2 = rs.AddPoint(tree[elements[str(i+1)][1]])
    lines.append(rs.AddLine(p1,p2))
# ---------- end python_6 ----------

yz = YZPlane(Origin=Point(0, 0, 0))
offset = OffsetCurve(Curve=bs.SteelReinforcementSections, Distance=Slider(0.015, range=0..0.1), Plane=yz, Corners=1)
ccx = CurveCurve(CurveA=graft(bs.ConcreteSections), CurveB=offset)  # -> flatten(Points), ParamsA, ParamsB
_10º = PowerOf10(Value=Slider(1, range=1..5))
lng_3 = ListLength(List=ccx.Points)
multiplication_5 = Multiplication(A=lng_3, B=_10º)
sqr = Square(Value=lng_3)
neg = Negative(Value=sqr)

# ---- group: Deflection calcs
division_5 = Division(A=slab_clear_span_m, B=Slider(360, range=0..1000))
deflection_limit_m = Panel(division_5)

read_mp_3 = ReadMP()
lecrv_2 = LoadEnvelopeFromCurves(
    ShearCurve=crv_5,
    MomentCurve=crv_4,
    ShearDomain=domain,
    MomentDomain=domain_2,
    SpanCurve=crv_6,
    NumberOfAnalysisSections=Slider(31, range=0..100))  # -> ShearEnvelopeKN, MomentEnvelopeKNM, ShearAndMomentGraphs
bs_2 = BeamSections(
    MaterialProperties=read_mp_3,
    MomentEnvelopeKNM=lecrv_2.MomentEnvelopeKNM,
    BeamBRep=brep_4,
    SpanCurve=crv_6,
    ClearCoverMm=num_4,
    AreaOfSteelMm2=num_3,
    ConstantAreaOfSteel=False)  # -> ConcreteSections, SteelReinforcementSections
fa = FlexuralAnalysis(
    MaterialProperties=read_mp_3,
    MomentEnvelopeKNM=lecrv_2.MomentEnvelopeKNM,
    ConcreteSection=bs_2.ConcreteSections,
    SteelSection=bs_2.SteelReinforcementSections,
    SectionSubdivisions=15)  # -> MomentCapacityKNM, CompressionArea
mcr = CrackingMoment(MaterialProperties=read_mp_3, ConcreteSection=bs_2.ConcreteSections, SteelSection=bs_2.SteelReinforcementSections)
icr = CrackedMomentOfInertia(MaterialProperties=read_mp_3, ConcreteCompressionArea=fa.CompressionArea, SteelSection=bs_2.SteelReinforcementSections)
iu = GrossMomentOfInertia(MaterialProperties=read_mp_3, ConcreteSection=bs_2.ConcreteSections, SteelSection=bs_2.SteelReinforcementSections)
ieff = EffectiveMomentOfInertia(
    MomentEnvelopeKNM=lecrv_2.MomentEnvelopeKNM,
    CrackingMomentKNM=mcr,
    GrossMomentOfInertiaM⁴=iu,
    CrackedMomentOfInertiaM⁴=icr)
defss = DisplacementOfSimplySupportedBeam(
    MaterialProperties=read_mp_3,
    MomentEnvelopeKNM=lecrv_2.MomentEnvelopeKNM,
    EffectiveMomentOfInertiaM⁴=ieff,
    SpanCurve=crv_6)  # -> Rotation, DeflectionM
item_9 = ListItem(List=defss.DeflectionM, Index=0, Wrap=True)  # -> Item1, Item
graph = QuickGraph(defss.DeflectionM, SortOrder=0)
graph_2 = QuickGraph(defss.Rotation, SortOrder=0)
panel_13 = Panel(item_9.Item1)
neg_2 = Negative(Value=item_9.Item1)
expression_4 = Expression(dlim=division_5, dmax=neg_2, Expression="100*(dlim-dmax)/dlim")
deflection_constraint = Panel(expression_4)

# ----
extr_2 = Extrude(Base=rectangle.Rectangle, Direction=cull_3)
preview_4 = CustomPreview(Geometry=extr, Material=ColourSwatch(SwatchColor=RGB(0, 55, 255)))

fa_2 = FlexuralAnalysis(
    MaterialProperties=read_mp_2,
    MomentEnvelopeKNM=num_2,
    ConcreteSection=bs.ConcreteSections,
    SteelSection=bs.SteelReinforcementSections,
    SectionSubdivisions=15)  # -> MomentCapacityKNM, CompressionArea
da = DuctilityAnalysis(
    MaterialProperties=read_mp_2,
    ConcreteSection=bs.ConcreteSections,
    SteelSection=bs.SteelReinforcementSections,
    ClearCoverMm=30,
    SectionSubdivisions=15)  # -> ReinforcementRatio, BwCrv, DistanceToTensileReinforcementM, MaxReinforcementRatio, MinReinforcementRatio
sa = ShearAnalysis(
    MaterialProperties=read_mp_2,
    MomentEnvelopeKNM=num_2,
    ShearEnvelopeKN=num,
    DesignShearReinforcementKN=0,
    ConcreteSection=bs.ConcreteSections,
    SteelSection=bs.SteelReinforcementSections,
    ClearCoverMm=30,
    SectionSubdivisions=15)  # -> ShearCapacityKN, BwCrv

# ---- group: effective width constraint
len = Length(Curve=sa.BwCrv)
expression_5 = Expression(hf=merge_6, bw=len, b=slab_width_m, Expression="100*((16*hf + bw)-b)/b")
panel_14 = Panel(merge_6)
expression_6 = Expression(hf=merge_6, lim=Slider(0.03, range=0..0.1), Expression="100*(hf-lim)/lim")

# ----
cross_section = CrossSectionKaramba3D(FamilyNameOfCrossSection="DefaultCroSec", Diameter_cm=11.43, WallThickness_cm=0.4, mode="Circular Hollow")
item_10 = ListItem(List=info.Nodes, Index=support_pin_inds_2.Index, Wrap=True)
matprops = MaterialPropertiesKaramba3D(
    FamilyOfMaterial="Steel",
    Name="S235",
    YoungsModulus_kN_cm2=21000,
    InPlaneShearModulus_kN_cm2=8076,
    TransverseShearModulus_kN_cm2=8076,
    SpecificWeight_kN_m3=78.5,
    CoefficientOfThermalExpansion_1_C=1.2e-05,
    TensileStrength_kN_cm2=23.5,
    CompressiveStrength_kN_cm2=-23.5,
    StrengthHypothesis="MISES",
    mode="Isotrop")
abs = Absolute(Value=num_2)
abs_2 = Absolute(Value=fa_2.MomentCapacityKNM)
abs_3 = Absolute(Value=num)
abs_4 = Absolute(Value=sa.ShearCapacityKN)

expression_7 = Expression(rho=da.ReinforcementRatio, rho_max=da.MaxReinforcementRatio, Expression="100*(rho_max-rho)/rho_max")
expression_8 = Expression(rho=da.ReinforcementRatio, rho_min=da.MinReinforcementRatio, Expression="100*(rho-rho_min)/rho_min")
expression_9 = Expression(Mu=abs, Mn=abs_2, Expression="100*(Mn-Mu)/Mn")
expression_10 = Expression(Vu=abs_3, Vn=abs_4, Expression="100*(Vn-Vu)/Vn")

python_7 = GhPythonScript(input=websocket_client_receiver.Message, points=pt2num_2)  # -> out, lines, pos_areas, stresses; inputs points: tree
# ---------- python_7: Python ----------
__author__ = "pitipatw"
__version__ = "2023.01.24"

import rhinoscriptsyntax as rs
import ghpythonlib.treehelpers as th
import json

tree= th.tree_to_list(points, retrieve_base = None)
#print(list_points)
data = json.loads(input)

n = len(data["Elements"])
elements = data["Elements"]
areas = data["Area"]
pos_areas = []
stresses = []
lines = []
for i in range(n) : 
    if areas[i] > 0.00001: 
        p1 = rs.AddPoint(tree[elements[str(i+1)][0]-1])
        p2 = rs.AddPoint(tree[elements[str(i+1)][1]-1])
        lines.append(rs.AddLine(p1,p2))
        pos_areas.append(areas[i])
        stresses.append(data["Stress"][i])
# ---------- end python_7 ----------
line_3 = LineSDL(Start=cull_2, Direction=cull_3, Length=cull_4)
supp_3 = SupportKaramba3D(PosInd=item_10, menu=[buttons(on, on, on, off, off, off)])
panel_15 = Panel(python_6.lines)
item_11 = ListItem(List=info.Nodes, Index=support_pin_inds.Index, Wrap=True)
Z_2 = UnitZ(Factor="-10")
explode = Explode(Curve=line_3, Recursive=True)  # -> Segments, Vertices
loads_2 = LoadsKaramba3D(ForceVector=Z_2, Local=False, PosInd=item_11, LCase="0", mode="Point")
duppt_2 = RemoveDuplicatePts(Points=flatten(explode.Vertices), Tolerance=0.01)
material = MaterialKaramba3D(matprops)
linetobeam_2 = LineToBeamKaramba3D(
    Line=line_3,
    New=True,
    Remove=True,
    LimitDistance_m=0.005,
    Bending=True,
    SetBucklingLength=True,
    ToPolylineMaxAngle=0.03,
    ToPolylineTolerance=0.01,
    ToPolylineMaxEdgeLength=0.25)  # -> Element, Points, Info
support = SupportKaramba3D(supp_3)
load = LoadKaramba3D(loads_2)

# ---- group: Constraints
num_5 = Number(flatten([expression_9, expression_10, neg, expression_7, expression_8, expression_5, expression_6, expression_4]))

# ----
smaller = SmallerThan(FirstNumber=num_5, SecondNumber=0)  # -> SmallerThan, OrEqualTo
ma = MassAddition(Input=smaller.SmallerThan)  # -> Result, PartialResults
panel_16 = Panel(ma.Result)

# ---- group: Variables
num_6 = Number([number_0, number_8, slab_width_m, maximum_depth, number_4_3, number_4_4, number_4_5, number_4, maximum_depth_2, number_4_7, number_4_8, number_4_6, number_4_2])

# ----
assemble_2 = AssembleModelKaramba3D(
    Point=duppt_2,
    Elem=linetobeam_2.Element,
    Support=support,
    Load=load,
    CrossSection=cross_section,
    Material=material,
    LimitDistance_m=0.005)  # -> Model, Info, Mass_kg, CenterOfGravity, LoadCaseNames
panel_17 = Panel(num_5)
X = UnitX(Factor=expr("1.5*x", lx))
analyze_2 = AnalyzeKaramba3D(Model=assemble_2.Model)  # -> CalculatedModel, MaximumDisplacement_cm, ResultingForceOfGravity_kN, ElasticEnergyChange_kNm
vec = VectorXYZ(XComponent=expr("1.5*x", lx), YComponent=0, ZComponent=0)  # -> Vector, Length
b_forces_2 = BeamForcesKaramba3D(AnalyzedModel=analyze_2.CalculatedModel, Ts=[0, 1])  # -> AnalyzedModel, NormalForce_kN, ShearForceVz_kN, ShearForceVy_kN, TorsionalMomentMt_kNm, BendingMomentMy_kNm, BendingMomentMz_kNm
larger_2 = LargerThan(FirstNumber=python_7.stresses, SecondNumber="0")  # -> LargerThan, OrEqualTo
cull_6 = CullPattern(List=python_7.pos_areas, CullPattern=larger_2.LargerThan)
xz_2 = XZPlane(Origin=Point(0, 0, 0))

resultant_mass_kg = Panel("6418.128969")
resultant_ec = Panel("994.759039")

X_2 = UnitX(Factor=expr("1.5*x", lx))

vol_steel_m3 = Panel("-0.005432")
vol_concrete_m3 = Panel("-2.656")

pipeline_6 = GeometryPipeline(
    GroupByLayer=False,
    GroupByType=False,
    IncludeHidden=True,
    IncludeLocked=True,
    LayerFilter="ModGeo",
    NameFilter="*",
    SublayerFiltering=True,
    TypeFilter=4)

# ---- group: Bake THIS and MOD
move_2 = Move(Geometry=pipeline_6, Motion=vec.Vector)  # -> Geometry, Transform

# ----
curvepoint_5 = PointOnCurve(pipeline_6, parameter=1)
curvepoint_6 = PointOnCurve(pipeline_6, parameter=0)
cull_7 = CullPattern(List=move_2.Geometry, CullPattern=larger_2.LargerThan)
cull_8 = CullPattern(List=move_2.Geometry, CullPattern=invert(larger_2.LargerThan))
hull = ConvexHull(Points=[curvepoint_5, curvepoint_6], Plane=xz_2)  # -> Hull, HullZ, Indices
move_3 = Move(Geometry=cull_7, Motion=X)  # -> Geometry, Transform
curvepoint_7 = PointOnCurve(move_3.Geometry, parameter=0.5)
move_4 = Move(Geometry=hull.Hull, Motion=X)  # -> Geometry, Transform
preview_5 = CustomPreview(Geometry=move_3.Geometry, Material=ColourSwatch(SwatchColor=RGB(0, 55, 255)))
move_5 = Move(Geometry=cull_8, Motion=X)  # -> Geometry, Transform
curvepoint_8 = PointOnCurve(move_5.Geometry, parameter=0.5)
xz_3 = XZPlane(Origin=curvepoint_7)
tag = TextTag3D(Location=xz_3, Text=cull_6, Size=Slider(50, range=0..100), Justification=7)
preview_6 = CustomPreview(Geometry=move_5.Geometry, Material=ColourSwatch(SwatchColor=RGB(255, 0, 0)))
llinter = LineLineIntersectionKaramba3D(Line=pipeline_6, LimitDistance_m=0.005)  # -> IntersectionPoints, flatten(LineSubSegements)
xz_4 = XZPlane(Origin=curvepoint_8)
tag_2 = TextTag3D(Location=xz_4, Text=cull_6, Size=Slider(50, range=0..100), Justification=7)
duppt_3 = RemoveDuplicatePts(Points=llinter.IntersectionPoints, Tolerance=0.01)
pdecon = Deconstruct(Point=duppt_3)  # -> XComponent, YComponent, ZComponent
dupln = RemoveDuplicateLines(Lines=llinter.LineSubSegements, Tolerance=0.01)

sort = SortList(Keys=pdecon.XComponent, ValuesA=pdecon.XComponent)  # -> Keys, ValuesA
sort_2 = SortList(Keys=pdecon.ZComponent, ValuesA=pdecon.XComponent)  # -> Keys, ValuesA
item_12 = ListItem(List=sort.ValuesA, Index=0, Wrap=True)
item_13 = ListItem(List=sort_2.Keys, Index=0, Wrap=True)
equals_2 = Equality(FirstNumber=item_12, SecondNumber=pdecon.XComponent)  # -> Equality, Inequality
equals_3 = Equality(FirstNumber=item_13, SecondNumber=pdecon.ZComponent)  # -> Equality, Inequality
and = GateAnd(A=equals_2.Equality, B=equals_3.Equality)
cull_9 = CullPattern(List=duppt_3, CullPattern=and)

python_8 = GhPythonScript(np=nx)  # -> out, output
# ---------- python_8: Python ----------
__author__ = "pitipatw"
__version__ = "2023.07.16"

import rhinoscriptsyntax as rs

output = []
if np%2 == 0:
    output.append(np/2)
    output.append(np/2+1)
else:
    output.append((np+1)/2)
# ---------- end python_8 ----------
subtraction_7 = Subtraction(A=python_8.output, B="1")
multiplication_6 = Multiplication(A=subtraction_7, B=python.x)
addition = Addition(A=multiplication_6, B=item_12)

sort_3 = SortList(Keys=pdecon.XComponent, ValuesA=pdecon.XComponent)  # -> Keys, ValuesA
sort_4 = SortList(Keys=pdecon.ZComponent, ValuesA=pdecon.XComponent)  # -> Keys, ValuesA
item_14 = ListItem(List=reverse(sort_3.ValuesA), Index=0, Wrap=True)
item_15 = ListItem(List=sort_4.Keys, Index=0, Wrap=True)
equals_4 = Equality(FirstNumber=item_15, SecondNumber=pdecon.ZComponent)  # -> Equality, Inequality
equals_5 = Equality(FirstNumber=item_14, SecondNumber=pdecon.XComponent)  # -> Equality, Inequality
and_2 = GateAnd(A=equals_5.Equality, B=equals_4.Equality)
cull_10 = CullPattern(List=duppt_3, CullPattern=and_2)

sort_5 = SortList(Keys=pdecon.ZComponent, ValuesA=pdecon.XComponent)  # -> Keys, ValuesA
item_16 = ListItem(List=reverse(sort_5.Keys), Index=0, Wrap=True)
ft_mpa = Slider(412, range=28..928)
fc_mpa = Slider(31, range=28..56)
number_slider_4 = Slider(20, range=0..20)
item_17 = ListItem(List=addition, Index=0, Wrap=True)  # -> Item, Item1
item_18 = ListItem(List=addition, Index=0, Wrap=True)  # -> Item, Item1
equalst = EqualityWithinTolerance(FirstNumber=item_16, SecondNumber=pdecon.ZComponent, Tolerance=number_slider_4)  # -> Equality, Inequality
or = GateOr(A=and, B=and_2)
matselect = MaterialSelectionKaramba3D(menu=[dropdown(7), dropdown(5)])
equalst_2 = EqualityWithinTolerance(FirstNumber=item_17.Item, SecondNumber=pdecon.XComponent, Tolerance=number_slider_4)  # -> Equality, Inequality
equalst_3 = EqualityWithinTolerance(FirstNumber=item_18.Item1, SecondNumber=pdecon.XComponent, Tolerance=number_slider_4)  # -> Equality, Inequality
division_6 = Division(A="5200000", B=Slider(2, range=0..10))
division_7 = Division(A=fc_mpa, B=10)
division_8 = Division(A=ft_mpa, B=10)
not = GateNot(A=or)
and_3 = GateAnd(A=equalst_2.Equality, B=equalst.Equality)
and_4 = GateAnd(A=equalst_3.Equality, B=equalst.Equality)
panel_18 = Panel(matselect)
supp_4 = SupportKaramba3D(PosInd=cull_10, menu=[buttons(off, on, on, off, off, off)])
supp_5 = SupportKaramba3D(PosInd=cull_9, menu=[buttons(on, on, on, off, off, off)])
linetobeam_3 = LineToBeamKaramba3D(
    Line=dupln,
    New=True,
    Remove=True,
    LimitDistance_m=0.005,
    Bending=True,
    SetBucklingLength=True,
    ToPolylineMaxAngle=0.03,
    ToPolylineTolerance=0.01,
    ToPolylineMaxEdgeLength=0.25)  # -> Element, Points, Info
cull_11 = CullPattern(List=duppt_3, CullPattern=and_3)
panel_19 = Panel("""3
5
6
8""")
matprops_2 = MaterialPropertiesKaramba3D(
    FamilyOfMaterial="Vectran",
    Name=panel_19,
    YoungsModulus_kN_cm2="5200000",
    InPlaneShearModulus_kN_cm2=division_6,
    TransverseShearModulus_kN_cm2=division_6,
    SpecificWeight_kN_m3=78.5,
    CoefficientOfThermalExpansion_1_C=1.2e-05,
    TensileStrength_kN_cm2=division_8,
    CompressiveStrength_kN_cm2=expr("-x", division_7),
    StrengthHypothesis="MISES",
    mode="Isotrop")
cull_12 = CullPattern(List=duppt_3, CullPattern=not)
supp_6 = SupportKaramba3D(PosInd=cull_12, menu=[buttons(off, on, off, off, off, off)])
cull_13 = CullPattern(List=duppt_3, CullPattern=and_4)
panel_20 = Panel("""1/8
3/16
1/4
5/16""")
Z_3 = UnitZ(Factor=expr("-x", Slider(2, range=0..100)))
panel_21 = Panel("5")
merge_9 = Merge(Data1=supp_5, Data2=supp_4, Data3=supp_6)
item_19 = ListItem(List=matprops_2, Index=Slider(2, range=0..4), Wrap=True)
division_9 = Division(A=panel_19, B=Slider(2, range=0..10))
merge_10 = Merge(Data1=cull_11, Data2=cull_13)
loads_3 = LoadsKaramba3D(ForceVector=Z_3, Local=False, PosInd=merge_10, LCase="0", mode="Point")
support_2 = SupportKaramba3D(merge_9)
panel_22 = Panel("concrete")
pipeline_7 = GeometryPipeline(
    GroupByLayer=False,
    GroupByType=False,
    IncludeHidden=True,
    IncludeLocked=True,
    LayerFilter="Holes",
    NameFilter="*",
    SublayerFiltering=True,
    TypeFilter=4)
pipeline_8 = GeometryPipeline(
    GroupByLayer=False,
    GroupByType=False,
    IncludeHidden=True,
    IncludeLocked=True,
    LayerFilter="Restricted bars",
    NameFilter="*",
    SublayerFiltering=True,
    TypeFilter=4)
cross_section_2 = CrossSectionKaramba3D(
    FamilyNameOfCrossSection="Vectran",
    NameOfCrossSection=panel_20,
    Diameter_cm=panel_19,
    WallThickness_cm=division_9,
    mode="Circular Hollow")
cross_section_3 = CrossSectionKaramba3D(
    FamilyNameOfCrossSection="Vectran",
    NameOfCrossSection=panel_20,
    Diameter_cm=panel_19,
    WallThickness_cm=division_9,
    mode="Circular Hollow")
item_20 = ListItem(List=panel_20, Index=Slider(3, range=0..3), Wrap=True)
panel_23 = Panel(equalst_2.Equality)
panel_24 = Panel(cross_section_2)
crosecselect = CrossSectionSelectorKaramba3D(CrossSections=cross_section_2, NameOrListIndexOfCrossSection=item_20)  # -> CrossSection, Info
assemble_3 = AssembleModelKaramba3D(
    Point=duppt_3,
    Elem=linetobeam_3.Element,
    Support=support_2,
    Load=loads_3,
    CrossSection=crosecselect.CrossSection,
    Material=item_19,
    LimitDistance_m=0.005)  # -> Model, Info, Mass_kg, CenterOfGravity, LoadCaseNames
analyze_3 = AnalyzeKaramba3D(Model=assemble_3.Model)  # -> CalculatedModel, MaximumDisplacement_cm, ResultingForceOfGravity_kN, ElasticEnergyChange_kNm
fsim = FindSimilarMember(Data=line_2, Set=pipeline_8)  # -> Hit, Index
bcx = BrepCurve()  # -> Curves, Points
index = ItemIndex(List=line_2, Item=pipeline_8)
modelview_2 = ModelViewKaramba3D(Model=analyze_3.CalculatedModel, ResultFactors=1, ResultCase=-1)  # -> Model, DeformedMesh, DeformedAxes, DeformedModel
panel_25 = Panel(crosecselect.CrossSection)

crv_7 = Curve(pipeline_8)  # disabled
curvepoint_9 = PointOnCurve(crv_7, parameter=1)  # disabled
curvepoint_10 = PointOnCurve(crv_7, parameter=0)  # disabled
crv_8 = Curve(info.Edges)  # disabled
mindex = MemberIndex(Set=info.Nodes, Member=curvepoint_9)  # -> graft(Index), Count; disabled
curvepoint_11 = PointOnCurve(crv_8, parameter=1)  # disabled
curvepoint_12 = PointOnCurve(crv_8, parameter=0)  # disabled
mindex_2 = MemberIndex(Set=info.Nodes, Member=curvepoint_10)  # -> graft(Index), Count; disabled
merge_11 = Merge(Data1=mindex_2.Index, Data2=mindex.Index)  # -> simplify(Result); disabled
mindex_3 = MemberIndex(Set=info.Nodes, Member=curvepoint_11)  # -> flatten(Index), Count; disabled
mindex_4 = MemberIndex(Set=info.Nodes, Member=curvepoint_12)  # -> flatten(Index), Count; disabled
equals_6 = Equality(FirstNumber=mindex_2.Index, SecondNumber=mindex_4.Index)  # -> Equality, Inequality; disabled
equals_7 = Equality(FirstNumber=mindex.Index, SecondNumber=mindex_3.Index)  # -> Equality, Inequality; disabled
panel_26 = Panel("1")  # disabled
panel_27 = Panel([mindex_2.Index, mindex.Index])  # disabled
panel_28 = Panel(merge_11)  # disabled
multiplication_7 = Multiplication(A=equals_6.Equality, B=equals_7.Equality)  # -> simplify(Result); disabled
index_2 = ItemIndex(List=simplify(equals_6.Equality), Item=panel_26)  # disabled
fsim_2 = FindSimilarMember(Data=simplify(multiplication_7), Set=panel_26)  # -> Hit, Index; disabled
mindex_5 = MemberIndex(Set=multiplication_7, Member=panel_26)  # -> Index, Count; disabled
ma_2 = MassAddition(Input=multiplication_7)  # -> Result, PartialResults; disabled
panel_29 = Panel(fsim_2.Hit)  # disabled

nodedisp = NodalDisplacementsKaramba3D(AnalyzedModel=modelview_2.Model, PositionsIndexes=merge_10)  # -> AnalyzedModel, NodalTranslations_m, NodalRotations_rad
# 2.300/480 = 0.00479 m
panel_30 = Panel(nodedisp.NodalTranslations_m)

ee = TotalEmbodiedEnergy(MaterialProperties=read_mp_2, ConcreteSection=bs.ConcreteSections, SteelSection=bs.SteelReinforcementSections)  # -> EmbodiedEnergyMJ, TotalMassKg, SteelAndConcreteBreps
brep_5 = Brep(ee.SteelAndConcreteBreps)

division_10 = Division(A=long_span_m, B=slab_width_m)
Y = UnitY(Factor=slab_width_m)
of_slabs = Panel(division_10)
arrlinear = LinearArray(Geometry=brep_5, Direction=Y, Count=division_10)  # -> Geometry, Transform
# 4 | Visualization
preview_7 = CustomPreview(Geometry=arrlinear.Geometry, Material=ColourSwatch(SwatchColor=RGBA(125, 119, 115, 178)))

num_7 = Number(division_10)
multiplication_8 = Multiplication(A=num_7, B=ee.EmbodiedEnergyMJ)

# ---- group: Objective
num_8 = Number(multiplication_8)

# ----
radical = Radical(
    Objective=num_8,
    Constraints=num_5,
    NumericalVariables=[number_0, number_8, slab_width_m, maximum_depth, number_4_3, number_4_4, number_4_5, number_4, maximum_depth_2, number_4_7, number_4_8, number_4_6, number_4_2])  # -> ObjectiveEvolution, Var, GradientEvolution

# ---- group: Material volumes
volume_2 = Volume(Geometry=brep_5)  # -> Volume, Centroid
multiplication_9 = Multiplication(A=num_7, B=volume_2.Volume)
item_21 = ListItem(List=multiplication_9, Index=0, Wrap=True)  # -> Item, Item1
panel_31 = Panel(item_21.Item1)
panel_32 = Panel(item_21.Item)

# ----
multiplication_10 = Multiplication(A=num_7, B=ee.TotalMassKg)
resultant_ee = Panel("2497.801029")
# 5 | Evaluation
resultant_ee_2 = Panel(num_8)
resultant_mass_kg_2 = Panel(multiplication_10)

expression_11 = Expression(x=panel_32, y=vol_concrete_m3, Expression="Format(\"{0:0}\", (y-x)/y*100) & \"% Concrete Reduction\"")
expression_12 = Expression(x=panel_31, y=vol_steel_m3, Expression="Format(\"{0:0}\", (y-x)/y*100) & \"% Steel Reduction\"")
panel_33 = Panel(expression_12)
panel_34 = Panel(expression_11)

expression_13 = Expression(x=resultant_ee_2, y=resultant_ec, Expression="\", \" & Format(\"{0:0}\", (y-x)/y*100) & \"% EC Reduction\"")
expression_14 = Expression(x=resultant_mass_kg_2, y=resultant_mass_kg, Expression="Format(\"{0:0}\", (y-x)/y*100) & \"% Mass Reduction\"")
panel_35 = Panel(expression_14)
panel_36 = Panel(expression_13)

# ---- group: Result Visualization
expression_15 = Expression(x=multiplication_8, Expression="Format(\"{0:0.0}\", x) & \" kg CO2\"")
curvepoint_13 = PointOnCurve(crv_3, parameter=0.5)
Z_4 = UnitZ(Factor=Slider(0.25, range=0..1))
move_6 = Move(Geometry=curvepoint_13, Motion=Z_4)  # -> Geometry, Transform
xz_5 = XZPlane(Origin=move_6.Geometry)

# ----
concat_5 = Concatenate(FragmentA=expression_15, FragmentB=expression_13)
panel_37 = Panel(expression_15)

# ---- group: Result Visualization (continued)
tag_3 = TextTag3D(Location=xz_5, Text=concat_5, Size=Slider(0.14, range=0..1), Justification=5)

# ----
sort_6 = SortList(Keys=pdecon.ZComponent, ValuesA=pdecon.ZComponent)  # -> Keys, ValuesA
item_22 = ListItem(List=reverse(sort_6.ValuesA), Index=0, Wrap=True)

equalst_4 = EqualityWithinTolerance(FirstNumber=item_22, SecondNumber=pdecon.ZComponent, Tolerance=0.001)  # -> Equality, Inequality

cull_14 = CullPattern(List=duppt_3, CullPattern=equalst_4.Equality)
