# Grasshopper definition 09152023_main_Multimat.gh (Grasshopper 1.0.7)
# plug-ins: FDMremote, Karamba3D, Kangaroo2 Components, BeamShapeExplorer, Radical, Pufferfish

dom = ConstructDomain(DomainStart=Slider(0, range=0..100), DomainEnd=Slider(12700, range=0..50000))
dom_2 = ConstructDomain(DomainStart=Slider(0, range=0..100), DomainEnd=Slider(2540, range=0..50000))
rectangle = Rectangle(Plane=PlaneXY(0, 0, 0), XSize=dom, YSize=dom_2, Radius=0)  # -> Rectangle, Length

number_slider = Slider(0, range=0..1000)
delete_points = Button()
setup_layers = CSharpScript()  # -> out, A
# ---------- setup_layers: C# usings ----------
using Rhino.DocObjects;
using Rhino.Display ;
# ---------- setup_layers: C# ----------
    Rhino.RhinoDoc doc = Rhino.RhinoDoc.ActiveDoc;



    Layer l0 = new Layer();
    l0.Name = "Default";
    l0.Color = System.Drawing.Color.Black;
    int l0Index = doc.Layers.Add(l0);

    Layer l1 = new Layer();
    l1.Name = "Load points";
    l1.Color = System.Drawing.Color.Red;
    int l1Index = doc.Layers.Add(l1);

    Layer l2 = new Layer();
    l2.Name = "Supports (pin)";
    l2.Color = System.Drawing.Color.Blue;
    int l2Index = doc.Layers.Add(l2);

    Layer l3 = new Layer();
    l3.Name = "Supports (roller)";
    l3.Color = System.Drawing.Color.Green;
    int l3Index = doc.Layers.Add(l3);

    Layer l4 = new Layer();
    l4.Name = "ModGeo";
    l4.Color = System.Drawing.Color.Orange;
    int l4Index = doc.Layers.Add(l4);

    Layer l5 = new Layer();
    l5.Name = "Lines";
    l5.Color = System.Drawing.Color.Red;
    int l5Index = doc.Layers.Add(l5);

    Layer l6 = new Layer();
    l6.Name = "Points";
    l6.Color = System.Drawing.Color.Red;
    int l6Index = doc.Layers.Add(l6);
    
    Layer l7 = new Layer();
    l7.Name = "Outline";
    l7.Color = System.Drawing.Color.Black;
    int l7Index = doc.Layers.Add(l7);
# ---------- end setup_layers ----------
# 5 4 6
# 0.27
# 3
# 0.27
# pass
delete_lines = Button()
pipeline = GeometryPipeline(
    GroupByLayer=False,
    GroupByType=False,
    IncludeHidden=True,
    IncludeLocked=True,
    LayerFilter="Outline",
    NameFilter="*",
    SublayerFiltering=True,
    TypeFilter=4)
# 5 4 6
# 0.27
# "2"
# 0.27
# fail
panel = Panel("Lines")
reset = PythonScript(layer="Points", delete=delete_points)  # -> out; inputs layer: list, delete: Boolean
# ---------- reset: Python ----------
__author__ = "Joseph Oster, IslandCAD.com"
__version__ = "2020.01.30"

import rhinoscriptsyntax as rs
import scriptcontext as sc
from Rhino import RhinoDoc

if (delete):
    try:
        sc.doc = RhinoDoc.ActiveDoc
        for aLayer in layer:
            if rs.IsLayer(aLayer):
                objects = rs.ObjectsByLayer(aLayer, False)
                if (objects and len(objects) > 0):
                    rs.DeleteObjects(objects)
                    print('{0} deleted [{1}]'.format(len(objects), aLayer))
    finally: #restore original Grasshopper document as default
        sc.doc = ghdoc
# ---------- end reset ----------
# This is a Topology Optimization using TopOpt.jl
# 
# last major modified: 14 April 2023
# Notes:
# 
# For 2D problems, 3D model will be made,
# but z-axis constraints will be added to every node.
# 
# Actual separation is not implemented yet.
reset_2 = PythonScript(layer=panel, delete=delete_lines)  # -> out; inputs layer: list, delete: Boolean; same code as reset
ly = Slider(1506, range=0..5000)

# ---- group: Adam's / 1.
# Box Ground Structure
lx = Slider(1778, range=0..5000)
ny = Slider(3, range=0..10)
nx = Slider(5, range=0..30)
nz = Slider(0, range=0..20)

# ----
lz = Slider(1366, range=0..5000)

# ---- group: TopOpt Control / 2.
max_members_length = Slider(34766, range=0..100000)

# ---- group: Supports
# Brep boundary Ground Structure (Advance)
panel_2 = Panel("1500,0,0")
line = LineSDL(Start="100,0,0", Direction=Vector(0, 0, 1), Length=number_slider)
line_2 = LineSDL(Start=panel_2, Direction=Vector(0, 0, 1), Length=number_slider)

# ---- group: TopOpt Control / 6.
# 5. Assign loads in Rhino
max_volume_fraction = Slider(19.99, range=0..200)

# ---- group: TopOpt Control / 3.
create_a_ground_structure = Button()

# ---- group: TopOpt Control / 7.
optimization = Button()

# ---- group: TopOpt Control / 4.
bake_points = Button()

# ----
bake_lines = Button()
# For other configurations, see below...
python = GhPythonScript(L=lx, x=nx)  # -> out, x
# ---------- python: Python ----------
__author__ = "pitipatw"
__version__ = "2023.03.10"

import rhinoscriptsyntax as rs

if x==1 :
    x = 0
else:
    x = L/(x-1)
# ---------- end python ----------

# ---- group: Adam's
python_2 = GhPythonScript(L=ly, x=ny)  # -> out, y
# ---------- python_2: Python ----------
__author__ = "pitipatw"
__version__ = "2023.03.10"

import rhinoscriptsyntax as rs

if x==1 :
    y = 0
else:
    y = L/(x-1)
# ---------- end python_2 ----------
python_3 = GhPythonScript(L=lz, x=nz)  # -> out, z
# ---------- python_3: Python ----------
__author__ = "pitipatw"
__version__ = "2023.03.10"

import rhinoscriptsyntax as rs

if x==1 :
    z = 0
else:
    z = L/(x-1)
# ---------- end python_3 ----------
box = CenterBox(Base=PlaneXY(0, 0, 0), X=expr("x/2", python.x), Y=expr("x/2", python_2.y), Z=expr("x/2", python_3.z))
origin_point = ConstructPoint(XCoordinate=0, YCoordinate=0, ZCoordinate=0)
# To do
# 
# visualize roller support points
# 
# Specified applied load values
# 
# movable points (optional: movable groundstructure)
# 
# color
# 
# Specify domain size
# and the nX,nY,nZ are divisions instead of keep adding
arrbox = BoxArray(Geometry=origin_point, Cell=box, XCount=nx, YCount=ny, ZCount=nz)  # -> Geometry, Transform
duppt = RemoveDuplicatePts(Points=arrbox.Geometry, Tolerance=0.01)

# ---- group: TopOpt Control
list = ValueList({"2D": 2, "3D": 3}, selected="3D")

# ----
number_4 = Slider(0.47, range=0.05..0.95)
number_4_2 = Slider(0.12, range=0.05..0.95)
filter = StreamFilter(Gate=list)  # disabled

# ---- group: Code Selection
# 0 | Materials and Code
# Right-click and recompute if changed
number_slider_2 = Slider(1, range=0..1)
nickname = SelectCode2(Code=number_slider_2)
panel_3 = Panel(nickname)

# ----
long_span_m = Slider(6, range=0..10)
slab_width_m = Slider(0.53, range=0..5)
# 1 | Geometry definition
slab_clear_span_m = Slider(4, range=0..8)

maximum_depth = Slider(0.1, range=0.05..1)
number_4_3 = Slider(0.62, range=0.05..0.95)
number_4_4 = Slider(0.23, range=0.05..0.95)
number_4_5 = Slider(0.37, range=0.05..0.95)
merge = Merge(Data1="1", Data2="1", Data3=number_4_3, Data4=number_4_4, Data5=number_4_4)
merge_2 = Merge(Data1="0", Data2=number_4_5, Data3="0", Data4=number_4, Data5="1")
sbuild = SectionBuilder(WidthMOfSectionB=slab_width_m, DepthMOfSectionH=maximum_depth, VPx=merge, VPy=merge_2)  # -> Pts, Crv, VSect

number_4_6 = Slider(0.14, range=0.05..0.95)
maximum_depth_2 = Slider(0.22, range=0.05..1)
number_4_7 = Slider(0.05, range=0.05..0.95)
number_4_8 = Slider(0.09, range=0.05..0.95)
merge_3 = Merge(Data1="1", Data2="1", Data3=number_4_7, Data4=number_4_8, Data5=number_4_8)
merge_4 = Merge(Data1="0", Data2=number_4_6, Data3="0", Data4=number_4_2, Data5="1")
sbuild_2 = SectionBuilder(WidthMOfSectionB=slab_width_m, DepthMOfSectionH=maximum_depth_2, VPx=merge_3, VPy=merge_4)  # -> Pts, Crv, VSect

pt = ConstructPoint(XCoordinate=lx, YCoordinate=0, ZCoordinate=0)
ln = Line(StartPoint=origin_point, EndPoint=pt)
curvepoint = PointOnCurve(ln, parameter=1)
curvepoint_2 = PointOnCurve(ln, parameter=0)
lineardim = LinearDimension(Line=ln, PointA=curvepoint_2, PointB=curvepoint, Text=lx, Size=Slider(100, range=0..100))

pt_2 = ConstructPoint(XCoordinate=0, YCoordinate=ly, ZCoordinate=0)

merge_5 = Merge(Data1=sbuild.VSect, Data2=sbuild_2.VSect, Data3=sbuild.VSect)
bbuild = BeamBuilder(SpanM=slab_clear_span_m, VSect=merge_5)  # -> ConstructionPlanes, Pts, Crv, BeamBrep, SpanCurve

ln_2 = Line(StartPoint=origin_point, EndPoint=pt_2)

# ---- group: Material Properties
# Right-click and recompute if changed
set_mp = MaterialPropertiesGlobal(
    ConcreteCharacteristicStrengthMPaNMm2="20",
    ConcreteEModulusMPaNMm2=27500,
    ConcreteMaximumStrainMmMm=0.0035,
    ConcreteDensityKgM3=2400,
    ConcreteEmbodiedEnergyCoefficientMJKg="0.147",
    SteelCharacteristicStrengthMPaNMm2="415",
    SteelEModulusMPaNMm2=205000,
    SteelMaximumStrainMmMm=0.004,
    SteelDensityKgM3=8050,
    SteelEmbodiedEnergyCoefficientMJKg="1.32")

# ---- group: effective width constraint / hf (m)
multiplication = Multiplication(A=maximum_depth, B=number_4_5)
multiplication_2 = Multiplication(A=maximum_depth_2, B=number_4_6)
merge_6 = Merge(Data1=multiplication, Data2=multiplication_2)

# ----
lineardim_2 = LinearDimension(Line=ln_2, PointA=origin_point, PointB=pt_2, Text=ly, Size=Slider(100, range=0..100))
time = Time("now")
# Issues
# 
# With nz = 7
# truss parser in the Websocket "doesnt" fail.
# 
# But with nz = 4 ,3 .. it fails
# 
# Unexpect end of file 0
# 
# 
# But run outside of the websocket does not fail too. What!
pipeline_2 = GeometryPipeline(
    GroupByLayer=False,
    GroupByType=False,
    IncludeHidden=True,
    IncludeLocked=True,
    LayerFilter="Lines",
    NameFilter="*",
    SublayerFiltering=True,
    TypeFilter=4)
pipeline_3 = GeometryPipeline(
    GroupByLayer=False,
    GroupByType=False,
    IncludeHidden=True,
    IncludeLocked=True,
    LayerFilter="Points",
    NameFilter="*",
    SublayerFiltering=True,
    TypeFilter=1)
ddate = DeconstructDate(Date=time)  # -> Year, Month, Day, Hour, Minute, Second
lng = ListLength(List=ddate.Month)
line_3 = Line(pipeline_2)

# ---- group: Formwork blocks (to be finished)
crv = Curve(bbuild.Crv)
item = ListItem(List=crv, Index="0", Wrap=True)
curvepoint_3 = PointOnCurve(item, parameter=0.5)
item_2 = ListItem(List=crv, Index="2", Wrap=True)
item_3 = ListItem(List=crv, Index="3", Wrap=True)
xz = XZPlane(Origin=curvepoint_3)
mirror = Mirror(Geometry=item_2, Plane=xz)  # -> Geometry, Transform
mirror_2 = Mirror(Geometry=item_3, Plane=xz)  # -> Geometry, Transform
merge_7 = Merge(Data1=item_3, Data2=item_2, Data3=mirror.Geometry, Data4=mirror_2.Geometry)
curvepoint_4 = PointOnCurve(merge_7, parameter=0.5)
end = EndPoints(Curve=merge_7)  # -> Start, End
pline = PolyLine(Vertices=end.End, Closed=False)
pline_2 = PolyLine(Vertices=curvepoint_4, Closed=False)

# ----
equals = Equality(FirstNumber=lng, SecondNumber=Slider(1, range=0..1))  # -> Equality, Inequality

crv_2 = Curve(bbuild.SpanCurve)
brep = Brep(bbuild.BeamBrep)

concat = Concatenate(FragmentA="0", FragmentB=ddate.Month)
filter_2 = StreamFilter(Gate=equals.Equality, Stream0=ddate.Month, Stream1=concat)
live_load_kn_m = Slider(2, range=0..10)
concat_2 = Concatenate(FragmentB=filter_2, FragmentC=ddate.Year)
multiplication_3 = Multiplication(A=Slider(200, range=0..1000), B=slab_width_m, C="9.8e-03")

# ---- group: FEA Assembly
number_slider_3 = Slider(5, range=0..10)
read_mp = ReadMP()
lew = LoadEnvelopeFromSelfweight(MaterialProperties=read_mp, BeamBRep=brep, SpanCurve=crv_2, NumberOfAnalysisSections=number_slider_3, GraphScale=0.1)  # -> DistributedLoadEnvelopeKNM, SplitCurve, DistributedLoadGraphActual, DistributedLoadGraphAverage, ElementSegments
expression = Expression(D=lew.DistributedLoadEnvelopeKNM, L=multiplication_3, Expression="-1.6*L+1.2*D")
series = Series(Start=0, Step=1, Count=number_slider_3)
end_2 = EndPoints(Curve=crv_2)  # -> Start, End
concat_3 = Concatenate(FragmentA="seg_", FragmentB=series)
Z = UnitZ(Factor=expression)
supp = SupportKaramba3D(PosInd=end_2.Start, menu=[buttons(on, on, on, on, off, on)])
supp_2 = SupportKaramba3D(PosInd=end_2.End, menu=[buttons(off, off, on, off, off, off)])
loads = LoadsKaramba3D(Vector=graft(Z), BeamIdentifiers=graft(concat_3), mode="Uniform Line", menu=[buttons(on, off, off)])  # -> flatten(Load)
linetobeam = LineToBeamKaramba3D(Line=lew.SplitCurve, Identifier=concat_3, New=True, Remove=True, LimitDistance_m=0.005)  # -> Element, Points, Info

# ----
panel_4 = Panel(concat_2)

# ---- group: FEW Analysis
assemble = AssembleModelKaramba3D(Elem=linetobeam.Element, Support=[supp_2, supp], Load=loads, LimitDistance_m=0.005)  # -> Model, Info, Mass_kg, CenterOfGravity
# 2 | Load envelope
analyze = AnalyzeKaramba3D(Model=assemble.Model)  # -> CalculatedModel, MaximumDisplacement_cm, ResultingForceOfGravity_kN, ElasticEnergy_kNm
modelview = ModelViewKaramba3D(Model=analyze.CalculatedModel, ResultFactors=1, ResultCase=-1)  # -> Model, DeformedMesh, DeformedAxes, DeformedModel
beamview = BeamViewKaramba3D(Model=modelview.Model)  # -> Model, MeshesOfRenderedBeams, DeformedBeamAxes, LegendColors, LegendTags

# ---- group: FEA Results
b_forces = BeamForcesKaramba3D(AnalyzedModel=beamview.Model, LCase=-1, MaximumDistanceBetweenResults_m=-1, NumberOfResultsPerBeamElement=2)  # -> AnalyzedModel, NormalForce_kN, ShearForceVz_kN, ShearForceVy_kN, BendingMomentMt_kNm, BendingMomentMy_kNm, BendingMomentMz_kNm
dispatch = Dispatch(List=beamview.DeformedBeamAxes, DispatchPattern=[True, False])  # -> ListA, ListB
bnd = Bounds(Numbers=flatten(b_forces.ShearForceVz_kN))
bnd_2 = Bounds(Numbers=flatten(b_forces.BendingMomentMy_kNm))
join = JoinCurves(Curves=dispatch.ListA, Preserve=False)
join_2 = JoinCurves(Curves=dispatch.ListB, Preserve=False)
lecrv = LoadEnvelopeFromCurves(
    ShearCurve=join,
    MomentCurve=join_2,
    ShearDomain=bnd,
    MomentDomain=bnd_2,
    SpanCurve=crv_2,
    NumberOfAnalysisSections=Slider(5, range=0..100))  # -> ShearEnvelopeKN, MomentEnvelopeKNM, ShearAndMomentGraphs

# ----
panel_5 = Panel("""0
0""")
y_kn = Panel("""0
0
0
0
0
0
0
0
0
0
0
0
0
0
0
0
0
0
0
0""")
panel_6 = Panel("""-4.4
0""")
merge_8 = Merge(Data1=graft(panel_5), Data2=graft(panel_6), Data3=graft(panel_5))  # -> simplify(Result)
get_default_points = CSharpScript(y=nz)  # -> out, points; inputs y: Int32; disabled
# ---------- get_default_points: C# ----------
    if (y== 1)
    {
      String layer = "Default";
      Int32 layer_index = doc.Layers.Find(layer, true);

      //if ((layer_index < 0));
      //return;

      Rhino.DocObjects.Layer lay = doc.Layers[layer_index];
      Rhino.DocObjects.RhinoObject[] objs = doc.Objects.FindByLayer(lay);
      //if (objs == null);
      //return ;
      List<Point3d> geo = new List<Point3d>();

      foreach (Rhino.DocObjects.RhinoObject obj in objs){
        GH_Point p = new GH_Point();
        p.CastFrom(obj.Geometry);
        geo.Add(p.Value);
      }
      points = geo;
    }
# ---------- end get_default_points ----------
panel_7 = Panel(merge_8)

crv_3 = Curve(bbuild.SpanCurve)
brep_2 = Brep(bbuild.BeamBrep)

expression_2 = Expression(d=Slider(12, range=0..100), Expression="pi*(d/2)^2")
expression_3 = Expression(A=expression_2, Expression="2*sqrt(A/pi)")
panel_8 = Panel(expression_3)

larger = LargerThan(SecondNumber=0)  # -> LargerThan, OrEqualTo

# ---- group: Vu, Mu
num = Number(lecrv.ShearEnvelopeKN)
num_2 = Number(lecrv.MomentEnvelopeKNM)

# ---- group: Rebar Area
number_0 = Slider(0.011, range=0.001..1)
remap = RemapNumbers(Value=number_0, Source=Domain(0, 1), Target="0 to 10000")  # -> Mapped, Clipped
as_mm2 = Panel(remap.Mapped)

# ----
division = Division(B=Slider(45, range=10..100))
cull = CullPattern(List=division, CullPattern=larger.LargerThan)
number_slider_4 = Slider(0.05, range=0..0.1)
multiplication_4 = Multiplication(A=cull, B=5)
panel_9 = Panel(num_2)
align = AlignPlanes()

# ----
# 3 | Analysis & Optimization
read_mp_2 = ReadMP()

number_8 = Slider(35, range=15..200)
bs = BeamSections(
    MaterialProperties=read_mp_2,
    MomentEnvelopeKNM=num_2,
    BeamBRep=brep_2,
    SpanCurve=crv_3,
    ClearCoverMm=number_8,
    AreaOfSteelMm2=remap.Mapped,
    ConstantAreaOfSteel=Toggle(True))  # -> ConcreteSections, SteelReinforcementSections

crv_4 = Curve(join_2)
domain = Domain(bnd)
domain_2 = Domain(bnd_2)
brep_3 = Brep(bbuild.BeamBrep)
crv_5 = Curve(join)
crv_6 = Curve(bbuild.SpanCurve)
num_3 = Number(remap.Mapped)
num_4 = Number(number_8)

yz = YZPlane(Origin=Point(0, 0, 0))
offset = OffsetCurve(Curve=bs.SteelReinforcementSections, Distance=Slider(0.015, range=0..0.1), Plane=yz, Corners=1)
ccx = CurveCurve(CurveA=graft(bs.ConcreteSections), CurveB=offset)  # -> flatten(Points), ParamsA, ParamsB
_10º = PowerOf10(Value=Slider(1, range=1..5))
lng_2 = ListLength(List=ccx.Points)
multiplication_5 = Multiplication(A=lng_2, B=_10º)
sqr = Square(Value=lng_2)
neg = Negative(Value=sqr)

# ---- group: Deflection calcs
division_2 = Division(A=slab_clear_span_m, B=Slider(360, range=0..1000))
deflection_limit_m = Panel(division_2)

read_mp_3 = ReadMP()
lecrv_2 = LoadEnvelopeFromCurves(
    ShearCurve=crv_5,
    MomentCurve=crv_4,
    ShearDomain=domain,
    MomentDomain=domain_2,
    SpanCurve=crv_6,
    NumberOfAnalysisSections=Slider(31, range=0..100))  # -> ShearEnvelopeKN, MomentEnvelopeKNM, ShearAndMomentGraphs
bs_2 = BeamSections(
    MaterialProperties=read_mp_3,
    MomentEnvelopeKNM=lecrv_2.MomentEnvelopeKNM,
    BeamBRep=brep_3,
    SpanCurve=crv_6,
    ClearCoverMm=num_4,
    AreaOfSteelMm2=num_3,
    ConstantAreaOfSteel=False)  # -> ConcreteSections, SteelReinforcementSections
fa = FlexuralAnalysis(
    MaterialProperties=read_mp_3,
    MomentEnvelopeKNM=lecrv_2.MomentEnvelopeKNM,
    ConcreteSection=bs_2.ConcreteSections,
    SteelSection=bs_2.SteelReinforcementSections,
    SectionSubdivisions=15)  # -> MomentCapacityKNM, CompressionArea
mcr = CrackingMoment(MaterialProperties=read_mp_3, ConcreteSection=bs_2.ConcreteSections, SteelSection=bs_2.SteelReinforcementSections)
icr = CrackedMomentOfInertia(MaterialProperties=read_mp_3, ConcreteCompressionArea=fa.CompressionArea, SteelSection=bs_2.SteelReinforcementSections)
iu = GrossMomentOfInertia(MaterialProperties=read_mp_3, ConcreteSection=bs_2.ConcreteSections, SteelSection=bs_2.SteelReinforcementSections)
ieff = EffectiveMomentOfInertia(
    MomentEnvelopeKNM=lecrv_2.MomentEnvelopeKNM,
    CrackingMomentKNM=mcr,
    GrossMomentOfInertiaM⁴=iu,
    CrackedMomentOfInertiaM⁴=icr)
defss = DisplacementOfSimplySupportedBeam(
    MaterialProperties=read_mp_3,
    MomentEnvelopeKNM=lecrv_2.MomentEnvelopeKNM,
    EffectiveMomentOfInertiaM⁴=ieff,
    SpanCurve=crv_6)  # -> Rotation, DeflectionM
item_4 = ListItem(List=defss.DeflectionM, Index=0, Wrap=True)  # -> Item1, Item
graph = QuickGraph(defss.DeflectionM, SortOrder=0)
graph_2 = QuickGraph(defss.Rotation, SortOrder=0)
panel_10 = Panel(item_4.Item1)
neg_2 = Negative(Value=item_4.Item1)
expression_4 = Expression(dlim=division_2, dmax=neg_2, Expression="100*(dlim-dmax)/dlim")
deflection_constraint = Panel(expression_4)

# ----
pipeline_4 = GeometryPipeline(
    GroupByLayer=False,
    GroupByType=False,
    IncludeHidden=True,
    IncludeLocked=True,
    LayerFilter="Outline",
    NameFilter="*",
    SublayerFiltering=True,
    TypeFilter=4)

fa_2 = FlexuralAnalysis(
    MaterialProperties=read_mp_2,
    MomentEnvelopeKNM=num_2,
    ConcreteSection=bs.ConcreteSections,
    SteelSection=bs.SteelReinforcementSections,
    SectionSubdivisions=15)  # -> MomentCapacityKNM, CompressionArea
da = DuctilityAnalysis(
    MaterialProperties=read_mp_2,
    ConcreteSection=bs.ConcreteSections,
    SteelSection=bs.SteelReinforcementSections,
    ClearCoverMm=30,
    SectionSubdivisions=15)  # -> ReinforcementRatio, BwCrv, DistanceToTensileReinforcementM, MaxReinforcementRatio, MinReinforcementRatio
sa = ShearAnalysis(
    MaterialProperties=read_mp_2,
    MomentEnvelopeKNM=num_2,
    ShearEnvelopeKN=num,
    DesignShearReinforcementKN=0,
    ConcreteSection=bs.ConcreteSections,
    SteelSection=bs.SteelReinforcementSections,
    ClearCoverMm=30,
    SectionSubdivisions=15)  # -> ShearCapacityKN, BwCrv

# ---- group: effective width constraint
len = Length(Curve=sa.BwCrv)
expression_5 = Expression(hf=merge_6, bw=len, b=slab_width_m, Expression="100*((16*hf + bw)-b)/b")
panel_11 = Panel(merge_6)
expression_6 = Expression(hf=merge_6, lim=Slider(0.03, range=0..0.1), Expression="100*(hf-lim)/lim")

# ----
cross_section = CrossSectionKaramba3D(FamilyNameOfCrossSection="DefaultCroSec", Diameter_cm=11.43, WallThickness_cm=0.4, mode="Circular Hollow")
matprops = MaterialPropertiesKaramba3D(
    FamilyOfMaterial="Steel",
    Name="S235",
    YoungsModulus_kN_cm2=21000,
    InPlaneShearModulus_kN_cm2=8076,
    TransverseShearModulus_kN_cm2=8076,
    SpecificWeight_kN_m3=78.5,
    CoefficientOfThermalExpansion_1_C=1.2e-05,
    TensileStrength_kN_cm2=23.5,
    CompressiveStrength_kN_cm2=-23.5,
    StrengthHypothesis="MISES",
    mode="Isotrop")
Y = UnitY(Factor=expr("4*x", ly))
abs = Absolute(Value=num_2)
abs_2 = Absolute(Value=fa_2.MomentCapacityKNM)
abs_3 = Absolute(Value=num)
abs_4 = Absolute(Value=sa.ShearCapacityKN)

expression_7 = Expression(rho=da.ReinforcementRatio, rho_max=da.MaxReinforcementRatio, Expression="100*(rho_max-rho)/rho_max")
expression_8 = Expression(rho=da.ReinforcementRatio, rho_min=da.MinReinforcementRatio, Expression="100*(rho-rho_min)/rho_min")
expression_9 = Expression(Mu=abs, Mn=abs_2, Expression="100*(Mn-Mu)/Mn")
expression_10 = Expression(Vu=abs_3, Vn=abs_4, Expression="100*(Vn-Vu)/Vn")

Z_2 = UnitZ(Factor="-10")
material = MaterialKaramba3D(matprops)

# ---- group: Constraints
num_5 = Number(flatten([expression_9, expression_10, neg, expression_7, expression_8, expression_5, expression_6, expression_4]))

# ----
smaller = SmallerThan(FirstNumber=num_5, SecondNumber=0)  # -> SmallerThan, OrEqualTo
ma = MassAddition(Input=smaller.SmallerThan)  # -> Result, PartialResults
panel_12 = Panel(ma.Result)

# ---- group: Variables
num_6 = Number([number_0, number_8, slab_width_m, maximum_depth, number_4_3, number_4_4, number_4_5, number_4, maximum_depth_2, number_4_7, number_4_8, number_4_6, number_4_2])

# ----
panel_13 = Panel(num_5)
panel_14 = Panel("3")
llinter = LineLineIntersectionKaramba3D(LimitDistance_m=0.005)  # -> IntersectionPoints, flatten(LineSubSegements)
duppt_2 = RemoveDuplicatePts(Points=llinter.IntersectionPoints, Tolerance=0.01)
pdecon = Deconstruct(Point=duppt_2)  # -> XComponent, YComponent, ZComponent
dupln = RemoveDuplicateLines(Lines=llinter.LineSubSegements, Tolerance=0.01)

sort = SortList(Keys=pdecon.XComponent, ValuesA=pdecon.XComponent)  # -> Keys, ValuesA
sort_2 = SortList(Keys=pdecon.ZComponent, ValuesA=pdecon.XComponent)  # -> Keys, ValuesA
item_5 = ListItem(List=sort.ValuesA, Index=0, Wrap=True)
item_6 = ListItem(List=sort_2.Keys, Index=0, Wrap=True)
equals_2 = Equality(FirstNumber=item_5, SecondNumber=pdecon.XComponent)  # -> Equality, Inequality
equals_3 = Equality(FirstNumber=item_6, SecondNumber=pdecon.ZComponent)  # -> Equality, Inequality
and = GateAnd(A=equals_2.Equality, B=equals_3.Equality)
cull_2 = CullPattern(List=duppt_2, CullPattern=and)

python_4 = GhPythonScript(np=nx)  # -> out, output
# ---------- python_4: Python ----------
__author__ = "pitipatw"
__version__ = "2023.07.16"

import rhinoscriptsyntax as rs

output = []
if np%2 == 0:
    output.append(np/2)
    output.append(np/2+1)
else:
    output.append((np+1)/2)
# ---------- end python_4 ----------
subtraction = Subtraction(A=python_4.output, B="1")
multiplication_6 = Multiplication(A=subtraction, B=python.x)
addition = Addition(A=multiplication_6, B=item_5)

sort_3 = SortList(Keys=pdecon.XComponent, ValuesA=pdecon.XComponent)  # -> Keys, ValuesA
sort_4 = SortList(Keys=pdecon.ZComponent, ValuesA=pdecon.XComponent)  # -> Keys, ValuesA
item_7 = ListItem(List=reverse(sort_3.ValuesA), Index=0, Wrap=True)
item_8 = ListItem(List=sort_4.Keys, Index=0, Wrap=True)
equals_4 = Equality(FirstNumber=item_8, SecondNumber=pdecon.ZComponent)  # -> Equality, Inequality
equals_5 = Equality(FirstNumber=item_7, SecondNumber=pdecon.XComponent)  # -> Equality, Inequality
and_2 = GateAnd(A=equals_5.Equality, B=equals_4.Equality)
cull_3 = CullPattern(List=duppt_2, CullPattern=and_2)

sort_5 = SortList(Keys=pdecon.ZComponent, ValuesA=pdecon.XComponent)  # -> Keys, ValuesA

resultant_mass_kg = Panel("6418.128969")
resultant_ec = Panel("994.759039")

item_9 = ListItem(List=reverse(sort_5.Keys), Index=0, Wrap=True)
ft_mpa = Slider(412, range=28..928)
fc_mpa = Slider(31, range=28..56)
number_slider_5 = Slider(20, range=0..20)

vol_steel_m3 = Panel("-0.005432")
vol_concrete_m3 = Panel("-2.656")

item_10 = ListItem(List=addition, Index=0, Wrap=True)  # -> Item, Item1
item_11 = ListItem(List=addition, Index=0, Wrap=True)  # -> Item, Item1
equalst = EqualityWithinTolerance(FirstNumber=item_9, SecondNumber=pdecon.ZComponent, Tolerance=number_slider_5)  # -> Equality, Inequality
or = GateOr(A=and, B=and_2)
matselect = MaterialSelectionKaramba3D(menu=[dropdown(7), dropdown(5)])
equalst_2 = EqualityWithinTolerance(FirstNumber=item_10.Item, SecondNumber=pdecon.XComponent, Tolerance=number_slider_5)  # -> Equality, Inequality
equalst_3 = EqualityWithinTolerance(FirstNumber=item_11.Item1, SecondNumber=pdecon.XComponent, Tolerance=number_slider_5)  # -> Equality, Inequality
division_3 = Division(A="5200000", B=Slider(2, range=0..10))
division_4 = Division(A=fc_mpa, B=10)
division_5 = Division(A=ft_mpa, B=10)
not = GateNot(A=or)
and_3 = GateAnd(A=equalst_2.Equality, B=equalst.Equality)
and_4 = GateAnd(A=equalst_3.Equality, B=equalst.Equality)
panel_15 = Panel(matselect)
supp_3 = SupportKaramba3D(PosInd=cull_3, menu=[buttons(off, on, on, off, off, off)])
supp_4 = SupportKaramba3D(PosInd=cull_2, menu=[buttons(on, on, on, off, off, off)])
linetobeam_2 = LineToBeamKaramba3D(
    Line=dupln,
    New=True,
    Remove=True,
    LimitDistance_m=0.005,
    Bending=True,
    SetBucklingLength=True,
    ToPolylineMaxAngle=0.03,
    ToPolylineTolerance=0.01,
    ToPolylineMaxEdgeLength=0.25)  # -> Element, Points, Info
cull_4 = CullPattern(List=duppt_2, CullPattern=and_3)
panel_16 = Panel("""3
5
6
8""")
matprops_2 = MaterialPropertiesKaramba3D(
    FamilyOfMaterial="Vectran",
    Name=panel_16,
    YoungsModulus_kN_cm2="5200000",
    InPlaneShearModulus_kN_cm2=division_3,
    TransverseShearModulus_kN_cm2=division_3,
    SpecificWeight_kN_m3=78.5,
    CoefficientOfThermalExpansion_1_C=1.2e-05,
    TensileStrength_kN_cm2=division_5,
    CompressiveStrength_kN_cm2=expr("-x", division_4),
    StrengthHypothesis="MISES",
    mode="Isotrop")
cull_5 = CullPattern(List=duppt_2, CullPattern=not)
supp_5 = SupportKaramba3D(PosInd=cull_5, menu=[buttons(off, on, off, off, off, off)])
cull_6 = CullPattern(List=duppt_2, CullPattern=and_4)
panel_17 = Panel("""1/8
3/16
1/4
5/16""")
Z_3 = UnitZ(Factor=expr("-x", Slider(2, range=0..100)))
panel_18 = Panel("5")
merge_9 = Merge(Data1=supp_4, Data2=supp_3, Data3=supp_5)
item_12 = ListItem(List=matprops_2, Index=Slider(2, range=0..4), Wrap=True)
division_6 = Division(A=panel_16, B=Slider(2, range=0..10))
merge_10 = Merge(Data1=cull_4, Data2=cull_6)
loads_2 = LoadsKaramba3D(ForceVector=Z_3, Local=False, PosInd=merge_10, LCase="0", mode="Point")
support = SupportKaramba3D(merge_9)
panel_19 = Panel("concrete")
cross_section_2 = CrossSectionKaramba3D(
    FamilyNameOfCrossSection="Vectran",
    NameOfCrossSection=panel_17,
    Diameter_cm=panel_16,
    WallThickness_cm=division_6,
    mode="Circular Hollow")
cross_section_3 = CrossSectionKaramba3D(
    FamilyNameOfCrossSection="Vectran",
    NameOfCrossSection=panel_17,
    Diameter_cm=panel_16,
    WallThickness_cm=division_6,
    mode="Circular Hollow")
item_13 = ListItem(List=panel_17, Index=Slider(3, range=0..3), Wrap=True)
panel_20 = Panel(equalst_2.Equality)
panel_21 = Panel(cross_section_2)
crosecselect = CrossSectionSelectorKaramba3D(CrossSections=cross_section_2, NameOrListIndexOfCrossSection=item_13)  # -> CrossSection, Info
assemble_2 = AssembleModelKaramba3D(
    Point=duppt_2,
    Elem=linetobeam_2.Element,
    Support=support,
    Load=loads_2,
    CrossSection=crosecselect.CrossSection,
    Material=item_12,
    LimitDistance_m=0.005)  # -> Model, Info, Mass_kg, CenterOfGravity, LoadCaseNames
analyze_2 = AnalyzeKaramba3D(Model=assemble_2.Model)  # -> CalculatedModel, MaximumDisplacement_cm, ResultingForceOfGravity_kN, ElasticEnergyChange_kNm
modelview_2 = ModelViewKaramba3D(Model=analyze_2.CalculatedModel, ResultFactors=1, ResultCase=-1)  # -> Model, DeformedMesh, DeformedAxes, DeformedModel
panel_22 = Panel(crosecselect.CrossSection)
nodedisp = NodalDisplacementsKaramba3D(AnalyzedModel=modelview_2.Model, PositionsIndexes=merge_10)  # -> AnalyzedModel, NodalTranslations_m, NodalRotations_rad
# 2.300/480 = 0.00479 m
panel_23 = Panel(nodedisp.NodalTranslations_m)
pipeline_5 = GeometryPipeline(
    GroupByLayer=False,
    GroupByType=False,
    IncludeHidden=True,
    IncludeLocked=True,
    LayerFilter="Holes",
    NameFilter="*",
    SublayerFiltering=True,
    TypeFilter=4)
pipeline_6 = GeometryPipeline(
    GroupByLayer=False,
    GroupByType=False,
    IncludeHidden=True,
    IncludeLocked=True,
    LayerFilter="Restricted bars",
    NameFilter="*",
    SublayerFiltering=True,
    TypeFilter=4)
bcx = BrepCurve()  # -> Curves, Points

ny_2 = Slider(5, range=0..20)
outline = Brep(pipeline)
nx_2 = Slider(13, range=0..30)
nz_2 = Slider(1, range=0..20)
volume = Volume(Geometry=outline)  # -> Volume, Centroid

area = Area(Geometry=outline)  # -> Area, Centroid

scale = Scale(Geometry=outline, Center=area.Centroid, Factor=Slider(1, range=0..10))  # -> Geometry, Transform
bbox = BoundingBox(Content=scale.Geometry, Plane=PlaneXY(0, 0, 0))  # -> Box, Box_2
debox = DeconstructBox(Box=bbox.Box)  # -> Plane, X, Y, Z
dedomain = DeconstructDomain(Domain=debox.X)  # -> Start, End
dedomain_2 = DeconstructDomain(Domain=debox.Z)  # -> Start, End
dedomain_3 = DeconstructDomain(Domain=debox.Y)  # -> Start, End
subtraction_2 = Subtraction(A=dedomain_3.End, B=dedomain_3.Start)
subtraction_3 = Subtraction(A=dedomain_2.End, B=dedomain_2.Start)
subtraction_4 = Subtraction(A=dedomain.End, B=dedomain.Start)

python_5 = GhPythonScript(L=subtraction_4, x=nx_2)  # -> out, z; same code as python_3
python_6 = GhPythonScript(L=subtraction_2, x=ny_2)  # -> out, z; same code as python_3
python_7 = GhPythonScript(L=subtraction_3, x=nz_2)  # -> out, z; same code as python_3
Z_4 = UnitZ(Factor=expr("2*x", subtraction_3))
Z_5 = UnitZ(Factor=expr("4*x", subtraction_3))
X = UnitX(Factor=subtraction_4)
move = Move(Geometry=pipeline_4, Motion=Z_4)  # -> Geometry, Transform

series_2 = Series(Start=dedomain.Start, Step=python_5.z, Count=nx_2)
series_3 = Series(Start=dedomain_3.Start, Step=python_6.z, Count=ny_2)
series_4 = Series(Start=dedomain_2.Start, Step=python_7.z, Count=nz_2)
python_8 = GhPythonScript(x=series_2, y=series_3, z=series_4)  # -> out, a, pts; inputs x: list, y: list, z: list
# ---------- python_8: Python ----------
__author__ = "pitipatw"
__version__ = "2023.04.13"

import rhinoscriptsyntax as rs


nx = len(x)
ny = len(y)
nz = len(z)

np = nx*ny*nz
points = [[[0] * nx] * ny ] * nz
pts = []
for i in range(nx):
    for j in range(ny):
        for k in range(nz):
            #print(x[i],y[j],z[k])
            #pts = rs.AddPoint(x[i], y[j], z[k])
            pts.append(rs.CreatePoint(x[i], y[j], z[k]))
# ---------- end python_8 ----------
pt_3 = Point(python_8.pts)
brepinc = PointInBrep(Brep=scale.Geometry, Point=pt_3, Strict=False)

incurve = PointInCurve(Point=pt_3, Curve=pipeline)  # -> Relationship, Point

cull_7 = CullPattern(List=pt_3, CullPattern=incurve.Relationship)

pt_4 = Point(cull_7)
pt_5 = Point(pt_4)
bake = GhPythonScript(geo=pt_5, layer="Points", active=bake_points)  # -> out
# ---------- bake: Python ----------
__author__ = "Joseph Oster, IslandCAD.com"
__version__ = "2020.01.30"

import rhinoscriptsyntax as rs
import scriptcontext
import Rhino
import System


def bakeGeo(geometry, attributes, layer):
    if geometry:
        if layer is None: layer = 'Default'
        if not rs.IsLayer(layer): rs.AddLayer(layer)

        attributes.MaterialSource = Rhino.DocObjects.ObjectMaterialSource.MaterialFromParent

        # add both the geometry and the attributes to the Rhino doc
        rhino_id = scriptcontext.doc.Objects.Add(geometry, attributes)
        rs.ObjectLayer(rhino_id, layer)
        #print rhino_id
        return rhino_id
        
        

if active: #change the scriptcontext
    scriptcontext.doc = Rhino.RhinoDoc.ActiveDoc
    try:
        if type(geo) is System.Guid:
            g = ghdoc.Objects.Find(geo)
            if g and hasattr(g, 'Geometry'):
                bakeGeo(g.Geometry, g.Attributes, layer)
        else: raise ValueError('Missing or Invalid geometry.')
    finally: #restore original Grasshopper document as default
        scriptcontext.doc = ghdoc
# ---------- end bake ----------
pdecon_2 = Deconstruct(Point=pt_5)  # -> XComponent, YComponent, ZComponent
sort_6 = SortList(Keys=pdecon_2.ZComponent, ValuesA=pdecon_2.ZComponent)  # -> Keys, ValuesA
item_14 = ListItem(List=reverse(sort_6.ValuesA), Index=0, Wrap=True)
similar = Similarity(FirstNumber=item_14, SecondNumber=pdecon_2.ZComponent, Threshold=0.1)  # -> Similarity, AbsoluteDifference
panel_24 = Panel(item_14)
cull_8 = CullPattern(List=pt_5, CullPattern=similar.Similarity)

# ---- group: Ground Structure
line_4 = Line(line_3)

# ----
fsim = FindSimilarMember(Data=line_4, Set=pipeline_6)  # -> Hit, Index
index = ItemIndex(List=line_4, Item=pipeline_6)

pipeline_7 = GeometryPipeline(
    GroupByLayer=False,
    GroupByType=False,
    IncludeHidden=True,
    IncludeLocked=True,
    LayerFilter="Load points",
    NameFilter="*",
    SublayerFiltering=True,
    TypeFilter=1)
pipeline_8 = GeometryPipeline(
    GroupByLayer=False,
    GroupByType=False,
    IncludeHidden=True,
    IncludeLocked=True,
    LayerFilter="Supports (pin)",
    NameFilter="*",
    SublayerFiltering=True,
    TypeFilter=1)
pipeline_9 = GeometryPipeline(
    GroupByLayer=False,
    GroupByType=False,
    IncludeHidden=True,
    IncludeLocked=True,
    LayerFilter="Supports (roller)",
    NameFilter="*",
    SublayerFiltering=True,
    TypeFilter=1)

merge_11 = Merge(Data1=pipeline_3, Data2=pipeline_7, Data3=pipeline_8, Data4=pipeline_9)
duppt_3 = RemoveDuplicatePts(Points=merge_11, Tolerance=0.01)
pt2num = PointsToNumbers(Points=graft(duppt_3), Mask=4)  # -> simplify(Numbers)

# ---- group: Ground Structure (continued)
pt_6 = Point(duppt_3)

# ----
panel_25 = Panel(pt2num)

# ---- group: Preprocessing (Adam)
supoprt_points = ListItem(List=pt_6, Index=0, Wrap=True)  # -> Item, Item1, Item2
create = CreateNetwork(
    Edges=flatten(line_4),
    Anchors=[supoprt_points.Item, supoprt_points.Item1, supoprt_points.Item2],
    ForceDensities=1,
    IntersectionTolerance=Slider(0.02, range=0..0.1))
info = NetworkInformation(FDMNetwork=create)  # -> Nodes, Edges, EdgeLengths, StartIndex, EndIndex, Anchors, ForceDensities, NumberEdges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

# ----
support_roller_inds = MemberIndex(Set=info.Nodes, Member=pipeline_9)  # -> simplify(flatten(Index)), Count
support_pin_inds = MemberIndex(Set=info.Nodes, Member=pipeline_8)  # -> simplify(flatten(Index)), Count
support_pin_inds_2 = MemberIndex(Set=info.Nodes, Member=pipeline_7)  # -> simplify(flatten(Index)), Count

lng_3 = ListLength(List=support_pin_inds_2.Index)
concat_4 = Concatenate(FragmentA="Please input ", FragmentB=lng_3, FragmentC=" load values as [x, y, z] kN")
panel_26 = Panel(concat_4)

roller_supports_inds = Number(support_roller_inds.Index)
supports_inds = Number(support_pin_inds.Index)
load_inds = Number(support_pin_inds_2.Index)

pt2num_2 = PointsToNumbers(Points=graft(info.Nodes), Mask=4)  # -> simplify(Numbers)
item_15 = ListItem(List=info.Nodes, Index=info.EndIndex, Wrap=True)
item_16 = ListItem(List=info.Nodes, Index=info.StartIndex, Wrap=True)
vec2pt = Vector2Pt(PointA=item_16, PointB=item_15, Unitize=False)  # -> Vector, Length
panel_27 = Panel(pt2num_2)

# ----
# Python
topopt_python = GhPythonScript(
    elements_i=info.StartIndex,
    elements_j=info.EndIndex,
    points=pt2num_2,
    supports_pin=supports_inds,
    supports_roller_x=roller_supports_inds,
    load_points=load_inds,
    load_values=merge_8,
    z=nz_2,
    maxVf=max_volume_fraction,
    date=concat_2,
    ndim=list)  # -> out; inputs elements_i: list, elements_j: list, points: tree, supports_pin: list, supports_roller_x: list, load_points: list, load_values: tree
# ---------- topopt_python: Python ----------
__author__ = "pitipatw"
__version__ = "2023.03.10"

import rhinoscriptsyntax as rs
import ghpythonlib.treehelpers as th
import json

# assign static values
output = dict() 
output["date"] = date
output["model_name"] = "Example_1"
output["unit"] = "meter"
output["generate_time"] = "10PM"

output["model_type"] = "truss"

output["_info"] = "Example1"
output["TO_model_type"] = "ground_mesh"
# Processing Inputs
tree = th.tree_to_list(points, retrieve_base = None)

#input materials detail
materials = dict()
materials = [{"G12": 1.0,
            "E": 1.0,
            "name": "DummyMaterial",
            "family": "DummyMaterial",
            "density": 78.5,
            "elem_tags": [],
            "E_unit": "kN/m2",
            "type_name": "ISO",
            "fy": 235000.0,
            "mu": 0.3,
            "density_unit": "kN/m3",
            "fy_unit": "kN/m2",
            "G12_unit": "kN/m2"}]
output["materials"] = materials

#make a default of 2 but then able to put in 3
output["dimension"] = ndim


cross_secs = dict() 
cross_secs["A"] = 3230 
cross_secs["name"] = ""
cross_secs["family"] = "DummyCroSecByPitipat"
cross_secs["elem_tags"] = []
cross_secs["A_unit"] = "m2" 
cross_secs["Iy"]= 2.1106547193827362e-06
cross_secs["Iz"]= 2.1106547193827362e-06
cross_secs["Jx"]= 4.2213094387654724e-06
cross_secs["name"]= "ex1"
output["cross_secs"] = [cross_secs]


nodes = dict()
nodes_list = list()
for i in range(len(tree)):
    dummy = dict()
    dummy["node_ind"] = i
    dummy["point"] = tree[i][0:3]
    dummy["is_grounded"] = False
    nodes_list.append(dummy)

output["nodes"] = nodes_list
elements_list = list() 
for i in range(len(elements_i)) : 
    dummy = dict() 
    dummy["elem_ind"] = i
    dummy["end_node_inds"] = [ elements_i[i], elements_j[i]]
    dummy["elem_tag"] = ""
    dummy["bending_stiff"] = False
    elements_list.append(dummy)

supports_list = list()

check = True
for i in supports_pin:
    dummy = dict()
    dummy["node_ind"] = int(i)
    dummy["condition"] = [1,1,1,0,0,0] # pin x y z
    supports_list.append(dummy)
        
for i in supports_roller_x :
    dummy = dict()
    dummy["node_ind"] = int(i)
    dummy["condition"] = [0,1,1,0,0,0] #
    supports_list.append(dummy)
    

if z == 1: #indicate 2d
    for i in range(len(tree)): 
        if i not in supports_roller_x:
            if i not in supports_pin:
                dummy = dict()
                dummy["node_ind"] = int(i)
                dummy["condition"] = [0,0,1,0,0,0] # pin z on everything
                supports_list.append(dummy)
else:
    for i in range(len(tree)): 
        if i not in supports_roller_x:
            if i not in supports_pin:
                dummy = dict()
                dummy["node_ind"] = int(i)
                # release everything on 3D
                # pin z on 2D
                dummy["condition"] = [0,0,0,0,0,0] 
                supports_list.append(dummy)

output["supports"] = supports_list



output["joints"] = []

load_value_list = th.tree_to_list(load_values, retrieve_base = None)

loadcases_dict = dict()
#this is load case "0"
loadcases_0 = dict()
loadcases_0["lc_ind"] = 0
ploads = dict()
load_list = list()
for i in range(len(load_points)) :
    dummy = dict()
    dummy["node_ind"] = load_points[i]
    if i > (len(load_value_list)-1) : 
        x = 0.0
        y = 0.0 
        #z = -1.0 #for 3d
    else:
#        continue
        [x,y,z] = load_value_list[i]
    dummy["force"]  = [ float(x),float(y),float(z)]
    dummy["moment"] = [0.0, 0.0, 0.0] #No moment for now
    dummy["loadcase"] = str(i)
    dummy["force_unit"] = "kN"
    load_list.append(dummy)
    
    
loadcases_0["ploads"] = load_list
loadcases_0["eloads"] = []
loadcases_0["gravity"] = ""
loadcases_dict["0"] = loadcases_0

output["loadcases"] = loadcases_dict


output["elements"] = elements_list

#====Node and Element numbers are here!====
output["node_num"] = len(tree)
output["element_num"] = len(elements_list) 
#====

output["maxVf"] = maxVf
output["stage"] = "Opt"
print(json.dumps(output))
# ---------- end topopt_python ----------
get_groundstructure = GhPythonScript(points=pt2num, Lmax=max_members_length, date=concat_2)  # -> out; inputs points: tree
# ---------- get_groundstructure: Python ----------
__author__ = "pitipatw"
__version__ = "2023.03.10"

import rhinoscriptsyntax as rs
import ghpythonlib.treehelpers as th
import json

# assign static values
output = dict() 
output["model_name"] = "Example_1"
output["unit"] = "meter"
output["generate_time"] = "10PM"

output["model_type"] = "truss"

output["_info"] = "Example1"
output["TO_model_type"] = "ground_mesh"

# Processing Inputs
tree = th.tree_to_list(points, retrieve_base = None)


nodes = dict()
nodes_list = dict()
for i in range(len(tree)):
    nodes_list[i] = tree[i][0:3]

output["nodes"] = nodes_list
output["Lmax"] = Lmax
output["date"] = date
output["stage"] = "GS"
print(json.dumps(output))
# ---------- end get_groundstructure ----------

# ---- group: WebSockets for Julia
server_port = Panel("ws://127.0.0.1:2000/")
websocket_client_start = WebsocketClientStart(Address=server_port, InitalMessage=get_groundstructure, Reset=create_a_ground_structure)
websocket_client_start_2 = WebsocketClientStart(Address=server_port, InitalMessage=topopt_python, Reset=optimization)
toggle = BooleanToggle(True)
websocket_client_receiver = WebsocketClientReceiver(WebsocketObjects=websocket_client_start_2, AutoUpdate=toggle)  # -> Message, Status
panel_28 = Panel(websocket_client_receiver.Status)

# ----
cull_9 = CullPattern(List=item_16, CullPattern=larger.LargerThan)
cull_10 = CullPattern(List=vec2pt.Vector, CullPattern=larger.LargerThan)
cull_11 = CullPattern(List=vec2pt.Length, CullPattern=larger.LargerThan)
panel_29 = Panel(get_groundstructure)
circle = CircleCNR(Center=cull_9, Normal=cull_10, Radius=cull)
rectangle_2 = Rectangle(Plane=cull_9, XSize=multiplication_4, YSize=multiplication_4, Radius=0)  # -> Rectangle, Length
orient = Orient(Geometry=rectangle_2.Rectangle, Source=cull_10, Target=PlaneXY(0, 0, 0))  # -> Geometry, Transform
extr = Extrude(Base=circle, Direction=cull_10)

# ---- group: Loads Visualization
item_17 = ListItem(List=info.Nodes, Index=load_inds, Wrap=True)
cone = Cone(Base=item_17, Radius=0.1, Length=expr("x/100", panel_6))  # -> Cone, Tip
move_2 = Move(Geometry=cone.Cone, Motion=Vector(0, 0, 0.1))  # -> Geometry, Transform
preview = CustomPreview(Geometry=move_2.Geometry, Material=ColourSwatch(SwatchColor=RGB(255, 64, 64)))

# ---- group: Supports Visualization
item_18 = ListItem(List=info.Nodes, Index=supports_inds, Wrap=True)
cone_2 = Cone(Base=item_18, Radius=number_slider_4, Length=number_slider_4)  # -> Cone, Tip
preview_2 = CustomPreview(Geometry=cone_2.Cone, Material=ColourSwatch(SwatchColor=RGB(64, 255, 175)))

item_19 = ListItem(List=info.Nodes, Index=roller_supports_inds, Wrap=True)
cone_3 = Cone(Base=item_19, Radius=number_slider_4, Length=number_slider_4)  # -> Cone, Tip
preview_3 = CustomPreview(Geometry=cone_3.Cone, Material=ColourSwatch(SwatchColor=RGB(64, 86, 255)))

# ----
websocket_client_receiver_2 = WebsocketClientReceiver(WebsocketObjects=websocket_client_start, AutoUpdate=toggle)  # -> Message, Status
python_9 = GhPythonScript(input=websocket_client_receiver_2.Message, points=pt2num_2)  # -> out, output; inputs points: tree
# ---------- python_9: Python ----------
__author__ = "pitipatw"
__version__ = "2023.01.24"

import rhinoscriptsyntax as rs
import ghpythonlib.treehelpers as th
import json


output = []
list_points= th.tree_to_list(points, retrieve_base = None)
print(list_points)
dictofelements = json.loads(input)
for i in range(len(dictofelements)):
    temp = (dictofelements[str(i)])
    #, points[i])
    output.append(temp)
    
    
print(output[1])
print(output)
# ---------- end python_9 ----------
python_10 = GhPythonScript(Msg=websocket_client_receiver_2.Message, points=pt2num)  # -> out, element_starts, element_ends, lines; inputs points: tree
# ---------- python_10: Python ----------
__author__ = "pitipatw"
__version__ = "2023.04.14"

import rhinoscriptsyntax as rs
import ghpythonlib.treehelpers as th
import json

elements = json.loads(Msg)
tree = th.tree_to_list(points, retrieve_base = None)
n = len(elements)
print(n)
print(elements)
lines = list()
element_starts = list()
element_ends = list()
for i in range(n) : 
#    print(str(i+1))
    element_starts.append(elements[str(i+1)][0])
    element_ends.append(elements[str(i+1)][1])
    p1 = rs.AddPoint(tree[elements[str(i+1)][0]])
    p2 = rs.AddPoint(tree[elements[str(i+1)][1]])
    lines.append(rs.AddLine(p1,p2))
# ---------- end python_10 ----------
bake_2 = GhPythonScript(geo=python_10.lines, layer="Lines", active=bake_lines)  # -> out; same code as bake
extr_2 = Extrude(Base=rectangle_2.Rectangle, Direction=cull_10)
preview_4 = CustomPreview(Geometry=extr, Material=ColourSwatch(SwatchColor=RGB(0, 55, 255)))
python_11 = GhPythonScript(input=websocket_client_receiver.Message, points=pt2num_2)  # -> out, lines, pos_areas, stresses; inputs points: tree
# ---------- python_11: Python ----------
__author__ = "pitipatw"
__version__ = "2023.01.24"

import rhinoscriptsyntax as rs
import ghpythonlib.treehelpers as th
import json

tree= th.tree_to_list(points, retrieve_base = None)
#print(list_points)
data = json.loads(input)

n = len(data["Elements"])
elements = data["Elements"]
areas = data["Area"]
pos_areas = []
stresses = []
lines = []
for i in range(n) : 
    if areas[i] > 0.00001: 
        p1 = rs.AddPoint(tree[elements[str(i+1)][0]-1])
        p2 = rs.AddPoint(tree[elements[str(i+1)][1]-1])
        lines.append(rs.AddLine(p1,p2))
        pos_areas.append(areas[i])
        stresses.append(data["Stress"][i])
# ---------- end python_11 ----------
panel_30 = Panel(python_10.lines)
item_20 = ListItem(List=info.Nodes, Index=support_pin_inds.Index, Wrap=True)
line_5 = LineSDL(Start=cull_9, Direction=cull_10, Length=cull_11)
supp_6 = SupportKaramba3D(PosInd=item_20, menu=[buttons(on, on, on, off, off, off)])
larger_2 = LargerThan(FirstNumber=python_11.stresses, SecondNumber="0")  # -> LargerThan, OrEqualTo
item_21 = ListItem(List=info.Nodes, Index=support_pin_inds_2.Index, Wrap=True)
larger_3 = LargerThan(FirstNumber=python_11.pos_areas, SecondNumber=Slider(1, range=0..1))  # -> LargerThan, OrEqualTo
explode = Explode(Curve=line_5, Recursive=True)  # -> Segments, Vertices
multiplication_7 = Multiplication(A=python_11.pos_areas, B=python_11.stresses)
loads_3 = LoadsKaramba3D(ForceVector=Z_2, Local=False, PosInd=item_21, LCase="0", mode="Point")
cull_12 = CullPattern(List=python_11.lines, CullPattern=larger_3.OrEqualTo)
duppt_4 = RemoveDuplicatePts(Points=flatten(explode.Vertices), Tolerance=0.01)
multiplication_8 = Multiplication(A=multiplication_7, B="216")
cull_13 = CullPattern(List=python_11.lines, CullPattern=larger_2.LargerThan)
linetobeam_3 = LineToBeamKaramba3D(
    Line=line_5,
    New=True,
    Remove=True,
    LimitDistance_m=0.005,
    Bending=True,
    SetBucklingLength=True,
    ToPolylineMaxAngle=0.03,
    ToPolylineTolerance=0.01,
    ToPolylineMaxEdgeLength=0.25)  # -> Element, Points, Info
cull_14 = CullPattern(List=python_11.lines, CullPattern=invert(larger_2.LargerThan))

# ---- group: Bake THIS and MOD
move_3 = Move(Geometry=cull_12, Motion=Y)  # -> Geometry, Transform

# ----
support_2 = SupportKaramba3D(supp_6)
cull_15 = CullPattern(List=multiplication_8, CullPattern=reverse(larger_2.LargerThan))
cull_16 = CullPattern(List=multiplication_8, CullPattern=larger_2.LargerThan)
load = LoadKaramba3D(loads_3)
move_4 = Move(Geometry=cull_13, Motion=Z_4)  # -> Geometry, Transform
move_5 = Move(Geometry=cull_14, Motion=Z_4)  # -> Geometry, Transform
assemble_3 = AssembleModelKaramba3D(
    Point=duppt_4,
    Elem=linetobeam_3.Element,
    Support=support_2,
    Load=load,
    CrossSection=cross_section,
    Material=material,
    LimitDistance_m=0.005)  # -> Model, Info, Mass_kg, CenterOfGravity, LoadCaseNames
curvepoint_5 = PointOnCurve(move_5.Geometry, parameter=0.5)
curvepoint_6 = PointOnCurve(move_4.Geometry, parameter=0.5)
preview_5 = CustomPreview(Geometry=move_4.Geometry, Material=ColourSwatch(SwatchColor=RGB(0, 55, 255)))
analyze_3 = AnalyzeKaramba3D(Model=assemble_3.Model)  # -> CalculatedModel, MaximumDisplacement_cm, ResultingForceOfGravity_kN, ElasticEnergyChange_kNm
xz_2 = XZPlane(Origin=curvepoint_6)
xz_3 = XZPlane(Origin=curvepoint_5)
tag = TextTag3D(Location=xz_2, Text=cull_16, Size=Slider(8, range=0..100), Justification=7)
preview_6 = CustomPreview(Geometry=move_5.Geometry, Material=ColourSwatch(SwatchColor=RGB(217, 106, 106)))
tag_2 = TextTag3D(Location=xz_3, Text=cull_15, Size=Slider(8, range=0..100), Justification=7)
b_forces_2 = BeamForcesKaramba3D(AnalyzedModel=analyze_3.CalculatedModel, Ts=[0, 1])  # -> AnalyzedModel, NormalForce_kN, ShearForceVz_kN, ShearForceVy_kN, TorsionalMomentMt_kNm, BendingMomentMy_kNm, BendingMomentMz_kNm

crv_7 = Curve(pipeline_6)  # disabled
curvepoint_7 = PointOnCurve(crv_7, parameter=1)  # disabled
curvepoint_8 = PointOnCurve(crv_7, parameter=0)  # disabled
crv_8 = Curve(info.Edges)  # disabled
mindex = MemberIndex(Set=info.Nodes, Member=curvepoint_7)  # -> graft(Index), Count; disabled
curvepoint_9 = PointOnCurve(crv_8, parameter=1)  # disabled
curvepoint_10 = PointOnCurve(crv_8, parameter=0)  # disabled
mindex_2 = MemberIndex(Set=info.Nodes, Member=curvepoint_8)  # -> graft(Index), Count; disabled
merge_12 = Merge(Data1=mindex_2.Index, Data2=mindex.Index)  # -> simplify(Result); disabled
mindex_3 = MemberIndex(Set=info.Nodes, Member=curvepoint_9)  # -> flatten(Index), Count; disabled
mindex_4 = MemberIndex(Set=info.Nodes, Member=curvepoint_10)  # -> flatten(Index), Count; disabled
equals_6 = Equality(FirstNumber=mindex_2.Index, SecondNumber=mindex_4.Index)  # -> Equality, Inequality; disabled
equals_7 = Equality(FirstNumber=mindex.Index, SecondNumber=mindex_3.Index)  # -> Equality, Inequality; disabled
panel_31 = Panel("1")  # disabled
panel_32 = Panel([mindex_2.Index, mindex.Index])  # disabled
panel_33 = Panel(merge_12)  # disabled
multiplication_9 = Multiplication(A=equals_6.Equality, B=equals_7.Equality)  # -> simplify(Result); disabled
index_2 = ItemIndex(List=simplify(equals_6.Equality), Item=panel_31)  # disabled
fsim_2 = FindSimilarMember(Data=simplify(multiplication_9), Set=panel_31)  # -> Hit, Index; disabled
mindex_5 = MemberIndex(Set=multiplication_9, Member=panel_31)  # -> Index, Count; disabled
ma_2 = MassAddition(Input=multiplication_9)  # -> Result, PartialResults; disabled
panel_34 = Panel(fsim_2.Hit)  # disabled

ee = TotalEmbodiedEnergy(MaterialProperties=read_mp_2, ConcreteSection=bs.ConcreteSections, SteelSection=bs.SteelReinforcementSections)  # -> EmbodiedEnergyMJ, TotalMassKg, SteelAndConcreteBreps
brep_4 = Brep(ee.SteelAndConcreteBreps)

division_7 = Division(A=long_span_m, B=slab_width_m)
Y_2 = UnitY(Factor=slab_width_m)
of_slabs = Panel(division_7)
arrlinear = LinearArray(Geometry=brep_4, Direction=Y_2, Count=division_7)  # -> Geometry, Transform
# 4 | Visualization
preview_7 = CustomPreview(Geometry=arrlinear.Geometry, Material=ColourSwatch(SwatchColor=RGBA(125, 119, 115, 178)))

num_7 = Number(division_7)
multiplication_10 = Multiplication(A=num_7, B=ee.EmbodiedEnergyMJ)

# ---- group: Objective
num_8 = Number(multiplication_10)

# ----
radical = Radical(
    Objective=num_8,
    Constraints=num_5,
    NumericalVariables=[number_0, number_8, slab_width_m, maximum_depth, number_4_3, number_4_4, number_4_5, number_4, maximum_depth_2, number_4_7, number_4_8, number_4_6, number_4_2])  # -> ObjectiveEvolution, Var, GradientEvolution

# ---- group: Material volumes
volume_2 = Volume(Geometry=brep_4)  # -> Volume, Centroid
multiplication_11 = Multiplication(A=num_7, B=volume_2.Volume)
item_22 = ListItem(List=multiplication_11, Index=0, Wrap=True)  # -> Item, Item1
panel_35 = Panel(item_22.Item1)
panel_36 = Panel(item_22.Item)

# ----
multiplication_12 = Multiplication(A=num_7, B=ee.TotalMassKg)
resultant_ee = Panel("2497.801029")
# 5 | Evaluation
resultant_ee_2 = Panel(num_8)
resultant_mass_kg_2 = Panel(multiplication_12)

expression_11 = Expression(x=panel_36, y=vol_concrete_m3, Expression="Format(\"{0:0}\", (y-x)/y*100) & \"% Concrete Reduction\"")
expression_12 = Expression(x=panel_35, y=vol_steel_m3, Expression="Format(\"{0:0}\", (y-x)/y*100) & \"% Steel Reduction\"")
panel_37 = Panel(expression_12)
panel_38 = Panel(expression_11)

expression_13 = Expression(x=resultant_ee_2, y=resultant_ec, Expression="\", \" & Format(\"{0:0}\", (y-x)/y*100) & \"% EC Reduction\"")
expression_14 = Expression(x=resultant_mass_kg_2, y=resultant_mass_kg, Expression="Format(\"{0:0}\", (y-x)/y*100) & \"% Mass Reduction\"")
panel_39 = Panel(expression_14)
panel_40 = Panel(expression_13)

# ---- group: Result Visualization
expression_15 = Expression(x=multiplication_10, Expression="Format(\"{0:0.0}\", x) & \" kg CO2\"")
curvepoint_11 = PointOnCurve(crv_3, parameter=0.5)
Z_6 = UnitZ(Factor=Slider(0.25, range=0..1))
move_6 = Move(Geometry=curvepoint_11, Motion=Z_6)  # -> Geometry, Transform
xz_4 = XZPlane(Origin=move_6.Geometry)

# ----
concat_5 = Concatenate(FragmentA=expression_15, FragmentB=expression_13)
panel_41 = Panel(expression_15)

# ---- group: Result Visualization (continued)
tag_3 = TextTag3D(Location=xz_4, Text=concat_5, Size=Slider(0.14, range=0..1), Justification=5)

# ----
sort_7 = SortList(Keys=pdecon.ZComponent, ValuesA=pdecon.ZComponent)  # -> Keys, ValuesA
item_23 = ListItem(List=reverse(sort_7.ValuesA), Index=0, Wrap=True)

equalst_4 = EqualityWithinTolerance(FirstNumber=item_23, SecondNumber=pdecon.ZComponent, Tolerance=0.001)  # -> Equality, Inequality

cull_17 = CullPattern(List=duppt_2, CullPattern=equalst_4.Equality)
