# Grasshopper definition 10022023_AdamModified3DTopOpt.gh (Grasshopper 1.0.7)
# plug-ins: FDMremote, Kangaroo2 Components

extent_z = Slider(4, range=1..4)
recgrid = Rectangular(Plane=PlaneXY(0, 0, 0), SizeX="1", SizeY="1", ExtentX=Slider(9, range=2..12), ExtentY=Slider(3, range=1..4))  # -> flatten(Cells), flatten(Points)
series = Series(Start=1, Step=1, Count=extent_z)
Z = UnitZ(Factor=series)  # -> graft(UnitVector)
panel = Panel("""2
1""")
panel_2 = Panel("""0
3""")
move = Move(Geometry=recgrid.Points, Motion=Z)  # -> Geometry, Transform
move_2 = Move(Geometry=recgrid.Cells, Motion=Z)  # -> Geometry, Transform
pt = Point(recgrid.Points)
line = LineSDL(Start=move.Geometry, Direction=Vector(0, 0, -1), Length=1)
explode = Explode(Curve=recgrid.Cells, Recursive=True)  # -> flatten(Segments), Vertices
inter = InterconnectPoints(Pts=pt)
merge = Merge(Data1=flatten(move_2.Geometry), Data2=flatten(line), Data3=recgrid.Cells)
item = ListItem(List=explode.Vertices, Index=panel_2, Wrap=True)
item_2 = ListItem(List=explode.Vertices, Index=panel, Wrap=True)
explode_2 = Explode(Curve=merge, Recursive=True)  # -> Segments, flatten(Vertices)
dupln = RemoveDuplicateLines(Lines=explode.Segments, Tolerance=0.01)
ln = Line(StartPoint=item, EndPoint=item_2)  # -> flatten(Line)
line_2 = Line(flatten([dupln, ln]))
duppt = RemoveDuplicatePts(Points=explode_2.Vertices, Tolerance=0.01)
inter_2 = InterconnectPoints(Pts=flatten(duppt))
len = Length(Curve=inter_2)
mplane = MeshPlane(Boundary={Plane=PlaneXY(0, 0, 0), Size=Domain2(u=-10..10, v=-10..10)}, WidthCount=10, HeightCount=10)  # -> Mesh, Area
smaller = SmallerThan(FirstNumber=len, SecondNumber="2")  # -> SmallerThan, OrEqualTo
medges = MeshEdges(Mesh=mplane.Mesh)  # -> NakedEdges, InteriorEdges, NonManifoldEdges
cull = CullPattern(List=inter_2, CullPattern=smaller.SmallerThan)

# ----
# Ground Structure
line_3 = Line(cull)
pt_2 = Point(explode_2.Vertices)

# ----
# In 'edge_end_ids' the first item is the index of the start node and the second item is the index of the end node
construct_network = GhPythonScript(curves=line_3, point_tol=6)  # -> network, simplify(nodes), simplify(edge_names), simplify(edge_end_IDs); inputs curves: list of Curve, curve_IDs: list, point_tol: Int32
# ---------- construct_network: Python ----------
__author__ = "adam"
__version__ = "2022.11.26"
        
import rhinoscriptsyntax as rs
import ghpythonlib.treehelpers as th
import json
import Grasshopper.Kernel as gh
import itertools
import Rhino
import time

time.sleep(0.01)

#print(settings)

e = gh.GH_RuntimeMessageLevel.Error
w = gh.GH_RuntimeMessageLevel.Warning

def format_nodes_edges(curves,curve_IDs):
    nodes = []
    nodes_Point3d = []
    edges = {}

    for i, crv in enumerate(curves):
        start_pt = rs.CurveStartPoint(crv)
        sx = round(start_pt.X,point_tol)
        sy = round(start_pt.Y,point_tol)
        sz = round(start_pt.Z,point_tol)
        start = [sx, sy, sz]
        end_pt = rs.CurveEndPoint(crv)
        ex = round(end_pt.X,point_tol)
        ey = round(end_pt.Y,point_tol)
        ez = round(end_pt.Z,point_tol)
        end = [ex, ey, ez]
        edge = []
        if start in nodes:
            #add +1 indexing for julia 1 based indexing
            edge.append(nodes.index(start)+1)
        else:
            nodes.append(start)
            nodes_Point3d.Add(start_pt)
            edge.append(nodes.index(start)+1)
        if end in nodes:
            edge.append(nodes.index(end)+1)
        else:
            nodes.append(end)
            nodes_Point3d.Add(end_pt)
            edge.append(nodes.index(end)+1)
        if len(curve_IDs) == 0:
            edges[str(i+1)] = edge
        elif len(curve_IDs) != len(curves):
            edges[str(i+1)] = edge
            ghenv.Component.AddRuntimeMessage(w,'Curve ID count does not match number of curves') 
        else:
            edges[str(curve_IDs[i])] = edge
    return nodes, edges



nodes, edges = format_nodes_edges(curves,curve_IDs)
network = {"nodes":nodes, "edges":edges}
network = json.dumps(network, indent=4)
nodes = th.list_to_tree(nodes, None)
edge_names = th.list_to_tree(edges.keys(), None)
edge_end_IDs = th.list_to_tree(edges.values(), None)
# ---------- end construct_network ----------

num2pt = NumbersToPoints(Numbers=construct_network.nodes, Mask=4)  # -> flatten(Points)
tstat = TreeStatistics(Tree=num2pt)  # -> Paths, Length, Count
supoprt_points = ListItem(List=pt_2, Index=0, Wrap=True)  # -> Item, Item1, Item2
series_2 = Series(Start="1", Step=1, Count=tstat.Length)
txt = Text(construct_network.edge_end_IDs)
txt_2 = Text(series_2)
keysearch = KeyValueSearch(Keys=txt_2, Values=num2pt, Search=txt)
create = CreateNetwork(
    Edges=flatten(line_3),
    Anchors=[supoprt_points.Item, supoprt_points.Item1, supoprt_points.Item2],
    ForceDensities=1,
    IntersectionTolerance=0.1)
dispatch = Dispatch(List=keysearch, DispatchPattern=[True, False])  # -> ListA, ListB
ln_2 = Line(StartPoint=dispatch.ListA, EndPoint=dispatch.ListB)
info = NetworkInformation(FDMNetwork=create)  # -> Nodes, Edges, EdgeLengths, StartIndex, EndIndex, Anchors, ForceDensities, NumberEdges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
pdecon = Deconstruct(Point=info.Nodes)  # -> XComponent, YComponent, ZComponent
sort = SortList(Keys=pdecon.YComponent)  # -> Keys, ValuesA
sort_2 = SortList(Keys=pdecon.XComponent)  # -> Keys, ValuesA
sort_3 = SortList(Keys=pdecon.ZComponent)  # -> Keys, ValuesA
pt2num = PointsToNumbers(Points=graft(info.Nodes), Mask=4)  # -> simplify(Numbers)
item_3 = ListItem(List=sort.Keys, Index=-1, Wrap=True)
ma = MassAddition(Input=sort_2.Keys)  # -> Result, PartialResults
item_4 = ListItem(List=sort_2.Keys, Index=-1, Wrap=True)
cull_2 = CullPattern(List=info.StartIndex, CullPattern=smaller.SmallerThan)
date = ConstructDate(Year=2023, Month=2, Day=7, Hour=12, Minute=0, Second=0)
item_5 = ListItem(List=sort_3.Keys, Index=-1, Wrap=True)
ma_2 = MassAddition(Input=sort.Keys)  # -> Result, PartialResults
lng = ListLength(List=pdecon.XComponent)
panel_3 = Panel(date)
lng_2 = ListLength(List=pdecon.YComponent)
division = Division(A=ma.Result, B=lng)
division_2 = Division(A=ma_2.Result, B=lng_2)
equals = Equality(FirstNumber=pdecon.ZComponent, SecondNumber=item_5)  # -> Equality, Inequality
expression = Expression(x=pdecon.XComponent, y=division, Expression="abs(x-y)")
expression_2 = Expression(x=pdecon.YComponent, y=division_2, Expression="abs(x-y)")
equals_2 = Equality(FirstNumber=pdecon.XComponent, SecondNumber=item_4)  # -> Equality, Inequality
equals_3 = Equality(FirstNumber=pdecon.ZComponent, SecondNumber="0")  # -> Equality, Inequality
equals_4 = Equality(FirstNumber=pdecon.XComponent, SecondNumber="0")  # -> Equality, Inequality
equals_5 = Equality(FirstNumber=pdecon.XComponent, SecondNumber=division)  # -> Equality, Inequality
smaller_2 = SmallerThan(FirstNumber=expression_2, SecondNumber="1")  # -> SmallerThan, OrEqualTo
smaller_3 = SmallerThan(FirstNumber=expression, SecondNumber="1")  # -> SmallerThan, OrEqualTo
or = GateOr(A=equals_4.Equality, B=equals_2.Equality)
and = GateAnd(A=equals.Equality, B=smaller_3.SmallerThan, C=smaller_2.SmallerThan)
and_2 = GateAnd(A=equals_3.Equality, B=or)
pt_3 = Point()
cull_3 = CullPattern(List=info.Nodes, CullPattern=and_2)
cull_4 = CullPattern(List=info.Nodes, CullPattern=and)
pt_4 = Point(<point referenced from the Rhino model>)
supports = ItemIndex(List=info.Nodes, Item=cull_3)
python = GhPythonScript(LIST=pt_4)  # -> out, a
# ---------- python: Python ----------
__author__ = "pitipatw"
__version__ = "2023.02.10"

import rhinoscriptsyntax as rs


for p in LIST:
    print(p.Location)
# ---------- end python ----------
ptloads_id = ItemIndex(List=info.Nodes, Item=pt_4)
python_2 = GhPythonScript(
    elements_i=info.StartIndex,
    elements_j=info.EndIndex,
    points=pt2num,
    supports=supports,
    loads=ptloads_id,
    maxVf=Slider(0.306, range=0.005..0.31),
    time=panel_3)  # -> out; inputs elements_i: list, elements_j: list, points: tree, supports: list, loads: list
# ---------- python_2: Python ----------
__author__ = "pitipatw"
__version__ = "2023.01.24"

import rhinoscriptsyntax as rs
import ghpythonlib.treehelpers as th
import json

# assign static values
output = dict() 
output["model_name"] = "Pitipat_SMBT"
output["unit"] = "meter"
output["generate_time"] = time

output["model_type"] = "truss"

output["_info"] = "myFirstGHtoJuliaTopOpt"
output["TO_model_type"] = "ground_mesh"
# Processing Inputs
tree = th.tree_to_list(points, retrieve_base = None)

#input materials detail
materials = dict()
materials = [{"G12": 80760000.0,
            "E": 1000.0,
            "name": "DummyMaterial",
            "family": "DummyMaterial",
            "density": 78.5,
            "elem_tags": [],
            "E_unit": "kN/m2",
            "type_name": "ISO",
            "fy": 235000.0,
            "mu": 0.3,
            "density_unit": "kN/m3",
            "fy_unit": "kN/m2",
            "G12_unit": "kN/m2"}]
output["materials"] = materials

#make a default of 2 but then able to put in 3
output["dimension"] = 3




cross_secs = dict() 
cross_secs["A"] = 1 
cross_secs["name"] = ""
cross_secs["family"] = "DummyCroSecByPitipat"
cross_secs["elem_tags"] = []
cross_secs["A_unit"] = "m2" 
cross_secs["Iy"]= 2.1106547193827362e-06
cross_secs["Iz"]= 2.1106547193827362e-06
cross_secs["Jx"]= 4.2213094387654724e-06
cross_secs["name"]= "RO114.3/4"
output["cross_secs"] = [cross_secs]


nodes = dict()
nodes_list = list()
for i in range(len(tree)):
    dummy = dict()
    dummy["node_ind"] = i
    dummy["point"] = tree[i][0:3]
    dummy["is_grounded"] = False
    nodes_list.append(dummy)

output["nodes"] = nodes_list
elements_list = list() 
for i in range(len(elements_i)) : 
    dummy = dict() 
    dummy["elem_ind"] = i
    dummy["end_node_inds"] = [ elements_i[i], elements_j[i]]
    dummy["elem_tag"] = ""
    dummy["bending_stiff"] = False
    elements_list.append(dummy)

supports_list = list()
check = True
for i in supports: 
    dummy = dict()
    dummy["node_ind"] = i
    if check :
        dummy["condition"] = [1,1,1,0,0,0]
        #check = False
    else :
        dummy["condition"] = [0,1]
    supports_list.append(dummy)
output["supports"] = supports_list

output["joints"] = []

loadcases_dict = dict()
#this is load case "0"
loadcases_0 = dict()
loadcases_0["lc_ind"] = 0
ploads = dict()
load_list = list()
for i in loads :
    dummy = dict()
    dummy["node_ind"] = int(i)
    dummy["force"]  = [0.0, 0.0, -1.0]
    dummy["moment"] = [0.0, 0.0, 0.0]
    dummy["loadcase"] = str(i)
    dummy["force_unit"] = "kN"
    load_list.append(dummy)
loadcases_0["ploads"] = load_list
loadcases_0["eloads"] = []
loadcases_0["gravity"] = ""
loadcases_dict["0"] = loadcases_0

output["loadcases"] = loadcases_dict


output["elements"] = elements_list

#====Node and Element numbers are here!====
output["node_num"] = len(tree)
output["element_num"] = len(elements_list) 
#====

output["maxVf"] = maxVf


print(json.dumps(output))
# ---------- end python_2 ----------
panel_4 = Panel(python.out)

websocket_client_start = WebsocketClientStart(Address="ws://127.0.0.1:2000/", InitalMessage=python_2, Reset=Button())
websocket_client_receiver = WebsocketClientReceiver(WebsocketObjects=websocket_client_start, AutoUpdate=Toggle(True))  # -> Message, Status
panel_5 = Panel(websocket_client_receiver.Message)
panel_6 = Panel(websocket_client_receiver.Status)
