# Grasshopper definition 11052023_main.gh (Grasshopper 1.0.7)
# plug-ins: FDMremote, Karamba3D, Kangaroo2 Components, MetaHopper, BeamShapeExplorer, Radical, Pufferfish, BubalusGH2.0

brep = Brep(<brep referenced from the Rhino model>)
capex = CapHolesEx(Brep=brep)  # -> Brep, Caps, Solid

# ---- group: TopOpt Control
apply_length_limit = BooleanToggle(False)
# 5 4 6
# 0.27
# "2"
# 0.27
# fail
interconnectivity = BooleanToggle(True)
gs_visibility = BooleanToggle(True)
max_members_length = Slider(384.2, range=0..1000)
max_volume_fraction = Slider(0.04, range=0..1)
groundstruct = Button()
optimization = Button()
bake_points = Button()
list = ValueList({"2D": 2, "3D": 3}, selected="3D")

# ---- group: Components control
# This is a Topology Optimization using TopOpt.jl
# 
# last major modified: 11 May 2023
bake = BakeObject(Bake=bake_points, AllObjects_Object=pt_3)
onoff = EnableDisableObject(AllObjects_Object=[smaller, cull, len])
# 5 4 6
# 0.27
# 3
# 0.27
# pass
onoff_2 = EnableDisableObject(Enabled=interconnectivity)
# Notes:
# 
# For 2D problems, 3D model will be made,
# but z-axis constraints will be added to every node.
# 
# Actual separation is not implemented yet.
hideshow = HideShowObjectPreview(Visible=gs_visibility, AllObjects_Object=line_2)

# ---- group: Adam's
# Box Ground Structure
nx = Slider(5, range=0..10)
ny = Slider(4, range=0..10)
nz = Slider(3, range=0..10)
lx = Slider(10, range=0..100)
ly = Slider(2, range=0..100)
lz = Slider(3, range=0..100)
expression = Expression(L=lx, x=nx, Expression="L/(x-1)")
python = GhPythonScript(L=ly, x=lz)  # -> out, a
# ---------- python: Python ----------
__author__ = "pitipatw"
__version__ = "2023.03.10"

import rhinoscriptsyntax as rs

if x==1 :
    a = 0
else:
    a = L/(x-1)
# ---------- end python ----------
python_2 = GhPythonScript(L=ly, x=ny)  # -> out, a; same code as python
box = CenterBox(Base=PlaneXY(0, 0, 0), X=expr("x/2", expression), Y=expr("x/2", python_2.a), Z=expr("x/2", python.a))
# With nz = 7
# truss parser in the Websocket "doesnt" fail.
# 
# But with nz = 4 ,3 .. it fails
# 
# Unexpect end of file 0
# 
# 
# But run outside of the websocket does not fail too. What!
origin_point = ConstructPoint(XCoordinate=0, YCoordinate=0, ZCoordinate=0)
arrbox = BoxArray(Geometry=origin_point, Cell=box, XCount=nx, YCount=ny, ZCount=nz)  # -> Geometry, Transform
duppt = RemoveDuplicatePts(Points=arrbox.Geometry, Tolerance=0.01)

# ----
# To do
# 
# visualize roller support points
# 
# Specified applied load values
# 
# movable points (optional: movable groundstructure)
# 
# color
# 
# Specify domain size
# and the nX,nY,nZ are divisions instead of keep adding
filter = StreamFilter(Gate=list)
number_4 = Slider(0.47, range=0.05..0.95)
number_4_2 = Slider(0.12, range=0.05..0.95)

# ---- group: Code Selection
# 0 | Materials and Code
# Right-click and recompute if changed
number_slider = Slider(1, range=0..1)
nickname = SelectCode2(Code=number_slider)
panel = Panel(nickname)

# ----
long_span_m = Slider(6, range=0..10)
slab_width_m = Slider(0.53, range=0..5)
# 1 | Geometry definition
slab_clear_span_m = Slider(4, range=0..8)

maximum_depth = Slider(0.1, range=0.05..1)
number_4_3 = Slider(0.62, range=0.05..0.95)
number_4_4 = Slider(0.23, range=0.05..0.95)
number_4_5 = Slider(0.37, range=0.05..0.95)
merge = Merge(Data1="1", Data2="1", Data3=number_4_3, Data4=number_4_4, Data5=number_4_4)
merge_2 = Merge(Data1="0", Data2=number_4_5, Data3="0", Data4=number_4, Data5="1")
sbuild = SectionBuilder(WidthMOfSectionB=slab_width_m, DepthMOfSectionH=maximum_depth, VPx=merge, VPy=merge_2)  # -> Pts, Crv, VSect

number_4_6 = Slider(0.14, range=0.05..0.95)
maximum_depth_2 = Slider(0.22, range=0.05..1)
number_4_7 = Slider(0.05, range=0.05..0.95)
number_4_8 = Slider(0.09, range=0.05..0.95)
merge_3 = Merge(Data1="1", Data2="1", Data3=number_4_7, Data4=number_4_8, Data5=number_4_8)
merge_4 = Merge(Data1="0", Data2=number_4_6, Data3="0", Data4=number_4_2, Data5="1")
sbuild_2 = SectionBuilder(WidthMOfSectionB=slab_width_m, DepthMOfSectionH=maximum_depth_2, VPx=merge_3, VPy=merge_4)  # -> Pts, Crv, VSect

merge_5 = Merge(Data1=sbuild.VSect, Data2=sbuild_2.VSect, Data3=sbuild.VSect)
bbuild = BeamBuilder(SpanM=slab_clear_span_m, VSect=merge_5)  # -> ConstructionPlanes, Pts, Crv, BeamBrep, SpanCurve

# ---- group: Material Properties
# Right-click and recompute if changed
set_mp = MaterialPropertiesGlobal(
    ConcreteCharacteristicStrengthMPaNMm2="20",
    ConcreteEModulusMPaNMm2=27500,
    ConcreteMaximumStrainMmMm=0.0035,
    ConcreteDensityKgM3=2400,
    ConcreteEmbodiedEnergyCoefficientMJKg="0.147",
    SteelCharacteristicStrengthMPaNMm2="415",
    SteelEModulusMPaNMm2=205000,
    SteelMaximumStrainMmMm=0.004,
    SteelDensityKgM3=8050,
    SteelEmbodiedEnergyCoefficientMJKg="1.32")

# ---- group: effective width constraint / hf (m)
multiplication = Multiplication(A=maximum_depth, B=number_4_5)
multiplication_2 = Multiplication(A=maximum_depth_2, B=number_4_6)
merge_6 = Merge(Data1=multiplication, Data2=multiplication_2)

# ----
time = Time("now")
date = ConstructDate(Year=2023, Month=4, Day=19, Hour=12, Minute=0, Second=0)
ddate = DeconstructDate(Date=time)  # -> Year, Month, Day, Hour, Minute, Second
lng = ListLength(List=ddate.Month)

# ---- group: Formwork blocks (to be finished)
crv = Curve(bbuild.Crv)
item = ListItem(List=crv, Index="0", Wrap=True)
curvepoint = PointOnCurve(item, parameter=0.5)
item_2 = ListItem(List=crv, Index="2", Wrap=True)
item_3 = ListItem(List=crv, Index="3", Wrap=True)
xz = XZPlane(Origin=curvepoint)
mirror = Mirror(Geometry=item_2, Plane=xz)  # -> Geometry, Transform
mirror_2 = Mirror(Geometry=item_3, Plane=xz)  # -> Geometry, Transform
merge_7 = Merge(Data1=item_3, Data2=item_2, Data3=mirror.Geometry, Data4=mirror_2.Geometry)
curvepoint_2 = PointOnCurve(merge_7, parameter=0.5)
end = EndPoints(Curve=merge_7)  # -> Start, End
pline = PolyLine(Vertices=end.End, Closed=False)
pline_2 = PolyLine(Vertices=curvepoint_2, Closed=False)

# ----
crv_2 = Curve(bbuild.SpanCurve)
brep_2 = Brep(bbuild.BeamBrep)

equals = Equality(FirstNumber=lng, SecondNumber=Slider(1, range=0..1))  # -> Equality, Inequality
concat = Concatenate(FragmentA=Slider(0, range=0..100), FragmentB=ddate.Month)

interconnected_lines = Line()
len = Length(Curve=interconnected_lines)
smaller = SmallerThan(FirstNumber=len, SecondNumber=max_members_length)  # -> SmallerThan, OrEqualTo
cull = CullPattern(List=interconnected_lines, CullPattern=smaller.SmallerThan)
filter_2 = StreamFilter(Gate=apply_length_limit, Stream0=interconnected_lines, Stream1=cull)

filter_3 = StreamFilter(Gate=equals.Equality, Stream0=ddate.Month, Stream1=concat)
live_load_kn_m = Slider(2, range=0..10)
multiplication_3 = Multiplication(A=Slider(200, range=0..1000), B=slab_width_m, C="9.8e-03")

# ---- group: FEA Assembly
number_slider_2 = Slider(5, range=0..10)
read_mp = ReadMP()
lew = LoadEnvelopeFromSelfweight(MaterialProperties=read_mp, BeamBRep=brep_2, SpanCurve=crv_2, NumberOfAnalysisSections=number_slider_2, GraphScale=0.1)  # -> DistributedLoadEnvelopeKNM, SplitCurve, DistributedLoadGraphActual, DistributedLoadGraphAverage, ElementSegments
expression_2 = Expression(D=lew.DistributedLoadEnvelopeKNM, L=multiplication_3, Expression="-1.6*L+1.2*D")
series = Series(Start=0, Step=1, Count=number_slider_2)
end_2 = EndPoints(Curve=crv_2)  # -> Start, End
concat_2 = Concatenate(FragmentA="seg_", FragmentB=series)
Z = UnitZ(Factor=expression_2)
supp = SupportKaramba3D(PosInd=end_2.Start, menu=[buttons(on, on, on, on, off, on)])
supp_2 = SupportKaramba3D(PosInd=end_2.End, menu=[buttons(off, off, on, off, off, off)])
loads = LoadsKaramba3D(Vector=graft(Z), BeamIdentifiers=graft(concat_2), mode="Uniform Line", menu=[buttons(on, off, off)])  # -> flatten(Load)
linetobeam = LineToBeamKaramba3D(Line=lew.SplitCurve, Identifier=concat_2, New=True, Remove=True, LimitDistance_m=0.005)  # -> Element, Points, Info

# ----
concat_3 = Concatenate(FragmentA="99", FragmentB=filter_3, FragmentC=ddate.Year)
panel_2 = Panel(concat_3)

# ---- group: FEW Analysis
assemble = AssembleModelKaramba3D(Elem=linetobeam.Element, Support=[supp_2, supp], Load=loads, LimitDistance_m=0.005)  # -> Model, Info, Mass_kg, CenterOfGravity
# 2 | Load envelope
analyze = AnalyzeKaramba3D(Model=assemble.Model)  # -> CalculatedModel, MaximumDisplacement_cm, ResultingForceOfGravity_kN, ElasticEnergy_kNm
modelview = ModelViewKaramba3D(Model=analyze.CalculatedModel, ResultFactors=1, ResultCase=-1)  # -> Model, DeformedMesh, DeformedAxes, DeformedModel
beamview = BeamViewKaramba3D(Model=modelview.Model)  # -> Model, MeshesOfRenderedBeams, DeformedBeamAxes, LegendColors, LegendTags

# ---- group: FEA Results
b_forces = BeamForcesKaramba3D(AnalyzedModel=beamview.Model, LCase=-1, MaximumDistanceBetweenResults_m=-1, NumberOfResultsPerBeamElement=2)  # -> AnalyzedModel, NormalForce_kN, ShearForceVz_kN, ShearForceVy_kN, BendingMomentMt_kNm, BendingMomentMy_kNm, BendingMomentMz_kNm
dispatch = Dispatch(List=beamview.DeformedBeamAxes, DispatchPattern=[True, False])  # -> ListA, ListB
bnd = Bounds(Numbers=flatten(b_forces.ShearForceVz_kN))
bnd_2 = Bounds(Numbers=flatten(b_forces.BendingMomentMy_kNm))
join = JoinCurves(Curves=dispatch.ListA, Preserve=False)
join_2 = JoinCurves(Curves=dispatch.ListB, Preserve=False)
lecrv = LoadEnvelopeFromCurves(
    ShearCurve=join,
    MomentCurve=join_2,
    ShearDomain=bnd,
    MomentDomain=bnd_2,
    SpanCurve=crv_2,
    NumberOfAnalysisSections=Slider(5, range=0..100))  # -> ShearEnvelopeKN, MomentEnvelopeKNM, ShearAndMomentGraphs

# ----
y_kn = Panel("""0
0
0
0
0
0
0
0
0
0
0
0
0
0
0
0
0
0
0
0""")
x_kn = Panel("""0
0
0
0
0
0
0
0
0
0
0
0
0
0
0
0
0
0
0
0""")
z_kn = Panel("""-10
-10
-10
-10
-10
-10
-10
-10
-10
-10
-10
-10
-10
-10
-10
-10
-10
-10
-10
-10""")
merge_8 = Merge(Data1=graft(x_kn), Data2=graft(z_kn), Data3=graft(x_kn))  # -> simplify(Result)
panel_3 = Panel(merge_8)

crv_3 = Curve(bbuild.SpanCurve)
brep_3 = Brep(bbuild.BeamBrep)

expression_3 = Expression(d=Slider(12, range=0..100), Expression="pi*(d/2)^2")
expression_4 = Expression(A=expression_3, Expression="2*sqrt(A/pi)")
panel_4 = Panel(expression_4)

# ---- group: Vu, Mu
num = Number(lecrv.ShearEnvelopeKN)
num_2 = Number(lecrv.MomentEnvelopeKNM)

# ---- group: Rebar Area
number_0 = Slider(0.011, range=0.001..1)
remap = RemapNumbers(Value=number_0, Source=Domain(0, 1), Target="0 to 10000")  # -> Mapped, Clipped
as_mm2 = Panel(remap.Mapped)

# ----
number_slider_3 = Slider(0.05, range=0..0.1)
panel_5 = Panel(num_2)

# ----
# 3 | Analysis & Optimization
read_mp_2 = ReadMP()

number_8 = Slider(35, range=15..200)
bs = BeamSections(
    MaterialProperties=read_mp_2,
    MomentEnvelopeKNM=num_2,
    BeamBRep=brep_3,
    SpanCurve=crv_3,
    ClearCoverMm=number_8,
    AreaOfSteelMm2=remap.Mapped,
    ConstantAreaOfSteel=Toggle(True))  # -> ConcreteSections, SteelReinforcementSections

crv_4 = Curve(join_2)
domain = Domain(bnd)
domain_2 = Domain(bnd_2)
brep_4 = Brep(bbuild.BeamBrep)
crv_5 = Curve(join)
crv_6 = Curve(bbuild.SpanCurve)
num_3 = Number(remap.Mapped)
num_4 = Number(number_8)

yz = YZPlane(Origin=Point(0, 0, 0))
offset = OffsetCurve(Curve=bs.SteelReinforcementSections, Distance=Slider(0.015, range=0..0.1), Plane=yz, Corners=1)
ccx = CurveCurve(CurveA=graft(bs.ConcreteSections), CurveB=offset)  # -> flatten(Points), ParamsA, ParamsB
_10º = PowerOf10(Value=Slider(1, range=1..5))
lng_2 = ListLength(List=ccx.Points)
multiplication_4 = Multiplication(A=lng_2, B=_10º)
sqr = Square(Value=lng_2)
neg = Negative(Value=sqr)

# ---- group: Deflection calcs
division = Division(A=slab_clear_span_m, B=Slider(360, range=0..1000))
deflection_limit_m = Panel(division)

read_mp_3 = ReadMP()
lecrv_2 = LoadEnvelopeFromCurves(
    ShearCurve=crv_5,
    MomentCurve=crv_4,
    ShearDomain=domain,
    MomentDomain=domain_2,
    SpanCurve=crv_6,
    NumberOfAnalysisSections=Slider(31, range=0..100))  # -> ShearEnvelopeKN, MomentEnvelopeKNM, ShearAndMomentGraphs
bs_2 = BeamSections(
    MaterialProperties=read_mp_3,
    MomentEnvelopeKNM=lecrv_2.MomentEnvelopeKNM,
    BeamBRep=brep_4,
    SpanCurve=crv_6,
    ClearCoverMm=num_4,
    AreaOfSteelMm2=num_3,
    ConstantAreaOfSteel=False)  # -> ConcreteSections, SteelReinforcementSections
fa = FlexuralAnalysis(
    MaterialProperties=read_mp_3,
    MomentEnvelopeKNM=lecrv_2.MomentEnvelopeKNM,
    ConcreteSection=bs_2.ConcreteSections,
    SteelSection=bs_2.SteelReinforcementSections,
    SectionSubdivisions=15)  # -> MomentCapacityKNM, CompressionArea
mcr = CrackingMoment(MaterialProperties=read_mp_3, ConcreteSection=bs_2.ConcreteSections, SteelSection=bs_2.SteelReinforcementSections)
icr = CrackedMomentOfInertia(MaterialProperties=read_mp_3, ConcreteCompressionArea=fa.CompressionArea, SteelSection=bs_2.SteelReinforcementSections)
iu = GrossMomentOfInertia(MaterialProperties=read_mp_3, ConcreteSection=bs_2.ConcreteSections, SteelSection=bs_2.SteelReinforcementSections)
ieff = EffectiveMomentOfInertia(
    MomentEnvelopeKNM=lecrv_2.MomentEnvelopeKNM,
    CrackingMomentKNM=mcr,
    GrossMomentOfInertiaM⁴=iu,
    CrackedMomentOfInertiaM⁴=icr)
defss = DisplacementOfSimplySupportedBeam(
    MaterialProperties=read_mp_3,
    MomentEnvelopeKNM=lecrv_2.MomentEnvelopeKNM,
    EffectiveMomentOfInertiaM⁴=ieff,
    SpanCurve=crv_6)  # -> Rotation, DeflectionM
item_4 = ListItem(List=defss.DeflectionM, Index=0, Wrap=True)  # -> Item1, Item
graph = QuickGraph(defss.DeflectionM, SortOrder=0)
graph_2 = QuickGraph(defss.Rotation, SortOrder=0)
panel_6 = Panel(item_4.Item1)
neg_2 = Negative(Value=item_4.Item1)
expression_5 = Expression(dlim=division, dmax=neg_2, Expression="100*(dlim-dmax)/dlim")
deflection_constraint = Panel(expression_5)

# ----
fa_2 = FlexuralAnalysis(
    MaterialProperties=read_mp_2,
    MomentEnvelopeKNM=num_2,
    ConcreteSection=bs.ConcreteSections,
    SteelSection=bs.SteelReinforcementSections,
    SectionSubdivisions=15)  # -> MomentCapacityKNM, CompressionArea
da = DuctilityAnalysis(
    MaterialProperties=read_mp_2,
    ConcreteSection=bs.ConcreteSections,
    SteelSection=bs.SteelReinforcementSections,
    ClearCoverMm=30,
    SectionSubdivisions=15)  # -> ReinforcementRatio, BwCrv, DistanceToTensileReinforcementM, MaxReinforcementRatio, MinReinforcementRatio
sa = ShearAnalysis(
    MaterialProperties=read_mp_2,
    MomentEnvelopeKNM=num_2,
    ShearEnvelopeKN=num,
    DesignShearReinforcementKN=0,
    ConcreteSection=bs.ConcreteSections,
    SteelSection=bs.SteelReinforcementSections,
    ClearCoverMm=30,
    SectionSubdivisions=15)  # -> ShearCapacityKN, BwCrv

# ---- group: effective width constraint
len_2 = Length(Curve=sa.BwCrv)
expression_6 = Expression(hf=merge_6, bw=len_2, b=slab_width_m, Expression="100*((16*hf + bw)-b)/b")
panel_7 = Panel(merge_6)
expression_7 = Expression(hf=merge_6, lim=Slider(0.03, range=0..0.1), Expression="100*(hf-lim)/lim")

# ----
Y = UnitY(Factor=expr("-x", Slider(0, range=0..1000)))
Z_2 = UnitZ(Factor=Slider(0, range=0..1000))
X = UnitX(Factor=Slider(1000, range=0..1000))
addition = Addition(A=Y, B=X, C=Z_2)

abs = Absolute(Value=num_2)
abs_2 = Absolute(Value=fa_2.MomentCapacityKNM)
abs_3 = Absolute(Value=num)
abs_4 = Absolute(Value=sa.ShearCapacityKN)

expression_8 = Expression(rho=da.ReinforcementRatio, rho_max=da.MaxReinforcementRatio, Expression="100*(rho_max-rho)/rho_max")
expression_9 = Expression(rho=da.ReinforcementRatio, rho_min=da.MinReinforcementRatio, Expression="100*(rho-rho_min)/rho_min")
expression_10 = Expression(Mu=abs, Mn=abs_2, Expression="100*(Mn-Mu)/Mn")
expression_11 = Expression(Vu=abs_3, Vn=abs_4, Expression="100*(Vn-Vu)/Vn")

Y_2 = UnitY(Factor=expr("-x", Slider(0, range=0..1000)))
Z_3 = UnitZ(Factor=Slider(0, range=0..1000))
X_2 = UnitX(Factor=Slider(1000, range=0..1000))
addition_2 = Addition(A=X_2, B=Y_2, C=Z_3)

# ---- group: Constraints
num_5 = Number(flatten([expression_10, expression_11, neg, expression_8, expression_9, expression_6, expression_7, expression_5]))

# ----
smaller_2 = SmallerThan(FirstNumber=num_5, SecondNumber=0)  # -> SmallerThan, OrEqualTo
ma = MassAddition(Input=smaller_2.SmallerThan)  # -> Result, PartialResults
panel_8 = Panel(ma.Result)

# ---- group: Variables
num_6 = Number([number_0, number_8, slab_width_m, maximum_depth, number_4_3, number_4_4, number_4_5, number_4, maximum_depth_2, number_4_7, number_4_8, number_4_6, number_4_2])

# ----
addition_3 = Addition(A=addition, B=addition_2)
panel_9 = Panel(num_5)
move = Move(Geometry=capex.Brep, Motion=addition)  # -> Geometry, Transform

# ---- group: Compression members
preview = CustomPreview(Geometry=move.Geometry, Material=ColourSwatch(SwatchColor=RGB(168, 197, 255)))

# ----
resultant_mass_kg = Panel("6418.128969")
resultant_ec = Panel("994.759039")

vol_steel_m3 = Panel("-0.005432")
vol_concrete_m3 = Panel("-2.656")

align = AlignPlanes()
pipeline = GeometryPipeline(
    GroupByLayer=False,
    GroupByType=False,
    IncludeHidden=True,
    IncludeLocked=True,
    LayerFilter="Holes",
    NameFilter="*",
    SublayerFiltering=True,
    TypeFilter=4)
pipeline_2 = GeometryPipeline(
    GroupByLayer=False,
    GroupByType=False,
    IncludeHidden=True,
    IncludeLocked=True,
    LayerFilter="Restricted bars",
    NameFilter="*",
    SublayerFiltering=True,
    TypeFilter=4)
bcx = BrepCurve()  # -> Curves, Points
cross_section = CrossSectionKaramba3D(FamilyNameOfCrossSection="DefaultCroSec", Diameter_cm=11.43, WallThickness_cm=0.4, mode="Circular Hollow")
matprops = MaterialPropertiesKaramba3D(
    FamilyOfMaterial="Steel",
    Name="S235",
    YoungsModulus_kN_cm2=21000,
    InPlaneShearModulus_kN_cm2=8076,
    TransverseShearModulus_kN_cm2=8076,
    SpecificWeight_kN_m3=78.5,
    CoefficientOfThermalExpansion_1_C=1.2e-05,
    TensileStrength_kN_cm2=23.5,
    CompressiveStrength_kN_cm2=-23.5,
    StrengthHypothesis="MISES",
    mode="Isotrop")
Z_4 = UnitZ(Factor="-10")
material = MaterialKaramba3D(matprops)

# ----
# Brep Ground Structure
nx_2 = Slider(5, range=0..20)
nz_2 = Slider(3, range=0..20)
ny_2 = Slider(6, range=0..20)
brep_5 = Brep(capex.Brep)
volume = Volume(Geometry=brep_5)  # -> Volume, Centroid
number_slider_4 = Slider(0.9, range=0..10)
scale = Scale(Geometry=brep_5, Center=volume.Centroid, Factor=number_slider_4)  # -> Geometry, Transform
subtraction = Subtraction(A=nx_2, B=1)
subtraction_2 = Subtraction(A=ny_2, B=1)
subtraction_3 = Subtraction(A=nz_2, B=1)

scale_nu = ScaleNU(Geometry=brep_5, Plane=volume.Centroid, ScaleX=1, ScaleY=number_slider_4, ScaleZ=1)  # -> Geometry, Transform

bbox = BoundingBox(Content=scale_nu.Geometry, Plane=PlaneXY(0, 0, 0))  # -> Box, Box_2
debox = DeconstructBox(Box=bbox.Box)  # -> Plane, X, Y, Z
dedomain = DeconstructDomain(Domain=debox.X)  # -> Start, End
dedomain_2 = DeconstructDomain(Domain=debox.Y)  # -> Start, End
dedomain_3 = DeconstructDomain(Domain=debox.Z)  # -> Start, End
subtraction_4 = Subtraction(A=dedomain.End, B=dedomain.Start)
subtraction_5 = Subtraction(A=dedomain_2.End, B=dedomain_2.Start)
subtraction_6 = Subtraction(A=dedomain_3.End, B=dedomain_3.Start)
division_2 = Division(A=subtraction_4, B=subtraction)
division_3 = Division(A=subtraction_5, B=subtraction_2)
division_4 = Division(A=subtraction_6, B=subtraction_3)
series_2 = Series(Start=dedomain_2.Start, Step=division_3, Count=ny_2)
series_3 = Series(Start=dedomain.Start, Step=division_2, Count=nx_2)
series_4 = Series(Start=dedomain_3.Start, Step=division_4, Count=nz_2)
python_3 = GhPythonScript(x=series_3, y=series_2, z=series_4)  # -> out, a, pts; inputs x: list, y: list, z: list
# ---------- python_3: Python ----------
__author__ = "pitipatw"
__version__ = "2023.04.13"

import rhinoscriptsyntax as rs


nx = len(x)
ny = len(y)
nz = len(z)

np = nx*ny*nz
points = [[[0] * nx] * ny ] * nz
pts = []
for i in range(nx):
    for j in range(ny):
        for k in range(nz):
            #print(x[i],y[j],z[k])
            #pts = rs.AddPoint(x[i], y[j], z[k])
            pts.append(rs.CreatePoint(x[i], y[j], z[k]))
# ---------- end python_3 ----------
pt = Point(python_3.pts)
brepinc = PointInBrep(Brep=scale_nu.Geometry, Point=pt, Strict=False)
cull_2 = CullPattern(List=pt, CullPattern=brepinc)

pt_2 = Point(cull_2)
pt2num = PointsToNumbers(Points=graft(pt_2), Mask=4)  # -> simplify(Numbers)
panel_10 = Panel(pt2num)

# ---- group: Ground Structure
pt_3 = Point(pt_2)

# ---- group: Preprocessing (Adam)
supoprt_points = ListItem(List=pt_3, Index=0, Wrap=True)  # -> Item, Item1, Item2

# ----
pipeline_3 = GeometryPipeline(
    GroupByLayer=False,
    GroupByType=False,
    IncludeHidden=True,
    IncludeLocked=True,
    LayerFilter="Load points",
    NameFilter="*",
    SublayerFiltering=True,
    TypeFilter=1)
pipeline_4 = GeometryPipeline(
    GroupByLayer=False,
    GroupByType=False,
    IncludeHidden=True,
    IncludeLocked=True,
    LayerFilter="Supports (pin)",
    NameFilter="*",
    SublayerFiltering=True,
    TypeFilter=1)
pipeline_5 = GeometryPipeline(
    GroupByLayer=False,
    GroupByType=False,
    IncludeHidden=True,
    IncludeLocked=True,
    LayerFilter="Supports (roller)",
    NameFilter="*",
    SublayerFiltering=True,
    TypeFilter=1)

gs = GhPythonScript(points=pt2num, Lmax=max_members_length, date=concat_3)  # -> out; inputs points: tree
# ---------- gs: Python ----------
__author__ = "pitipatw"
__version__ = "2023.03.10"

import rhinoscriptsyntax as rs
import ghpythonlib.treehelpers as th
import json

# assign static values
output = dict() 
output["model_name"] = "Example_1"
output["unit"] = "meter"
output["generate_time"] = "10PM"

output["model_type"] = "truss"

output["_info"] = "Example1"
output["TO_model_type"] = "ground_mesh"

# Processing Inputs
tree = th.tree_to_list(points, retrieve_base = None)


nodes = dict()
nodes_list = dict()
for i in range(len(tree)):
    nodes_list[i] = tree[i][0:3]

output["nodes"] = nodes_list
output["Lmax"] = Lmax
output["date"] = date
output["stage"] = "GS"
print(json.dumps(output))
# ---------- end gs ----------

panel_11 = Panel(gs)

# ---- group: WebSockets for Julia
server_port = Panel("ws://127.0.0.1:2000/")
websocket_client_start = WebsocketClientStart(Address=server_port, InitalMessage=gs, Reset=groundstruct)
toggle = BooleanToggle(True)

# ----
websocket_client_receiver = WebsocketClientReceiver(WebsocketObjects=websocket_client_start, AutoUpdate=toggle)  # -> Message, Status
python_4 = GhPythonScript(Msg=websocket_client_receiver.Message, points=pt2num)  # -> out, element_starts, element_ends, lines; inputs points: tree
# ---------- python_4: Python ----------
__author__ = "pitipatw"
__version__ = "2023.04.14"

import rhinoscriptsyntax as rs
import ghpythonlib.treehelpers as th
import json

elements = json.loads(Msg)
tree = th.tree_to_list(points, retrieve_base = None)
n = len(elements)
print(n)
print(elements)
lines = list()
element_starts = list()
element_ends = list()
for i in range(n) : 
#    print(str(i+1))
    element_starts.append(elements[str(i+1)][0])
    element_ends.append(elements[str(i+1)][1])
    p1 = rs.AddPoint(tree[elements[str(i+1)][0]])
    p2 = rs.AddPoint(tree[elements[str(i+1)][1]])
    lines.append(rs.AddLine(p1,p2))
# ---------- end python_4 ----------
line = Line(python_4.lines)

# ---- group: Ground Structure (continued)
line_2 = Line(line)

# ---- group: Preprocessing (Adam) (continued)
create = CreateNetwork(
    Edges=flatten(line_2),
    Anchors=[supoprt_points.Item, supoprt_points.Item1, supoprt_points.Item2],
    ForceDensities=1,
    IntersectionTolerance=Slider(0.02, range=0..0.1))
info = NetworkInformation(FDMNetwork=create)  # -> Nodes, Edges, EdgeLengths, StartIndex, EndIndex, Anchors, ForceDensities, NumberEdges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

# ----
support_pin_inds = MemberIndex(Set=info.Nodes, Member=pipeline_3)  # -> simplify(flatten(Index)), Count
support_roller_inds = MemberIndex(Set=info.Nodes, Member=pipeline_5)  # -> simplify(flatten(Index)), Count
support_pin_inds_2 = MemberIndex(Set=info.Nodes, Member=pipeline_4)  # -> simplify(flatten(Index)), Count

lng_3 = ListLength(List=support_pin_inds.Index)
concat_4 = Concatenate(FragmentA="Please input ", FragmentB=lng_3, FragmentC=" load values as [x, y, z] kN")
panel_12 = Panel(concat_4)

roller_supports_inds = Number(support_roller_inds.Index)
supports_inds = Number(support_pin_inds_2.Index)
load_inds = Number(support_pin_inds.Index)

pt2num_2 = PointsToNumbers(Points=graft(info.Nodes), Mask=4)  # -> simplify(Numbers)
panel_13 = Panel(pt2num_2)

# ----
# Python
topopt_python = GhPythonScript(
    elements_i=info.StartIndex,
    elements_j=info.EndIndex,
    points=pt2num_2,
    supports_pin=supports_inds,
    supports_rollery=roller_supports_inds,
    load_points=load_inds,
    load_values=merge_8,
    maxVf=max_volume_fraction,
    date=concat_3,
    ndim=list)  # -> out; inputs elements_i: list, elements_j: list, points: tree, supports_pin: list, supports_rollery: list, load_points: list, load_values: tree
# ---------- topopt_python: Python ----------
__author__ = "pitipatw"
__version__ = "2023.03.10"

import rhinoscriptsyntax as rs
import ghpythonlib.treehelpers as th
import json

# assign static values
output = dict() 
output["date"] = date
output["model_name"] = "Example_1"
output["unit"] = "meter"
output["generate_time"] = "10PM"

output["model_type"] = "truss"

output["_info"] = "Example1"
output["TO_model_type"] = "ground_mesh"
# Processing Inputs
tree = th.tree_to_list(points, retrieve_base = None)

#input materials detail
materials = dict()
materials = [{"G12": 1.0,
            "E": 1.0,
            "name": "DummyMaterial",
            "family": "DummyMaterial",
            "density": 78.5,
            "elem_tags": [],
            "E_unit": "kN/m2",
            "type_name": "ISO",
            "fy": 235000.0,
            "mu": 0.3,
            "density_unit": "kN/m3",
            "fy_unit": "kN/m2",
            "G12_unit": "kN/m2"}]
output["materials"] = materials

#make a default of 2 but then able to put in 3
output["dimension"] = ndim


cross_secs = dict() 
cross_secs["A"] = 1 
cross_secs["name"] = ""
cross_secs["family"] = "DummyCroSecByPitipat"
cross_secs["elem_tags"] = []
cross_secs["A_unit"] = "m2" 
cross_secs["Iy"]= 2.1106547193827362e-06
cross_secs["Iz"]= 2.1106547193827362e-06
cross_secs["Jx"]= 4.2213094387654724e-06
cross_secs["name"]= "ex1"
output["cross_secs"] = [cross_secs]


nodes = dict()
nodes_list = list()
for i in range(len(tree)):
    dummy = dict()
    dummy["node_ind"] = i
    dummy["point"] = tree[i][0:3]
    dummy["is_grounded"] = False
    nodes_list.append(dummy)

output["nodes"] = nodes_list
elements_list = list() 
for i in range(len(elements_i)) : 
    dummy = dict() 
    dummy["elem_ind"] = i
    dummy["end_node_inds"] = [ elements_i[i], elements_j[i]]
    dummy["elem_tag"] = ""
    dummy["bending_stiff"] = False
    elements_list.append(dummy)

supports_list = list()

check = True
for i in supports_pin:
    dummy = dict()
    dummy["node_ind"] = int(i)
    dummy["condition"] = [1,1,1,0,0,0] # pin x y z
    supports_list.append(dummy)
        
for i in supports_rollery :
    dummy = dict()
    dummy["node_ind"] = int(i)
    dummy["condition"] = [0,1,0,0,0,0] #
    supports_list.append(dummy)

for i in range(len(tree)): 
    if i not in supports_rollery:
        if i not in supports_pin:
            dummy = dict()
            dummy["node_ind"] = int(i)
            dummy["condition"] = [0,0,0,0,0,0] # roller on y
            supports_list.append(dummy)

output["supports"] = supports_list


output["joints"] = []

load_value_list = th.tree_to_list(load_values, retrieve_base = None)

loadcases_dict = dict()
#this is load case "0"
loadcases_0 = dict()
loadcases_0["lc_ind"] = 0
ploads = dict()
load_list = list()
for i in range(len(load_points)) :
    dummy = dict()
    dummy["node_ind"] = load_points[i]
    if i > (len(load_value_list)-1) : 
        x = 0.0
        y = 0.0 
        z = -10.0
    else:
#        continue
        [x,y,z] = load_value_list[i]
    dummy["force"]  = [int(x),int(y),int(z)]
    dummy["moment"] = [0.0, 0.0, 0.0] #No moment for now
    dummy["loadcase"] = str(i)
    dummy["force_unit"] = "kN"
    load_list.append(dummy)
loadcases_0["ploads"] = load_list
loadcases_0["eloads"] = []
loadcases_0["gravity"] = ""
loadcases_dict["0"] = loadcases_0

output["loadcases"] = loadcases_dict


output["elements"] = elements_list

#====Node and Element numbers are here!====
output["node_num"] = len(tree)
output["element_num"] = len(elements_list) 
#====

output["maxVf"] = maxVf
output["stage"] = "Opt"
print(json.dumps(output))
# ---------- end topopt_python ----------

# ---- group: WebSockets for Julia (continued)
websocket_client_start_2 = WebsocketClientStart(Address=server_port, InitalMessage=topopt_python, Reset=optimization)
websocket_client_receiver_2 = WebsocketClientReceiver(WebsocketObjects=websocket_client_start_2, AutoUpdate=toggle)  # -> Message, Status
panel_14 = Panel(websocket_client_receiver_2.Status)
panel_15 = Panel(websocket_client_receiver_2.Message)

# ---- group: Loads Visualization
item_5 = ListItem(List=info.Nodes, Index=load_inds, Wrap=True)
cone = Cone(Base=item_5, Radius=0.1, Length=expr("x/100", z_kn))  # -> Cone, Tip
move_2 = Move(Geometry=cone.Cone, Motion=Vector(0, 0, 0.1))  # -> Geometry, Transform
preview_2 = CustomPreview(Geometry=move_2.Geometry, Material=ColourSwatch(SwatchColor=RGB(255, 64, 64)))

# ---- group: Supports Visualization
item_6 = ListItem(List=info.Nodes, Index=supports_inds, Wrap=True)
cone_2 = Cone(Base=item_6, Radius=number_slider_3, Length=number_slider_3)  # -> Cone, Tip
preview_3 = CustomPreview(Geometry=cone_2.Cone, Material=ColourSwatch(SwatchColor=RGB(64, 255, 175)))

item_7 = ListItem(List=info.Nodes, Index=roller_supports_inds, Wrap=True)
cone_3 = Cone(Base=item_7, Radius=number_slider_3, Length=number_slider_3)  # -> Cone, Tip
preview_4 = CustomPreview(Geometry=cone_3.Cone, Material=ColourSwatch(SwatchColor=RGB(64, 86, 255)))

# ----
python_5 = GhPythonScript(input=websocket_client_receiver_2.Message, points=pt2num_2)  # -> out, output, lines, pos_areas, stresses; inputs points: tree
# ---------- python_5: Python ----------
__author__ = "pitipatw"
__version__ = "2023.01.24"

import rhinoscriptsyntax as rs
import ghpythonlib.treehelpers as th
import json

tree= th.tree_to_list(points, retrieve_base = None)
#print(list_points)
data = json.loads(input)

n = len(data["Elements"])
elements = data["Elements"]
areas = data["Area"]
pos_areas = []
stresses = []
lines = []
for i in range(n) : 
    if areas[i] > 0.001: 
        p1 = rs.AddPoint(tree[elements[str(i+1)][0]-1])
        p2 = rs.AddPoint(tree[elements[str(i+1)][1]-1])
        lines.append(rs.AddLine(p1,p2))
        pos_areas.append(areas[i])
        stresses.append(data["Stress"][i])
# ---------- end python_5 ----------
panel_16 = Panel(python_4.lines)

curvepoint_3 = PointOnCurve(python_5.lines, parameter=0)
curvepoint_4 = PointOnCurve(python_5.lines, parameter=1)
expression_12 = Expression(x=python_5.pos_areas, Expression="sqrt(x/pi)")
vec2pt = Vector2Pt(PointA=curvepoint_3, PointB=curvepoint_4, Unitize=False)  # -> Vector, Length
vlen = VectorLength(Vector=vec2pt.Vector)
multiplication_5 = Multiplication(A=expression_12, B=Slider(2, range=0..10))
line_3 = LineSDL(Start=curvepoint_3, Direction=vec2pt.Vector, Length=vlen)
pl = PlaneNormal(Origin=curvepoint_3, ZAxis=vec2pt.Vector)
cylinder = CylinderExtrusion(Plane=pl, Radius=multiplication_5, Height=vlen, Cap=True)

larger = LargerThan(FirstNumber=python_5.stresses, SecondNumber=Slider(0, range=0..5))  # -> LargerThan, OrEqualTo
invbool = InvertBoolean(Boolean=larger.LargerThan)  # -> Inverted, Number
move_3 = Move(Geometry=cylinder, Motion=addition)  # -> Geometry, Transform
cull_3 = CullPattern(List=move_3.Geometry, CullPattern=invert(larger.LargerThan))
cull_4 = CullPattern(List=move_3.Geometry, CullPattern=larger.LargerThan)
cull_5 = CullPattern(List=move_3.Geometry, CullPattern=invbool.Inverted)
move_4 = Move(Geometry=cull_5, Motion=addition_2)  # -> Geometry, Transform

# ---- group: Compression members
preview_5 = CustomPreview(Geometry=move_4.Geometry, Material=ColourSwatch(SwatchColor=RGB(255, 0, 0)))

# ----
move_5 = Move(Geometry=cull_4, Motion=addition_2)  # -> Geometry, Transform

# ---- group: Compression members
preview_6 = CustomPreview(Geometry=move_5.Geometry, Material=ColourSwatch(SwatchColor=RGB(0, 85, 255)))

# ---- group: Bake
merge_9 = Merge(Data1=move_4.Geometry, Data2=move_5.Geometry)

# ----
item_8 = ListItem(List=info.Nodes, Index=info.EndIndex, Wrap=True)
python_6 = GhPythonScript(input=websocket_client_receiver.Message, points=pt2num_2)  # -> out, output; inputs points: tree
# ---------- python_6: Python ----------
__author__ = "pitipatw"
__version__ = "2023.01.24"

import rhinoscriptsyntax as rs
import ghpythonlib.treehelpers as th
import json


output = []
list_points= th.tree_to_list(points, retrieve_base = None)
print(list_points)
dictofelements = json.loads(input)
for i in range(len(dictofelements)):
    temp = (dictofelements[str(i)])
    #, points[i])
    output.append(temp)
    
    
print(output[1])
print(output)
# ---------- end python_6 ----------
item_9 = ListItem(List=info.Nodes, Index=info.StartIndex, Wrap=True)
vec2pt_2 = Vector2Pt(PointA=item_9, PointB=item_8, Unitize=False)  # -> Vector, Length
larger_2 = LargerThan(FirstNumber=python_5.output, SecondNumber=0)  # -> LargerThan, OrEqualTo
cull_6 = CullPattern(List=item_9, CullPattern=larger_2.LargerThan)
cull_7 = CullPattern(List=vec2pt_2.Vector, CullPattern=larger_2.LargerThan)
cull_8 = CullPattern(List=vec2pt_2.Length, CullPattern=larger_2.LargerThan)
division_5 = Division(A=python_5.output, B=Slider(45, range=10..100))
cull_9 = CullPattern(List=division_5, CullPattern=larger_2.LargerThan)
multiplication_6 = Multiplication(A=cull_9, B=5)
circle = CircleCNR(Center=cull_6, Normal=cull_7, Radius=cull_9)
rectangle = Rectangle(Plane=cull_6, XSize=multiplication_6, YSize=multiplication_6, Radius=0)  # -> Rectangle, Length
orient = Orient(Geometry=rectangle.Rectangle, Source=cull_7, Target=PlaneXY(0, 0, 0))  # -> Geometry, Transform
extr = Extrude(Base=circle, Direction=cull_7)
extr_2 = Extrude(Base=rectangle.Rectangle, Direction=cull_7)
preview_7 = CustomPreview(Geometry=extr, Material=ColourSwatch(SwatchColor=RGB(0, 55, 255)))
fsim = FindSimilarMember(Data=line_2, Set=pipeline_2)  # -> Hit, Index
index = ItemIndex(List=line_2, Item=pipeline_2)
item_10 = ListItem(List=info.Nodes, Index=support_pin_inds_2.Index, Wrap=True)

crv_7 = Curve(pipeline_2)  # disabled
curvepoint_5 = PointOnCurve(crv_7, parameter=1)  # disabled
curvepoint_6 = PointOnCurve(crv_7, parameter=0)  # disabled
crv_8 = Curve(info.Edges)  # disabled
mindex = MemberIndex(Set=info.Nodes, Member=curvepoint_5)  # -> graft(Index), Count; disabled
curvepoint_7 = PointOnCurve(crv_8, parameter=1)  # disabled
curvepoint_8 = PointOnCurve(crv_8, parameter=0)  # disabled
mindex_2 = MemberIndex(Set=info.Nodes, Member=curvepoint_6)  # -> graft(Index), Count; disabled
merge_10 = Merge(Data1=mindex_2.Index, Data2=mindex.Index)  # -> simplify(Result); disabled
mindex_3 = MemberIndex(Set=info.Nodes, Member=curvepoint_7)  # -> flatten(Index), Count; disabled
mindex_4 = MemberIndex(Set=info.Nodes, Member=curvepoint_8)  # -> flatten(Index), Count; disabled
equals_2 = Equality(FirstNumber=mindex_2.Index, SecondNumber=mindex_4.Index)  # -> Equality, Inequality; disabled
equals_3 = Equality(FirstNumber=mindex.Index, SecondNumber=mindex_3.Index)  # -> Equality, Inequality; disabled
panel_17 = Panel("1")  # disabled
panel_18 = Panel([mindex_2.Index, mindex.Index])  # disabled
panel_19 = Panel(merge_10)  # disabled
multiplication_7 = Multiplication(A=equals_2.Equality, B=equals_3.Equality)  # -> simplify(Result); disabled
index_2 = ItemIndex(List=simplify(equals_2.Equality), Item=panel_17)  # disabled
fsim_2 = FindSimilarMember(Data=simplify(multiplication_7), Set=panel_17)  # -> Hit, Index; disabled
mindex_5 = MemberIndex(Set=multiplication_7, Member=panel_17)  # -> Index, Count; disabled
ma_2 = MassAddition(Input=multiplication_7)  # -> Result, PartialResults; disabled
panel_20 = Panel(fsim_2.Hit)  # disabled

line_4 = LineSDL(Start=cull_6, Direction=cull_7, Length=cull_8)
supp_3 = SupportKaramba3D(PosInd=item_10, menu=[buttons(on, on, on, off, off, off)])
item_11 = ListItem(List=info.Nodes, Index=support_pin_inds.Index, Wrap=True)
explode = Explode(Curve=line_4, Recursive=True)  # -> Segments, Vertices
loads_2 = LoadsKaramba3D(ForceVector=Z_4, Local=False, PosInd=item_11, LCase="0", mode="Point")
duppt_2 = RemoveDuplicatePts(Points=flatten(explode.Vertices), Tolerance=0.01)
linetobeam_2 = LineToBeamKaramba3D(
    Line=line_4,
    New=True,
    Remove=True,
    LimitDistance_m=0.005,
    Bending=True,
    SetBucklingLength=True,
    ToPolylineMaxAngle=0.03,
    ToPolylineTolerance=0.01,
    ToPolylineMaxEdgeLength=0.25)  # -> Element, Points, Info
support = SupportKaramba3D(supp_3)
load = LoadKaramba3D(loads_2)
assemble_2 = AssembleModelKaramba3D(
    Point=duppt_2,
    Elem=linetobeam_2.Element,
    Support=support,
    Load=load,
    CrossSection=cross_section,
    Material=material,
    LimitDistance_m=0.005)  # -> Model, Info, Mass_kg, CenterOfGravity, LoadCaseNames
analyze_2 = AnalyzeKaramba3D(Model=assemble_2.Model)  # -> CalculatedModel, MaximumDisplacement_cm, ResultingForceOfGravity_kN, ElasticEnergyChange_kNm
b_forces_2 = BeamForcesKaramba3D(AnalyzedModel=analyze_2.CalculatedModel, Ts=[0, 1])  # -> AnalyzedModel, NormalForce_kN, ShearForceVz_kN, ShearForceVy_kN, TorsionalMomentMt_kNm, BendingMomentMy_kNm, BendingMomentMz_kNm

ee = TotalEmbodiedEnergy(MaterialProperties=read_mp_2, ConcreteSection=bs.ConcreteSections, SteelSection=bs.SteelReinforcementSections)  # -> EmbodiedEnergyMJ, TotalMassKg, SteelAndConcreteBreps
brep_6 = Brep(ee.SteelAndConcreteBreps)

division_6 = Division(A=long_span_m, B=slab_width_m)
Y_3 = UnitY(Factor=slab_width_m)
of_slabs = Panel(division_6)
arrlinear = LinearArray(Geometry=brep_6, Direction=Y_3, Count=division_6)  # -> Geometry, Transform
# 4 | Visualization
preview_8 = CustomPreview(Geometry=arrlinear.Geometry, Material=ColourSwatch(SwatchColor=RGBA(125, 119, 115, 178)))

num_7 = Number(division_6)
multiplication_8 = Multiplication(A=num_7, B=ee.EmbodiedEnergyMJ)

# ---- group: Objective
num_8 = Number(multiplication_8)

# ----
radical = Radical(
    Objective=num_8,
    Constraints=num_5,
    NumericalVariables=[number_0, number_8, slab_width_m, maximum_depth, number_4_3, number_4_4, number_4_5, number_4, maximum_depth_2, number_4_7, number_4_8, number_4_6, number_4_2])  # -> ObjectiveEvolution, Var, GradientEvolution

# ---- group: Material volumes
volume_2 = Volume(Geometry=brep_6)  # -> Volume, Centroid
multiplication_9 = Multiplication(A=num_7, B=volume_2.Volume)
item_12 = ListItem(List=multiplication_9, Index=0, Wrap=True)  # -> Item, Item1
panel_21 = Panel(item_12.Item1)
panel_22 = Panel(item_12.Item)

# ----
multiplication_10 = Multiplication(A=num_7, B=ee.TotalMassKg)
resultant_ee = Panel("2497.801029")
# 5 | Evaluation
resultant_ee_2 = Panel(num_8)
resultant_mass_kg_2 = Panel(multiplication_10)

expression_13 = Expression(x=panel_22, y=vol_concrete_m3, Expression="Format(\"{0:0}\", (y-x)/y*100) & \"% Concrete Reduction\"")
expression_14 = Expression(x=panel_21, y=vol_steel_m3, Expression="Format(\"{0:0}\", (y-x)/y*100) & \"% Steel Reduction\"")
panel_23 = Panel(expression_14)
panel_24 = Panel(expression_13)

expression_15 = Expression(x=resultant_ee_2, y=resultant_ec, Expression="\", \" & Format(\"{0:0}\", (y-x)/y*100) & \"% EC Reduction\"")
expression_16 = Expression(x=resultant_mass_kg_2, y=resultant_mass_kg, Expression="Format(\"{0:0}\", (y-x)/y*100) & \"% Mass Reduction\"")
panel_25 = Panel(expression_16)
panel_26 = Panel(expression_15)

# ---- group: Result Visualization
expression_17 = Expression(x=multiplication_8, Expression="Format(\"{0:0.0}\", x) & \" kg CO2\"")
curvepoint_9 = PointOnCurve(crv_3, parameter=0.5)
Z_5 = UnitZ(Factor=Slider(0.25, range=0..1))
move_6 = Move(Geometry=curvepoint_9, Motion=Z_5)  # -> Geometry, Transform
xz_2 = XZPlane(Origin=move_6.Geometry)

# ----
concat_5 = Concatenate(FragmentA=expression_17, FragmentB=expression_15)
panel_27 = Panel(expression_17)

# ---- group: Result Visualization (continued)
tag = TextTag3D(Location=xz_2, Text=concat_5, Size=Slider(0.14, range=0..1), Justification=5)
