# Grasshopper definition ModelInput.gh (Grasshopper 1.0.7)
# plug-ins: FDMremote, Kangaroo2 Components, Karamba3D, MetaHopper

# ---- group: OLD
number_slider = Slider(1, range=1..52)  # disabled
number_slider_2 = Slider(1, range=0..101)  # disabled
extent_z = Slider(1, range=1..51)  # disabled

# ----
geo = Geometry(<brep referenced from the Rhino model>)
volume = Volume(Geometry=geo)  # -> Volume, Centroid
circle = CircleCNR(Center=volume.Centroid, Normal=Vector(0, 0, 1), Radius=Slider(4.318, range=0..10))
qrsettings = QuadRemeshSettings(TargetCount="100", AdaptiveSize=0, AdaptiveCount=False, HardEdges=False, SeamEdges=0, Symmetry=0, GuideCurves=0)
area = Area(Geometry=circle)  # -> Area, Centroid
divide = DivideCurve(Curve=circle, Count="1", Kinks=False)  # -> Points, Tangents, Parameters
mesh = MeshBrep(
    Brep=geo,
    Settings={GridMaxCount=0, GridMinCount=16, JaggedSeams=False, MaxEdgeLength=0, MinEdgeLength=0.0001, MinTolerance=0, Refine=True, RefineAngle=0, RelativeTolerance=0.65, SimplePlanes=True, Tolerance=0})
ln = Line(StartPoint=area.Centroid, EndPoint=divide.Points)
qrmesh = QuadRemesh(Mesh=mesh, Settings=qrsettings)
len = Length(Curve=ln)
demesh = DeconstructMesh(Mesh=qrmesh)  # -> Vertices, Faces, Colours, Normals
pdecon = Deconstruct(Point=area.Centroid)  # -> XComponent, YComponent, ZComponent
pt = Point(demesh.Vertices)
expression = Expression(
    x0=pdecon.XComponent,
    y0=pdecon.YComponent,
    r=len,
    tol=Slider(0.25, range=0..1),
    Expression="(x-x0)^2 + (y-y0)^2 - r^2 > tol")
inter = InterconnectPoints(Pts=flatten(pt))  # disabled
panel = Panel(expression)

# ---- group: Adam's
nz = Slider(1, range=0..10)
# 5 4 6
# 0.27
# "2"
# 0.27
# fail
nx = Slider(9, range=0..10)
ny = Slider(5, range=0..10)
lz = Slider(1, range=0..100)
ly = Slider(4, range=0..100)
lx = Slider(8, range=0..100)
expression_2 = Expression(L=lx, x=nx, Expression="L/(x-1)")
python = GhPythonScript(L=ly, x=lz)  # -> out, a
# ---------- python: Python ----------
__author__ = "pitipatw"
__version__ = "2023.03.10"

import rhinoscriptsyntax as rs

if x==1 :
    a = 0
else:
    a = L/(x-1)
# ---------- end python ----------
python_2 = GhPythonScript(L=ly, x=ny)  # -> out, a; same code as python
origin_point = ConstructPoint(XCoordinate=0, YCoordinate=0, ZCoordinate=0)
box = CenterBox(Base=PlaneXY(0, 0, 0), X=expr("x/2", expression_2), Y=expr("x/2", python_2.a), Z=expr("x/2", python.a))
arrbox = BoxArray(Geometry=origin_point, Cell=box, XCount=nx, YCount=ny, ZCount=nz)  # -> Geometry, Transform

# ---- group: TopOpt Control
max_members_length = Slider(100, range=0..100)
# This is a Topology Optimization using TopOpt.jl
# 
# last major modified: 10 Feb 2023
# Control Panel
button = Button()
gs_visibility = BooleanToggle(True)
max_volume_fraction = Slider(200, range=0.005..10000.005)
list = ValueList({"2D": 2, "3D": 3}, selected="3D")

# ---- group: OLD
recgrid = Rectangular(Plane=PlaneXY(0, 0, 0), SizeX=1, SizeY=1, ExtentX=number_slider, ExtentY=number_slider_2)  # -> flatten(Cells), flatten(Points); disabled
series = Series(Start=1, Step=1, Count=extent_z)  # disabled
Z = UnitZ(Factor=series)  # -> graft(UnitVector); disabled
move = Move(Geometry=recgrid.Cells, Motion=Z)  # -> Geometry, Transform; disabled
move_2 = Move(Geometry=recgrid.Points, Motion=Z)  # -> Geometry, Transform; disabled
line = LineSDL(Start=move_2.Geometry, Direction=Vector(0, 0, -1), Length=1)  # disabled
merge = Merge(Data1=flatten(move.Geometry), Data2=recgrid.Cells, Data3=flatten(line))  # disabled
explode = Explode(Curve=merge, Recursive=True)  # -> Segments, flatten(Vertices); disabled
duppt = RemoveDuplicatePts(Points=explode.Vertices, Tolerance=0.01)  # disabled
inter_2 = InterconnectPoints(Pts=flatten(pt))  # disabled
len_2 = Length(Curve=inter_2)  # disabled
smaller = SmallerThan(FirstNumber=len_2, SecondNumber=max_members_length)  # -> SmallerThan, OrEqualTo; disabled
# 5 4 6
# 0.27
# 3
# 0.27
# pass
cull = CullPattern(List=inter_2, CullPattern=smaller.SmallerThan)  # disabled

# ----
# If 2D then put a z axis constriain on every node
length_limit = BooleanToggle(True)
pipeline = GeometryPipeline(
    GroupByLayer=False,
    GroupByType=False,
    IncludeHidden=True,
    IncludeLocked=True,
    LayerFilter="L1",
    NameFilter="*",
    SublayerFiltering=True,
    TypeFilter=1)
pipeline_2 = GeometryPipeline(
    GroupByLayer=False,
    GroupByType=False,
    IncludeHidden=True,
    IncludeLocked=True,
    LayerFilter="L2",
    NameFilter="*",
    SublayerFiltering=True,
    TypeFilter=1)
pipeline_3 = GeometryPipeline(
    GroupByLayer=False,
    GroupByType=False,
    IncludeHidden=True,
    IncludeLocked=True,
    LayerFilter="L3",
    NameFilter="*",
    SublayerFiltering=True,
    TypeFilter=1)
pipeline_4 = GeometryPipeline(
    GroupByLayer=False,
    GroupByType=False,
    IncludeHidden=True,
    IncludeLocked=True,
    LayerFilter="5",
    NameFilter="*",
    SublayerFiltering=True,
    TypeFilter=1)
pipeline_5 = GeometryPipeline(
    GroupByLayer=False,
    GroupByType=False,
    IncludeHidden=True,
    IncludeLocked=True,
    LayerFilter="L4",
    NameFilter="*",
    SublayerFiltering=True,
    TypeFilter=1)
pipeline_6 = GeometryPipeline(
    GroupByLayer=False,
    GroupByType=False,
    IncludeHidden=True,
    IncludeLocked=True,
    LayerFilter="R1",
    NameFilter="*",
    SublayerFiltering=True,
    TypeFilter=1)
pipeline_7 = GeometryPipeline(
    GroupByLayer=False,
    GroupByType=False,
    IncludeHidden=True,
    IncludeLocked=True,
    LayerFilter="R2",
    NameFilter="*",
    SublayerFiltering=True,
    TypeFilter=1)
pipeline_8 = GeometryPipeline(
    GroupByLayer=False,
    GroupByType=False,
    IncludeHidden=True,
    IncludeLocked=True,
    LayerFilter="Output",
    NameFilter="*",
    SublayerFiltering=True,
    TypeFilter=4)

# ---- group: Remove Dups
# To do
# 
# visualize support points
# 
# Specified applied load values
# 
# 
# 
# movable points (optional: movable groundstructure)
# 
# color
# 
# Specify domain size
# and the nX,nY,nZ are divisions instead of keep adding
inter_3 = InterconnectPoints(Pts=arrbox.Geometry)
duppt_2 = RemoveDuplicatePts(Points=arrbox.Geometry, Tolerance=0.01)

# ----
inter_4 = InterconnectPoints(Pts=pipeline)
inter_5 = InterconnectPoints(Pts=pipeline_2)
inter_6 = InterconnectPoints(Pts=pipeline_3)
inter_7 = InterconnectPoints(Pts=pipeline_4)
inter_8 = InterconnectPoints(Pts=pipeline_5)
inter_9 = InterconnectPoints(Pts=pipeline_7)
inter_10 = InterconnectPoints(Pts=pipeline_6)

# ---- group: Length Constraint
len_3 = Length(Curve=inter_3)
smaller_2 = SmallerThan(FirstNumber=len_3, SecondNumber=max_members_length)  # -> SmallerThan, OrEqualTo
cull_2 = CullPattern(List=inter_3, CullPattern=smaller_2.SmallerThan)

# ----
merge_2 = Merge(
    Data1=inter_4,
    Data2=inter_5,
    Data3=inter_6,
    Data4=inter_8,
    Data5=inter_7,
    Data6=inter_10,
    Data7=inter_9,
    Data8=pipeline_8)
dupln = RemoveDuplicateLines(Lines=merge_2, Tolerance=0.01)
explode_2 = Explode(Curve=dupln, Recursive=True)  # -> Segments, flatten(Vertices)
filter = StreamFilter(Gate=length_limit, Stream0=inter_3, Stream1=cull_2)
pt_2 = Point(explode_2.Vertices)
bake = BakeObject(Bake=Button(), AllObjects_Object=pt_3)

# ---- group: Ground Structure
pt_3 = Point(explode_2.Vertices)
line_2 = Line(dupln)

# ----
pipeline_9 = GeometryPipeline(
    GroupByLayer=False,
    GroupByType=False,
    IncludeHidden=True,
    IncludeLocked=True,
    LayerFilter="Load points",
    NameFilter="*",
    SublayerFiltering=True,
    TypeFilter=1)
onoff = EnableDisableObject(Enabled=length_limit, AllObjects_Object=[smaller_2, cull_2, len_3])

# ---- group: Preprocessing
supoprt_points = ListItem(List=pt_3, Index=0, Wrap=True)  # -> Item, Item1, Item2, Item3, Item4, Item5, Item6, Item7
create = CreateNetwork(
    Edges=flatten(line_2),
    Anchors=[supoprt_points.Item6, supoprt_points.Item3, supoprt_points.Item7],
    ForceDensities=1,
    IntersectionTolerance=0.1)
info = NetworkInformation(FDMNetwork=create)  # -> Nodes, Edges, EdgeLengths, StartIndex, EndIndex, Anchors, ForceDensities, NumberEdges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

# ----
pt_4 = Point([<point referenced from the Rhino model> x120])
pipeline_10 = GeometryPipeline(
    GroupByLayer=False,
    GroupByType=False,
    IncludeHidden=True,
    IncludeLocked=True,
    LayerFilter="Support (pin)",
    NameFilter="*",
    SublayerFiltering=True,
    TypeFilter=1)
pipeline_11 = GeometryPipeline(
    GroupByLayer=False,
    GroupByType=False,
    IncludeHidden=True,
    IncludeLocked=True,
    LayerFilter="Support (roller)",
    NameFilter="*",
    SublayerFiltering=True,
    TypeFilter=1)

# ---- group: background
hideshow = HideShowObjectPreview(Visible=gs_visibility, AllObjects_Object=line_2)

# ----
item = ListItem(List=line_2, Index=Slider(1, range=0..36), Wrap=True)
support_roller_inds = MemberIndex(Set=info.Nodes, Member=pipeline_11)  # -> simplify(flatten(Index)), Count
load = MemberIndex(Set=info.Nodes, Member=pt_4)  # -> simplify(flatten(Index)), Count
support_pin_inds = MemberIndex(Set=info.Nodes, Member=pipeline_10)  # -> simplify(flatten(Index)), Count
panel_2 = Panel(support_roller_inds.Index)
x_kn = Panel("""1
1""")
y_kn = Panel("""0
0""")
z_kn = Panel("0")
item_2 = ListItem(List=info.Nodes, Index=info.StartIndex, Wrap=True)
lng = ListLength(List=load.Index)
item_3 = ListItem(List=info.Nodes, Index=info.EndIndex, Wrap=True)
filter_2 = StreamFilter(Gate=list)
concat = Concatenate(FragmentA="Please input ", FragmentB=lng, FragmentC=" load values as [x, y, z] kN")
panel_3 = Panel(concat)
merge_3 = Merge(Data1=graft(x_kn), Data2=graft(y_kn), Data3=graft(y_kn))  # -> simplify(Result)
panel_4 = Panel(merge_3)
pt2num = PointsToNumbers(Points=graft(info.Nodes), Mask=4)  # -> simplify(Numbers)
time = Time()
Y = UnitY(Factor=Slider(6, range=0..20))
move_3 = Move(Geometry=line_2, Motion=Y)  # -> Geometry, Transform
supports_inds = Number(support_pin_inds.Index)
load_inds = Number(load.Index)

# ---- group: Loads Visualization
item_4 = ListItem(List=info.Nodes, Index=load_inds, Wrap=True)
cone = Cone(Base=item_4, Radius=0.1, Length=expr("x/100", z_kn))  # -> Cone, Tip
move_4 = Move(Geometry=cone.Cone, Motion=Vector(0, 0, 0.1))  # -> Geometry, Transform
preview = CustomPreview(Geometry=move_4.Geometry, Material=ColourSwatch(SwatchColor=RGB(255, 64, 64)))

# ---- group: Supports Visualization
item_5 = ListItem(List=info.Nodes, Index=supports_inds, Wrap=True)
cone_2 = Cone(Base=item_5, Radius=0.1, Length=0.1)  # -> Cone, Tip
preview_2 = CustomPreview(Geometry=cone_2.Cone, Material=ColourSwatch(SwatchColor=RGB(64, 255, 175)))

# ----
python_3 = GhPythonScript(
    elements_i=info.StartIndex,
    elements_j=info.EndIndex,
    points=pt2num,
    supports_pin=supports_inds,
    supports_rollery=support_roller_inds.Index,
    load_points=load_inds,
    load_values=merge_3,
    maxVf=max_volume_fraction,
    time=time,
    ndim=list)  # -> out; inputs elements_i: list, elements_j: list, points: tree, supports_pin: list, supports_rollery: list, load_points: list, load_values: tree
# ---------- python_3: Python ----------
__author__ = "pitipatw"
__version__ = "2023.03.10"

import rhinoscriptsyntax as rs
import ghpythonlib.treehelpers as th
import json

# assign static values
output = dict() 
output["model_name"] = "Example_1"
output["unit"] = "meter"
output["generate_time"] = "10PM"

output["model_type"] = "truss"

output["_info"] = "Example1"
output["TO_model_type"] = "ground_mesh"
# Processing Inputs
tree = th.tree_to_list(points, retrieve_base = None)

#input materials detail
materials = dict()
materials = [{"G12": 1.0,
            "E": 1.0,
            "name": "DummyMaterial",
            "family": "DummyMaterial",
            "density": 78.5,
            "elem_tags": [],
            "E_unit": "kN/m2",
            "type_name": "ISO",
            "fy": 235000.0,
            "mu": 0.3,
            "density_unit": "kN/m3",
            "fy_unit": "kN/m2",
            "G12_unit": "kN/m2"}]
output["materials"] = materials

#make a default of 2 but then able to put in 3
output["dimension"] = ndim


cross_secs = dict() 
cross_secs["A"] = 1 
cross_secs["name"] = ""
cross_secs["family"] = "DummyCroSecByPitipat"
cross_secs["elem_tags"] = []
cross_secs["A_unit"] = "m2" 
cross_secs["Iy"]= 2.1106547193827362e-06
cross_secs["Iz"]= 2.1106547193827362e-06
cross_secs["Jx"]= 4.2213094387654724e-06
cross_secs["name"]= "ex1"
output["cross_secs"] = [cross_secs]


nodes = dict()
nodes_list = list()
for i in range(len(tree)):
    dummy = dict()
    dummy["node_ind"] = i
    dummy["point"] = tree[i][0:3]
    dummy["is_grounded"] = False
    nodes_list.append(dummy)

output["nodes"] = nodes_list
elements_list = list() 
for i in range(len(elements_i)) : 
    dummy = dict() 
    dummy["elem_ind"] = i
    dummy["end_node_inds"] = [ elements_i[i], elements_j[i]]
    dummy["elem_tag"] = ""
    dummy["bending_stiff"] = False
    elements_list.append(dummy)

supports_list = list()

check = True
for i in supports_pin:
    dummy = dict()
    dummy["node_ind"] = int(i)
    dummy["condition"] = [1,1,1,1,1,1] # pin x y z
    supports_list.append(dummy)
        
for i in supports_rollery :
    dummy = dict()
    dummy["node_ind"] = int(i)
    dummy["condition"] = [1,0,1,0,0,0] # roller on y
    supports_list.append(dummy)

for i in range(len(tree)): 
    if i not in supports_rollery:
        if i not in supports_pin:
            dummy = dict()
            dummy["node_ind"] = int(i)
            dummy["condition"] = [0,0,1,0,0,0] # roller on y
            supports_list.append(dummy)

output["supports"] = supports_list


output["joints"] = []

load_value_list = th.tree_to_list(load_values, retrieve_base = None)

loadcases_dict = dict()
#this is load case "0"
loadcases_0 = dict()
loadcases_0["lc_ind"] = 0
ploads = dict()
load_list = list()
for i in range(len(load_points)) :
    dummy = dict()
    dummy["node_ind"] = load_points[i]
    if i > (len(load_value_list)-1) : 
        x = -1.0
        y = 0.0 
        z = 0.0
    else:
        [x,y,z] = load_value_list[i]
    dummy["force"]  = [int(x),int(y),int(z)]
    dummy["moment"] = [0.0, 0.0, 0.0] #No moment for now
    dummy["loadcase"] = str(i)
    dummy["force_unit"] = "kN"
    load_list.append(dummy)
loadcases_0["ploads"] = load_list
loadcases_0["eloads"] = []
loadcases_0["gravity"] = ""
loadcases_dict["0"] = loadcases_0

output["loadcases"] = loadcases_dict


output["elements"] = elements_list

#====Node and Element numbers are here!====
output["node_num"] = len(tree)
output["element_num"] = len(elements_list) 
#====

output["maxVf"] = maxVf
output["stage"] = "Opt"
print(json.dumps(output))
# ---------- end python_3 ----------
vec2pt = Vector2Pt(PointA=item_2, PointB=item_3, Unitize=False)  # -> Vector, Length
align = AlignPlanes()
cross_section = CrossSectionKaramba3D(FamilyNameOfCrossSection="DefaultCroSec", Diameter_cm=11.43, WallThickness_cm=0.4, mode="Circular Hollow")
item_6 = ListItem(List=info.Nodes, Index=support_pin_inds.Index, Wrap=True)
matprops = MaterialPropertiesKaramba3D(
    FamilyOfMaterial="Steel",
    Name="S235",
    YoungsModulus_kN_cm2=21000,
    InPlaneShearModulus_kN_cm2=8076,
    TransverseShearModulus_kN_cm2=8076,
    SpecificWeight_kN_m3=78.5,
    CoefficientOfThermalExpansion_1_C=1.2e-05,
    TensileStrength_kN_cm2=23.5,
    CompressiveStrength_kN_cm2=-23.5,
    StrengthHypothesis="MISES",
    mode="Isotrop")
supp = SupportKaramba3D(PosInd=item_6, menu=[buttons(on, on, on, off, off, off)])
item_7 = ListItem(List=info.Nodes, Index=load.Index, Wrap=True)
Z_2 = UnitZ(Factor="-10")
loads = LoadsKaramba3D(ForceVector=Z_2, Local=False, PosInd=item_7, LCase="0", mode="Point")
material = MaterialKaramba3D(matprops)
support = SupportKaramba3D(supp)
load_2 = LoadKaramba3D(loads)

# ---- group: WebSockets for Julia
server_port = Panel("ws://127.0.0.1:2000/")
websocket_client_start = WebsocketClientStart(Address=server_port, InitalMessage=python_3, Reset=button)

# ----
websocket_client_start_2 = WebsocketClientStart(Address=server_port, InitalMessage="GS", Reset=button)  # disabled

# ---- group: WebSockets for Julia (continued)
websocket_client_receiver = WebsocketClientReceiver(WebsocketObjects=[websocket_client_start, websocket_client_start_2], AutoUpdate=Toggle(True))  # -> Message, Status
panel_5 = Panel(websocket_client_receiver.Message)
panel_6 = Panel(websocket_client_receiver.Status)

# ----
python_4 = GhPythonScript(input=websocket_client_receiver.Message, points=pt2num)  # -> out, output; inputs points: tree
# ---------- python_4: Python ----------
__author__ = "pitipatw"
__version__ = "2023.01.24"

import rhinoscriptsyntax as rs
import ghpythonlib.treehelpers as th
import json


output = []
list_points= th.tree_to_list(points, retrieve_base = None)
print(list_points)
dictofelements = json.loads(input)
for i in range(len(dictofelements)):
    temp = (dictofelements[str(i)])
    #, points[i])
    output.append(temp)
    
    
print(output[1])
print(output)
# ---------- end python_4 ----------
larger = LargerThan(FirstNumber=python_4.output, SecondNumber=0)  # -> LargerThan, OrEqualTo
cull_3 = CullPattern(List=item_2, CullPattern=larger.LargerThan)
cull_4 = CullPattern(List=vec2pt.Vector, CullPattern=larger.LargerThan)
cull_5 = CullPattern(List=vec2pt.Length, CullPattern=larger.LargerThan)
division = Division(A=python_4.output, B=Slider(45, range=10..100))
cull_6 = CullPattern(List=division, CullPattern=larger.LargerThan)
multiplication = Multiplication(A=cull_6, B=5)
circle_2 = CircleCNR(Center=cull_3, Normal=cull_4, Radius=cull_6)
rectangle = Rectangle(Plane=cull_3, XSize=multiplication, YSize=multiplication, Radius=0)  # -> Rectangle, Length
orient = Orient(Geometry=rectangle.Rectangle, Source=cull_4, Target=PlaneXY(0, 0, 0))  # -> Geometry, Transform
extr = Extrude(Base=circle_2, Direction=cull_4)
panel_7 = Panel(python_4.out)
extr_2 = Extrude(Base=rectangle.Rectangle, Direction=cull_4)
preview_3 = CustomPreview(Geometry=extr, Material=ColourSwatch(SwatchColor=RGB(0, 55, 255)))
line_3 = LineSDL(Start=cull_3, Direction=cull_4, Length=cull_5)
explode_3 = Explode(Curve=line_3, Recursive=True)  # -> Segments, Vertices
duppt_3 = RemoveDuplicatePts(Points=flatten(explode_3.Vertices), Tolerance=0.01)
linetobeam = LineToBeamKaramba3D(
    Line=line_3,
    New=True,
    Remove=True,
    LimitDistance_m=0.005,
    Bending=True,
    SetBucklingLength=True,
    ToPolylineMaxAngle=0.03,
    ToPolylineTolerance=0.01,
    ToPolylineMaxEdgeLength=0.25)  # -> Element, Points, Info
assemble = AssembleModelKaramba3D(
    Point=duppt_3,
    Elem=linetobeam.Element,
    Support=support,
    Load=load_2,
    CrossSection=cross_section,
    Material=material,
    LimitDistance_m=0.005)  # -> Model, Info, Mass_kg, CenterOfGravity, LoadCaseNames
analyze = AnalyzeKaramba3D(Model=assemble.Model)  # -> CalculatedModel, MaximumDisplacement_cm, ResultingForceOfGravity_kN, ElasticEnergyChange_kNm
b_forces = BeamForcesKaramba3D(AnalyzedModel=analyze.CalculatedModel, Ts=[0, 1])  # -> AnalyzedModel, NormalForce_kN, ShearForceVz_kN, ShearForceVy_kN, TorsionalMomentMt_kNm, BendingMomentMy_kNm, BendingMomentMz_kNm

# ==== cluster Time
time = ConstructTime(Hour=20, Minute=48, Second=0)
date = ConstructDate(Year=2023, Month=2, Day=7, Hour=12, Minute=0, Second=0)
cdate = CombineDateTime(Date=date, Time=time)
panel = Panel(cdate)
panel_2 = ClusterOutput(panel)
