# Grasshopper definition late07022023_GHandJuliaConnected3D.gh (Grasshopper 1.0.7)
# plug-ins: FDMremote, Kangaroo2 Components

extent_z = Slider(4, range=1..4)
recgrid = Rectangular(Plane=PlaneXY(0, 0, 0), SizeX="1", SizeY="1", ExtentX=Slider(5, range=2..5), ExtentY=Slider(4, range=1..4))  # -> flatten(Cells), flatten(Points)
series = Series(Start=1, Step=1, Count=extent_z)
pipeline = GeometryPipeline(
    GroupByLayer=False,
    GroupByType=False,
    IncludeHidden=True,
    IncludeLocked=True,
    LayerFilter="GroundStructure",
    NameFilter="*",
    SublayerFiltering=True,
    TypeFilter=4)
Z = UnitZ(Factor=series)  # -> graft(UnitVector)
explode = Explode(Curve=pipeline, Recursive=True)  # -> flatten(Segments), flatten(Vertices)
panel = Panel("""2
1""")
panel_2 = Panel("""0
3""")
move = Move(Geometry=recgrid.Points, Motion=Z)  # -> Geometry, Transform
move_2 = Move(Geometry=recgrid.Cells, Motion=Z)  # -> Geometry, Transform
divide = DivideCurve(Curve=explode.Segments, Count=10, Kinks=False)  # -> Points, Tangents, Parameters
pt = Point(recgrid.Points)
line = LineSDL(Start=move.Geometry, Direction=Vector(0, 0, -1), Length=1)
groundstructure = Curve(pipeline)
duppt = RemoveDuplicatePts(Points=explode.Vertices, Tolerance=0.01)
explode_2 = Explode(Curve=recgrid.Cells, Recursive=True)  # -> flatten(Segments), Vertices
inter = InterconnectPoints(Pts=pt)
merge = Merge(Data1=flatten(move_2.Geometry), Data2=flatten(line), Data3=recgrid.Cells)
inter_2 = InterconnectPoints()
item = ListItem(List=explode_2.Vertices, Index=panel_2, Wrap=True)
item_2 = ListItem(List=explode_2.Vertices, Index=panel, Wrap=True)
explode_3 = Explode(Curve=merge, Recursive=True)  # -> Segments, flatten(Vertices)
dupln = RemoveDuplicateLines(Lines=explode_2.Segments, Tolerance=0.01)
ln = Line(StartPoint=item, EndPoint=item_2)  # -> flatten(Line)
line_2 = Line(flatten([dupln, ln]))
duppt_2 = RemoveDuplicatePts(Points=explode_3.Vertices, Tolerance=0.01)
line_3 = Line(inter)

# ---- group: Select Low or Dense GS
filter = StreamFilter(Gate=Toggle(True), Stream0=line_3, Stream1=line_2)

# ----
inter_3 = InterconnectPoints(Pts=flatten(duppt_2))

# ----
# Ground Structure
# (BackUp)
pt_2 = Point(recgrid.Points)
line_4 = Line(filter)

# ----
# Ground Structure
line_5 = Line(inter_3)
pt_3 = Point(explode_3.Vertices)

supoprt_points = ListItem(List=pt_3, Index=0, Wrap=True)  # -> Item, Item1, Item2
create = CreateNetwork(
    Edges=flatten(line_5),
    Anchors=[supoprt_points.Item, supoprt_points.Item1, supoprt_points.Item2],
    ForceDensities=1,
    IntersectionTolerance=0.1)
info = NetworkInformation(FDMNetwork=create)  # -> Nodes, Edges, EdgeLengths, StartIndex, EndIndex, Anchors, ForceDensities, NumberEdges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
pdecon = Deconstruct(Point=info.Nodes)  # -> XComponent, YComponent, ZComponent
sort = SortList(Keys=pdecon.YComponent)  # -> Keys, ValuesA
sort_2 = SortList(Keys=pdecon.XComponent)  # -> Keys, ValuesA
smaller = SmallerThan(FirstNumber=info.EdgeLengths, SecondNumber="3")  # -> SmallerThan, OrEqualTo
sort_3 = SortList(Keys=pdecon.ZComponent)  # -> Keys, ValuesA
pt2num = PointsToNumbers(Points=graft(info.Nodes), Mask=4)  # -> simplify(Numbers)
item_3 = ListItem(List=sort.Keys, Index=-1, Wrap=True)
ma = MassAddition(Input=sort_2.Keys)  # -> Result, PartialResults
item_4 = ListItem(List=sort_2.Keys, Index=-1, Wrap=True)
date = ConstructDate(Year=2023, Month=2, Day=7, Hour=12, Minute=0, Second=0)
cull = CullPattern(List=info.StartIndex, CullPattern=smaller.OrEqualTo)
cull_2 = CullPattern(List=info.EndIndex, CullPattern=smaller.OrEqualTo)
item_5 = ListItem(List=sort_3.Keys, Index=-1, Wrap=True)
ma_2 = MassAddition(Input=sort.Keys)  # -> Result, PartialResults
lng = ListLength(List=pdecon.XComponent)
panel_3 = Panel(date)
lng_2 = ListLength(List=pdecon.YComponent)
division = Division(A=ma.Result, B=lng)
division_2 = Division(A=ma_2.Result, B=lng_2)
equals = Equality(FirstNumber=pdecon.ZComponent, SecondNumber=item_5)  # -> Equality, Inequality
expression = Expression(x=pdecon.XComponent, y=division, Expression="abs(x-y)")
expression_2 = Expression(x=pdecon.YComponent, y=division_2, Expression="abs(x-y)")
equals_2 = Equality(FirstNumber=pdecon.XComponent, SecondNumber=item_4)  # -> Equality, Inequality
equals_3 = Equality(FirstNumber=pdecon.ZComponent, SecondNumber="0")  # -> Equality, Inequality
equals_4 = Equality(FirstNumber=pdecon.XComponent, SecondNumber="0")  # -> Equality, Inequality
equals_5 = Equality(FirstNumber=pdecon.XComponent, SecondNumber=division)  # -> Equality, Inequality
smaller_2 = SmallerThan(FirstNumber=expression_2, SecondNumber="1")  # -> SmallerThan, OrEqualTo
smaller_3 = SmallerThan(FirstNumber=expression, SecondNumber="1")  # -> SmallerThan, OrEqualTo
or = GateOr(A=equals_4.Equality, B=equals_2.Equality)
and = GateAnd(A=equals.Equality, B=smaller_3.SmallerThan, C=smaller_2.SmallerThan)
and_2 = GateAnd(A=equals_3.Equality, B=or)
cull_3 = CullPattern(List=info.Nodes, CullPattern=and_2)
cull_4 = CullPattern(List=info.Nodes, CullPattern=and)
supports = ItemIndex(List=info.Nodes, Item=cull_3)
ptloads_id = ItemIndex(List=info.Nodes, Item=cull_4)
python = GhPythonScript(
    elements_i=cull,
    elements_j=cull_2,
    points=pt2num,
    supports=supports,
    loads=ptloads_id,
    maxVf=Slider(0.031, range=0.005..0.31),
    time=panel_3)  # -> out, c, output, supports; inputs elements_i: list, elements_j: list, points: tree, supports: list, loads: list
# ---------- python: Python ----------
__author__ = "pitipatw"
__version__ = "2023.01.24"

import rhinoscriptsyntax as rs
import ghpythonlib.treehelpers as th
import json

# assign static values
output = dict() 
output["model_name"] = "Pitipat_SMBT"
output["unit"] = "meter"
output["generate_time"] = time

output["model_type"] = "truss"

output["_info"] = "myFirstGHtoJuliaTopOpt"
output["TO_model_type"] = "ground_mesh"
# Processing Inputs
tree = th.tree_to_list(points, retrieve_base = None)

#input materials detail
materials = dict()
materials = [{"G12": 80760000.0,
            "E": 1000.0,
            "name": "DummyMaterial",
            "family": "DummyMaterial",
            "density": 78.5,
            "elem_tags": [],
            "E_unit": "kN/m2",
            "type_name": "ISO",
            "fy": 235000.0,
            "mu": 0.3,
            "density_unit": "kN/m3",
            "fy_unit": "kN/m2",
            "G12_unit": "kN/m2"}]
output["materials"] = materials

#make a default of 2 but then able to put in 3
output["dimension"] = 3




cross_secs = dict() 
cross_secs["A"] = 1 
cross_secs["name"] = ""
cross_secs["family"] = "DummyCroSecByPitipat"
cross_secs["elem_tags"] = []
cross_secs["A_unit"] = "m2" 
cross_secs["Iy"]= 2.1106547193827362e-06
cross_secs["Iz"]= 2.1106547193827362e-06
cross_secs["Jx"]= 4.2213094387654724e-06
cross_secs["name"]= "RO114.3/4"
output["cross_secs"] = [cross_secs]


nodes = dict()
nodes_list = list()
for i in range(len(tree)):
    dummy = dict()
    dummy["node_ind"] = i
    dummy["point"] = tree[i][0:3]
    dummy["is_grounded"] = False
    nodes_list.append(dummy)

output["nodes"] = nodes_list
elements_list = list() 
for i in range(len(elements_i)) : 
    dummy = dict() 
    dummy["elem_ind"] = i
    dummy["end_node_inds"] = [ elements_i[i], elements_j[i]]
    dummy["elem_tag"] = ""
    dummy["bending_stiff"] = False
    elements_list.append(dummy)

supports_list = list()
check = True
for i in supports: 
    dummy = dict()
    dummy["node_ind"] = i
    if check :
        dummy["condition"] = [1,1,1,0,0,0]
        #check = False
    else :
        dummy["condition"] = [0,1]
    supports_list.append(dummy)
output["supports"] = supports_list

output["joints"] = []

loadcases_dict = dict()
#this is load case "0"
loadcases_0 = dict()
loadcases_0["lc_ind"] = 0
ploads = dict()
load_list = list()
for i in loads :
    dummy = dict()
    dummy["node_ind"] = int(i)
    dummy["force"]  = [0.0, 0.0, -1.0]
    dummy["moment"] = [0.0, 0.0, 0.0]
    dummy["loadcase"] = str(i)
    dummy["force_unit"] = "kN"
    load_list.append(dummy)
loadcases_0["ploads"] = load_list
loadcases_0["eloads"] = []
loadcases_0["gravity"] = ""
loadcases_dict["0"] = loadcases_0

output["loadcases"] = loadcases_dict


output["elements"] = elements_list

#====Node and Element numbers are here!====
output["node_num"] = len(tree)
output["element_num"] = len(elements_list) 
#====




output["maxVf"] = maxVf




print(json.dumps(output))
# ---------- end python ----------
panel_4 = Panel(python.out)
websocket_client_start = WebsocketClientStart(Address="ws://127.0.0.1:2000/", InitalMessage=python.out, Reset=Button())
websocket_client_receiver = WebsocketClientReceiver(WebsocketObjects=websocket_client_start, AutoUpdate=Toggle(True))  # -> Message, Status
panel_5 = Panel(websocket_client_receiver.Message)
panel_6 = Panel(websocket_client_receiver.Status)
panel_7 = Panel("fc_prime")
