# Grasshopper definition 3D_TopOpt_night23FEB.gh (Grasshopper 1.0.7)
# plug-ins: FDMremote, Kangaroo2 Components, Pufferfish

# ---- group: TopOpt Control
# Control Panel
max_volume_fraction = Slider(0.3, range=0.005..0.705)
# 5 4 6
# 0.27
# "2"
# 0.27
# fail
# 5 4 6
# 0.27
# 3
# 0.27
# pass
max_members_length = Slider(1.5, range=0..10)
# This is a Topology Optimization using TopOpt.jl
# 
# last major modified: 10 Feb 2023
button = Button()

# ----
number_slider = Slider(60, range=0..100)

extent_z = Slider(1, range=1..51)

recgrid = Rectangular(Plane=PlaneXY(0, 0, 0), SizeX=1, SizeY=1, ExtentX=Slider(1, range=1..52), ExtentY=Slider(1, range=0..101))  # -> flatten(Cells), flatten(Points)
series = Series(Start=1, Step=1, Count=extent_z)
Z = UnitZ(Factor=series)  # -> graft(UnitVector)
move = Move(Geometry=recgrid.Cells, Motion=Z)  # -> Geometry, Transform
move_2 = Move(Geometry=recgrid.Points, Motion=Z)  # -> Geometry, Transform
line = LineSDL(Start=move_2.Geometry, Direction=Vector(0, 0, -1), Length=1)
# To do
# 
# visualize support points
# 
# Specified applied load values
# 
# visualize load points and direction (scales with value)
# 
# 
# movable points (optional: movable groundstructure)
# 
# color
# 
# Specify domain size
# and the nX,nY,nZ are divisions instead of keep adding
merge = Merge(Data1=flatten(move.Geometry), Data2=recgrid.Cells, Data3=flatten(line))
explode = Explode(Curve=merge, Recursive=True)  # -> Segments, flatten(Vertices)
duppt = RemoveDuplicatePts(Points=explode.Vertices, Tolerance=0.01)
inter = InterconnectPoints(Pts=flatten(duppt))
len = Length(Curve=inter)
smaller = SmallerThan(FirstNumber=len, SecondNumber=max_members_length)  # -> SmallerThan, OrEqualTo
cull = CullPattern(List=inter, CullPattern=smaller.SmallerThan)
pipeline = GeometryPipeline(
    GroupByLayer=False,
    GroupByType=False,
    IncludeHidden=True,
    IncludeLocked=True,
    LayerFilter="support points",
    NameFilter="*",
    SublayerFiltering=True,
    TypeFilter=1)
pipeline_2 = GeometryPipeline(
    GroupByLayer=False,
    GroupByType=False,
    IncludeHidden=True,
    IncludeLocked=True,
    LayerFilter="load points",
    NameFilter="*",
    SublayerFiltering=True,
    TypeFilter=1)

# ----
# Ground Structure
pt = Point(duppt)
line_2 = Line(cull)

list = ValueList({"All": 0, "Mid X": 1, "Mid Y": 2, "Mid X&Y": 3}, selected="Mid X&Y")
supoprt_points = ListItem(List=pt, Index=0, Wrap=True)  # -> Item, Item1, Item2
create = CreateNetwork(
    Edges=flatten(line_2),
    Anchors=[supoprt_points.Item, supoprt_points.Item1, supoprt_points.Item2],
    ForceDensities=1,
    IntersectionTolerance=0.1)
info = NetworkInformation(FDMNetwork=create)  # -> Nodes, Edges, EdgeLengths, StartIndex, EndIndex, Anchors, ForceDensities, NumberEdges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
# For quick test, no layers
# supports on all lowest points
# loads on all highest points
pdecon = Deconstruct(Point=info.Nodes)  # -> XComponent, YComponent, ZComponent
sort_y = SortList(Keys=pdecon.YComponent)  # -> Keys, ValuesA
sort_x = SortList(Keys=pdecon.XComponent)  # -> Keys, ValuesA
sort_z = SortList(Keys=pdecon.ZComponent)  # -> Keys, ValuesA
item = ListItem(List=sort_y.Keys, Index=0, Wrap=True)  # -> Item1, Item
division = Division(A=item.Item1, B=2)
panel = Panel(division)
expression = Expression(x=pdecon.YComponent, y=division, Expression="abs(x-y)")
item_2 = ListItem(List=sort_x.Keys, Index=0, Wrap=True)  # -> Item1, Item
division_2 = Division(A=item_2.Item1, B=2)
panel_2 = Panel(division_2)
expression_2 = Expression(x=pdecon.XComponent, y=division_2, Expression="abs(x-y)")
item_3 = ListItem(List=sort_z.Keys, Index=0, Wrap=True)  # -> Item1, Item
item_4 = ListItem(List=info.Nodes, Index=info.StartIndex, Wrap=True)
item_5 = ListItem(List=info.Nodes, Index=info.EndIndex, Wrap=True)
mindex = MemberIndex(Set=info.Nodes, Member=pipeline_2)  # -> flatten(Index), Count
mindex_2 = MemberIndex(Set=info.Nodes, Member=pipeline)  # -> flatten(Index), Count
equalst = EqualityWithinTolerance(FirstNumber=pdecon.ZComponent, SecondNumber=item_3.Item, Tolerance=0.001)  # -> Equality, Inequality
equalst_2 = EqualityWithinTolerance(FirstNumber=pdecon.YComponent, SecondNumber=item.Item1, Tolerance=0.001)  # -> Equality, Inequality
equalst_3 = EqualityWithinTolerance(FirstNumber=pdecon.XComponent, SecondNumber="1", Tolerance=0.001)  # -> Equality, Inequality; disabled
equalst_4 = EqualityWithinTolerance(FirstNumber=pdecon.YComponent, SecondNumber=item.Item, Tolerance=0.001)  # -> Equality, Inequality
or = GateOr(A=equalst_2.Equality, B=equalst_4.Equality)
equalst_5 = EqualityWithinTolerance(FirstNumber=pdecon.ZComponent, SecondNumber=item_3.Item1, Tolerance=0.001)  # -> Equality, Inequality
pt2num = PointsToNumbers(Points=graft(info.Nodes), Mask=4)  # -> simplify(Numbers)
and = GateAnd(A=equalst.Equality, B=or, C=equalst_3.Inequality)
cull_2 = CullPattern(List=info.Nodes, CullPattern=equalst_2.Equality)
cull_3 = CullPattern(List=info.Nodes, CullPattern=equalst_4.Equality)
and_2 = GateAnd(A=and, B=equalst_4.Equality)
smaller_2 = SmallerThan(FirstNumber=expression, SecondNumber=Slider(0.5, range=0..1))  # -> SmallerThan, OrEqualTo
smaller_3 = SmallerThan(FirstNumber=expression_2, SecondNumber=Slider(0.5, range=0..1))  # -> SmallerThan, OrEqualTo
and_3 = GateAnd(A=smaller_3.OrEqualTo, B=smaller_2.OrEqualTo)
filter = StreamFilter(Gate=list, Stream0="1", Stream1=smaller_3.OrEqualTo, Stream2=smaller_2.OrEqualTo, Stream3=and_3)
and_4 = GateAnd(A=filter, B=equalst_5.Equality)
cull_4 = CullPattern(List=info.Nodes, CullPattern=and)
cull_5 = CullPattern(List=info.Nodes, CullPattern=and_2)
cull_6 = CullPattern(List=info.Nodes, CullPattern=and_4)
time = Time()
load_inds = ItemIndex(List=info.Nodes, Item=cull_2)
support_inds = ItemIndex(List=info.Nodes, Item=cull_3)
support_inds_2 = ItemIndex(List=info.Nodes, Item=cull_4)
supports_inds = Number(support_inds_2)

# ---- group: Supports Visualization
item_6 = ListItem(List=info.Nodes, Index=supports_inds, Wrap=True)
cone = Cone(Base=item_6, Radius=0.1, Length=0.1)  # -> Cone, Tip
preview = CustomPreview(Geometry=cone.Cone, Material=ColourSwatch(SwatchColor=RGB(64, 255, 175)))

# ----
load_inds_2 = ItemIndex(List=info.Nodes, Item=cull_6)
load_inds_3 = Number(load_inds_2)
suppor_rollert_inds = ItemIndex(List=info.Nodes, Item=cull_5)
id = Panel(load_inds_2)
lng = ListLength(List=load_inds_2)
y_kn = Panel("""0
0
0
0
0
0
0
0
0
0
0
0
0
0
0
0
0
0
0
0""")
concat = Concatenate(FragmentA="Please input ", FragmentB=lng, FragmentC=" load values as [x, y, z] kN")
panel_3 = Panel(concat)
z_kn = Panel("""-10
-10
-10
-10
-10
-10
-10
-10
-10
-10
-10
-10
-10
-10
-10
-10
-10
-10
-10
-10""")

# ---- group: Loads Visualization
item_7 = ListItem(List=info.Nodes, Index=load_inds_3, Wrap=True)
cone_2 = Cone(Base=item_7, Radius=0.1, Length=expr("x/100", z_kn))  # -> Cone, Tip
move_3 = Move(Geometry=cone_2.Cone, Motion=Vector(0, 0, 0.1))  # -> Geometry, Transform
preview_2 = CustomPreview(Geometry=move_3.Geometry, Material=ColourSwatch(SwatchColor=RGB(255, 64, 64)))

# ----
x_kn = Panel("""0
0
0
0
0
0
0
0
0
0
0
0
0
0
0
0
0
0
0
0""")
merge_2 = Merge(Data1=graft(x_kn), Data2=graft(y_kn), Data3=graft(z_kn))  # -> simplify(Result)
python = GhPythonScript(
    elements_i=info.StartIndex,
    elements_j=info.EndIndex,
    points=pt2num,
    supports=supports_inds,
    supports_rollery=suppor_rollert_inds,
    load_points=load_inds_3,
    load_values=merge_2,
    maxVf=max_volume_fraction,
    time=time)  # -> out; inputs elements_i: list, elements_j: list, points: tree, supports: list, supports_rollery: list, load_points: list, load_values: tree
# ---------- python: Python ----------
__author__ = "pitipatw"
__version__ = "2023.01.24"

import rhinoscriptsyntax as rs
import ghpythonlib.treehelpers as th
import json

# assign static values
output = dict() 
output["model_name"] = "Pitipat_SMBT"
output["unit"] = "meter"
output["generate_time"] = time

output["model_type"] = "truss"

output["_info"] = "myFirstGHtoJuliaTopOpt"
output["TO_model_type"] = "ground_mesh"
# Processing Inputs
tree = th.tree_to_list(points, retrieve_base = None)

#input materials detail
materials = dict()
materials = [{"G12": 80760000.0,
            "E": 1000.0,
            "name": "DummyMaterial",
            "family": "DummyMaterial",
            "density": 78.5,
            "elem_tags": [],
            "E_unit": "kN/m2",
            "type_name": "ISO",
            "fy": 235000.0,
            "mu": 0.3,
            "density_unit": "kN/m3",
            "fy_unit": "kN/m2",
            "G12_unit": "kN/m2"}]
output["materials"] = materials

#make a default of 2 but then able to put in 3
output["dimension"] = 3




cross_secs = dict() 
cross_secs["A"] = 1 
cross_secs["name"] = ""
cross_secs["family"] = "DummyCroSecByPitipat"
cross_secs["elem_tags"] = []
cross_secs["A_unit"] = "m2" 
cross_secs["Iy"]= 2.1106547193827362e-06
cross_secs["Iz"]= 2.1106547193827362e-06
cross_secs["Jx"]= 4.2213094387654724e-06
cross_secs["name"]= "RO114.3/4"
output["cross_secs"] = [cross_secs]


nodes = dict()
nodes_list = list()
for i in range(len(tree)):
    dummy = dict()
    dummy["node_ind"] = i
    dummy["point"] = tree[i][0:3]
    dummy["is_grounded"] = False
    nodes_list.append(dummy)

output["nodes"] = nodes_list
elements_list = list() 
for i in range(len(elements_i)) : 
    dummy = dict() 
    dummy["elem_ind"] = i
    dummy["end_node_inds"] = [ elements_i[i], elements_j[i]]
    dummy["elem_tag"] = ""
    dummy["bending_stiff"] = False
    elements_list.append(dummy)

supports_list = list()

check = True
for i in supports: 
    dummy = dict()
    dummy["node_ind"] = int(i)
    if check :
        if i in supports_rollery :
            dummy["condition"] = [1,0,1,0,0,0] #roller on y
        else :
            dummy["condition"] = [1,1,1,0,0,0] #pin x y z
        #check = False
    else :
        dummy["condition"] = [0,0,0,0,0,0]
    supports_list.append(dummy)
output["supports"] = supports_list

output["joints"] = []


load_value_list = th.tree_to_list(load_values, retrieve_base = None)

loadcases_dict = dict()
#this is load case "0"
loadcases_0 = dict()
loadcases_0["lc_ind"] = 0
ploads = dict()
load_list = list()
for i in range(len(load_points)) :
    dummy = dict()
    dummy["node_ind"] = load_points[i]
    if i > (len(load_value_list)-1) : 
        x = 0.0
        y = 0.0 
        z = 0.0
    else:
        [x,y,z] = load_value_list[i]
    dummy["force"]  = [int(x),int(y),int(z)]
    dummy["moment"] = [0.0, 0.0, 0.0] #No moment for now
    dummy["loadcase"] = str(i)
    dummy["force_unit"] = "kN"
    load_list.append(dummy)
loadcases_0["ploads"] = load_list
loadcases_0["eloads"] = []
loadcases_0["gravity"] = ""
loadcases_dict["0"] = loadcases_0

output["loadcases"] = loadcases_dict


output["elements"] = elements_list

#====Node and Element numbers are here!====
output["node_num"] = len(tree)
output["element_num"] = len(elements_list) 
#====

output["maxVf"] = maxVf


print(json.dumps(output))
# ---------- end python ----------

# ---- group: WebSockets for Julia
websocket_client_start = WebsocketClientStart(Address="ws://127.0.0.1:2000/", InitalMessage=python, Reset=button)
websocket_client_receiver = WebsocketClientReceiver(WebsocketObjects=websocket_client_start, AutoUpdate=Toggle(True))  # -> Message, Status
panel_4 = Panel(websocket_client_receiver.Status)
panel_5 = Panel(websocket_client_receiver.Message)

# ----
vec2pt = Vector2Pt(PointA=item_4, PointB=item_5, Unitize=False)  # -> Vector, Length
panel_6 = Panel(merge_2)
python_2 = GhPythonScript(input=websocket_client_receiver.Message, points=pt2num)  # -> out, output; inputs points: tree
# ---------- python_2: Python ----------
__author__ = "pitipatw"
__version__ = "2023.01.24"

import rhinoscriptsyntax as rs
import ghpythonlib.treehelpers as th
import json


output = []
list_points= th.tree_to_list(points, retrieve_base = None)
print(list_points)
dictofelements = json.loads(input)
for i in range(len(dictofelements)):
    temp = (dictofelements[str(i)])
    #, points[i])
    output.append(temp)
    
    
print(output[1])
print(output)
# ---------- end python_2 ----------
larger = LargerThan(FirstNumber=python_2.output, SecondNumber=0)  # -> LargerThan, OrEqualTo
cull_7 = CullPattern(List=item_4, CullPattern=larger.LargerThan)
cull_8 = CullPattern(List=vec2pt.Vector, CullPattern=larger.LargerThan)
cull_9 = CullPattern(List=vec2pt.Length, CullPattern=larger.LargerThan)
division_3 = Division(A=python_2.output, B=Slider(45, range=10..100))
cull_10 = CullPattern(List=division_3, CullPattern=larger.LargerThan)
line_3 = LineSDL(Start=cull_7, Direction=cull_8, Length=cull_9)
multiplication = Multiplication(A=cull_10, B=5)
Y = UnitY(Factor=Slider(6, range=0..20))
circle = CircleCNR(Center=cull_7, Normal=cull_8, Radius=cull_10)
align = AlignPlanes()
rectangle = Rectangle(Plane=cull_7, XSize=multiplication, YSize=multiplication, Radius=0)  # -> Rectangle, Length
move_4 = Move(Geometry=line_2, Motion=Y)  # -> Geometry, Transform
orient = Orient(Geometry=rectangle.Rectangle, Source=cull_8, Target=PlaneXY(0, 0, 0))  # -> Geometry, Transform
panel_7 = Panel(python_2.out)
extr = Extrude(Base=circle, Direction=cull_8)
extr_2 = Extrude(Base=rectangle.Rectangle, Direction=cull_8)
preview_3 = CustomPreview(Geometry=extr, Material=ColourSwatch(SwatchColor=RGB(0, 55, 255)))

# ==== cluster Time
time = ConstructTime(Hour=20, Minute=48, Second=0)
date = ConstructDate(Year=2023, Month=2, Day=7, Hour=12, Minute=0, Second=0)
cdate = CombineDateTime(Date=date, Time=time)
panel = Panel(cdate)
panel_2 = ClusterOutput(panel)
